# Grasshopper definition C#_WS_Examples_001.gh (Grasshopper 1.0.7)
# plug-ins: Bifocals

# C#_WS_Examples_001
genes = GenePool(
    Decimals=2,
    Maximum=100,
    Minimum=0,
    Value=[34.90827016, 25.33473348, 43.217234, 10.43849377, 81.03106995, 32.72204574, 72.32126702, 66.80885303, 67.4794551, 19.37739861])
genes_2 = GenePool(
    Decimals=2,
    Maximum=100,
    Minimum=0,
    Value=[74.56361934, 2.340053023, 1.234632545, 67.21139991, 43.34703881, 95.42041933, 57.66104784, 55.09482979, 30.14270618, 24.88406539])
genes_3 = GenePool(
    Decimals=2,
    Maximum=100,
    Minimum=0,
    Value=[69.75006194, 12.89536041, 60.20431638, 93.48050896, 54.81138423, 62.10463767, 26.69630755, 89.70269397, 40.51114518, 35.32090869])
createpointinitializexyz = CreatePointIntializeXYZ(x=genes, y=genes_2, z=genes_3)  # -> out, Point; inputs x: Double, y: Double, z: Double
# ---------- createpointinitializexyz: C# usings ----------
using System.IO;
using System.Linq;
using System.Data;
using System.Drawing;
using System.Reflection;
using System.Windows.Forms;
using System.Xml;
using System.Xml.Linq;
using System.Runtime.InteropServices;

using Rhino.DocObjects;
using Rhino.Collections;
using GH_IO;
using GH_IO.Serialization;
# ---------- createpointinitializexyz: C# ----------
    //Create an instance of a point and initialize to x, y and z
    Point3d pt = new Point3d(x, y, z);

    //Assign the point "pt" to output
    Point = pt;
# ---------- end createpointinitializexyz ----------
graft = GraftTree(Tree=createpointinitializexyz.Point, IncludeEmptyLists=True, IncludeNullItems=True)
bang = ExplodeTree(Data=graft)  # -> Branch0, Branch1, Branch2, Branch3, Branch4, Branch5, Branch6, Branch7, Branch8, Branch9
constructorcreatepolylinecrvfrompts = ConstructorCreatePolylineCurveFromPoints(
    x=bang.Branch0,
    y=bang.Branch1,
    z=bang.Branch2,
    u=bang.Branch3,
    v=bang.Branch4,
    w=bang.Branch5,
    xx=bang.Branch6,
    xy=bang.Branch7,
    xz=bang.Branch8)  # -> out, OutPlineCurve, Points; inputs x: Double, y: Double, z: Double, u: Double, v: Double, w: Double, xx: Double, xy: Double, xz: Double
# ---------- constructorcreatepolylinecrvfrompts: C# ----------
    var p0 = new Point3d(x, y, z);
    var p1 = new Point3d(u, v, w);
    var p2 = new Point3d(xx, xy, xz);
    Point3d[] pointList = {p0, p1, p2};

    //Create a new instance of ArcCurve
    PolylineCurve plineCurve = new PolylineCurve(pointList);

    //Check if the curve is valid then assign curve to the output value A
    if (plineCurve != null)
      OutPlineCurve = plineCurve;

    Points = pointList;
# ---------- end constructorcreatepolylinecrvfrompts ----------
constructorcreatepolylinecrvfrompts_2 = ConstructorCreatePolylineCurveFromPoints(x=genes, y=genes_2, z=genes_3)  # -> out, OutPlineCurve, Points; inputs x: Double, y: Double, z: Double, u: Double, v: Double, w: Double, xx: Double, xy: Double, xz: Double; same code as constructorcreatepolylinecrvfrompts
graft_2 = GraftTree(Tree=constructorcreatepolylinecrvfrompts_2.OutPlineCurve, IncludeEmptyLists=True, IncludeNullItems=True)
createrevsrffromlinecrv = CreateRevSurfaceFromLineAndCurve(revCrv=constructorcreatepolylinecrvfrompts.OutPlineCurve, revAxis=graft(graft_2))  # -> out, RevolutionSurface; inputs revCrv: Curve, revAxis: Line
# ---------- createrevsrffromlinecrv: C# ----------
    var revSrf = RevSurface.Create(revCrv, revAxis);

    RevolutionSurface = revSrf;
# ---------- end createrevsrffromlinecrv ----------
cap = CapHoles(Brep=createrevsrffromlinecrv.RevolutionSurface)
