# Grasshopper definition C#_WS_Examples_002.gh (Grasshopper 1.0.7)
# plug-ins: Bifocals

# C#_WS_Examples_002
gene_pool = GenePool(Decimals=1, Maximum=1, Minimum=0, Value=[0, 0, 1, 1, 0, 0, 1, 1])
gene_pool_2 = GenePool(Decimals=1, Maximum=1, Minimum=0, Value=[0, 0, 0, 0, 1, 0.9758850206, 1, 1])
gene_pool_3 = GenePool(Decimals=1, Maximum=1, Minimum=0, Value=[0, 1, 1, 0, 0, 1, 1, 0])
createpointintializexyz = CreatePointIntializeXYZ(x=gene_pool, y=gene_pool_3, z=gene_pool_2)  # -> out, Point; inputs x: Double, y: Double, z: Double
# ---------- createpointintializexyz: C# usings ----------
using System.IO;
using System.Linq;
using System.Data;
using System.Drawing;
using System.Reflection;
using System.Windows.Forms;
using System.Xml;
using System.Xml.Linq;
using System.Runtime.InteropServices;

using Rhino.DocObjects;
using Rhino.Collections;
using GH_IO;
using GH_IO.Serialization;
# ---------- createpointintializexyz: C# ----------
    //Create an instance of a point and initialize to x, y and z
    Point3d pt = new Point3d(x, y, z);

    //Assign the point "pt" to output
    Point = pt;
# ---------- end createpointintializexyz ----------
sphere = Sphere(Base=createpointintializexyz.Point, Radius=0.1)
createbrepbox = CreateBrepBox(corners=createpointintializexyz.Point)  # -> out, BrepBox; inputs corners: list of Point3d
# ---------- createbrepbox: C# ----------
    //Build the brep from corners
    Brep twistedBox = Brep.CreateFromBox(corners);

    BrepBox = twistedBox;
# ---------- end createbrepbox ----------
gene_pool_4 = GenePool(Decimals=1, Maximum=1, Minimum=0, Value=[0, 1, 1, 0, 0, 1, 1, 0])
gene_pool_5 = GenePool(Decimals=1, Maximum=1, Minimum=0, Value=[0, 0, 1, 1, 1, 1, 0, 0])
gene_pool_6 = GenePool(Decimals=1, Maximum=1, Minimum=0, Value=[0, 0, 1, 1, 0, 0, 1, 1])
createpointintializexyz_2 = CreatePointIntializeXYZ(x=gene_pool_6, y=gene_pool_4, z=gene_pool_5)  # -> out, Point; inputs x: Double, y: Double, z: Double; same code as createpointintializexyz
createbrepbox_2 = CreateBrepBox(corners=createpointintializexyz_2.Point)  # -> out, BrepBox; inputs corners: list of Point3d; same code as createbrepbox
sphere_2 = Sphere(Base=createpointintializexyz_2.Point, Radius=0.1)
