# Grasshopper definition C#_WS_Examples_003.gh (Grasshopper 1.0.7)
# plug-ins: Bifocals, MeshEdit Components

number_slider = Slider(2, range=0..10)
# C#_WS_Examples_003
number_slider_2 = Slider(5, range=0..10)
constructtreeofnumbers = ConstructTreeOfNumbers(branchNum=number_slider_2, countNum=number_slider, number=Slider(4, range=0..10))  # -> out, Numbers; inputs branchNum: Int32, countNum: Int32, number: Int32
# ---------- constructtreeofnumbers: C# usings ----------
using System.IO;
using System.Linq;
using System.Data;
using System.Drawing;
using System.Reflection;
using System.Windows.Forms;
using System.Xml;
using System.Xml.Linq;
using System.Runtime.InteropServices;

using Rhino.DocObjects;
using Rhino.Collections;
using GH_IO;
using GH_IO.Serialization;
# ---------- constructtreeofnumbers: C# ----------
    DataTree<double> numTree = new DataTree<double>();
    int pathIndex = 0;
    for (int b = 1; b <= branchNum; b++) {
      List<double> numList = new List<double>();
      GH_Path path = new GH_Path(pathIndex);
      pathIndex = pathIndex + 1;
      for (int i = 1; i <= countNum; i++) {
        numList.Add(number * i * b);
      }
      numTree.AddRange(numList, path);
    }
    Numbers = numTree;
# ---------- end constructtreeofnumbers ----------
panel = Panel(constructtreeofnumbers.Numbers)
structpointpassedbyvalue = StructPointPassedByValue(x=panel)  # -> out, flatten(Point); inputs x: Double, y: Double, z: Double
# ---------- structpointpassedbyvalue: C# ----------
    Point3d pt = new Point3d(x, y, z);
    Print("pt.X before ChaneX: " + pt.X);

    //Call a function to change the value of X in the point
    ChangeX(pt);

    Print("pt.X after ChaneX: x=" + pt.X);

    Point = pt;
# ---------- structpointpassedbyvalue: C# additional code ----------
  public void ChangeX(Point3d pt)
  {
    pt.X = 100;
    Print("pt.X inside ChaneX: x=" + pt.X);
  }
# ---------- end structpointpassedbyvalue ----------
construct_domain = ConstructDomain(DomainStart=Slider(0.52, range=0..10), DomainEnd=Slider(3.93, range=0..10))
list_length = ListLength(List=structpointpassedbyvalue.Point)
number_slider_3 = Slider(1, range=0..1)
range = Range(Domain=construct_domain, Steps=expr("x-1", list_length))
range_2 = Range(Domain=Slider(29, range=0..100), Steps=expr("x-1", list_length))
construct_point = ConstructPoint(XCoordinate=0, YCoordinate=0, ZCoordinate=0)
unit_y = UnitY(Factor=range_2)
pi = Pi(Factor=range)
transformscalerotatemove = TransformScaleRotateMove(center=construct_point, objs=structpointpassedbyvalue.Point, factor=number_slider_3, angle=pi, dir=unit_y)  # -> out, flatten(XformGeom); inputs center: Point3d, objs: list of GeometryBase, factor: Double, angle: Double, dir: Vector3d
# ---------- transformscalerotatemove: C# ----------
    //Create a new list of geometry objects
    List<GeometryBase> newGeom = new List<GeometryBase>();


    foreach (GeometryBase obj in objs) {
      //scale, rotate And move
      obj.Scale(factor);
      obj.Rotate(angle, Vector3d.YAxis, center);
      obj.Translate(dir);

      //add to list
      newGeom.Add(obj);
    }

    //Assign output
    XformGeom = newGeom;
# ---------- end transformscalerotatemove ----------
surface_from_points = SurfaceFromPoints(Points=transformscalerotatemove.XformGeom, UCount=number_slider, Interpolate=False)
transformscalerotatemove_2 = TransformScaleRotateMove(center=construct_point, objs=surface_from_points, factor=number_slider_3, angle=pi, dir=unit_y)  # -> out, flatten(XformGeom); inputs center: Point3d, objs: list of GeometryBase, factor: Double, angle: Double, dir: Vector3d; same code as transformscalerotatemove
transformscalerotatemove_3 = TransformScaleRotateMove(center=construct_point, objs=transformscalerotatemove_2.XformGeom, factor=number_slider_3, angle=pi, dir=unit_y)  # -> out, flatten(XformGeom); inputs center: Point3d, objs: list of GeometryBase, factor: Double, angle: Double, dir: Vector3d; same code as transformscalerotatemove

number_slider_4 = Slider(42, range=0..100)
surface = Surface(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)
divide_surface = DivideSurface(Surface=surface, UCount=number_slider_4, VCount=number_slider_4)  # -> Points, Normals, Parameters
amplitude = Amplitude(Vector=divide_surface.Normals, Amplitude=Slider(0.981, range=0.001..2))
vector_display = VectorDisplay(Anchor=divide_surface.Points, Vector=divide_surface.Normals)
move = Move(Geometry=divide_surface.Points, Motion=amplitude)  # -> flatten(Geometry), Transform
expression = Expression(x=number_slider_4, Expression="x+1")
surface_from_points_2 = SurfaceFromPoints(Points=move.Geometry, UCount=expression, Interpolate=False)
mesh_frompoints = MeshFromPoints(Points=move.Geometry, UDirection=expression, VDirection=expression)
deconstruct_brep = DeconstructBrep(Brep=surface_from_points_2)  # -> Faces, graft(Edges), Vertices
deconstruct_brep_2 = DeconstructBrep(Brep=surface)  # -> Faces, graft(Edges), Vertices
loft = Loft(
    Curves=[deconstruct_brep.Edges, deconstruct_brep_2.Edges],
    Options={Adjust=False, Closed=False, LoftEnds=0, LoftSimp=0, LoftType=0, Rebuild=10, Refit=0.01})  # -> flatten(Loft)

merge = Merge(Data1=surface_from_points_2, Data2=loft, Data3=surface)

brep_join = BrepJoin(Breps=merge)  # -> Breps, Closed
