# Grasshopper definition C#_WS_Examples_004.gh (Grasshopper 1.0.7)
# plug-ins: Bifocals

# C#_WS_Examples_004
number_slider = Slider(2, range=0..10)
l_04_randomnumbergenerator = L_04_RandomNumberGenerator(min=number_slider, max=Slider(3, range=0..10), count=Slider(3, range=0..10), seed=Slider(12, range=0..100))  # -> out, numbers; inputs min: Double, max: Double, count: Int32, seed: Int32
# ---------- l_04_randomnumbergenerator: C# ----------
    Component.Message = "Random numbers";

    Random randGen = new Random(seed);
    List<double> randomNumbers = new List<double>();

    for(int i = 0; i < count; i++)
    {
      randomNumbers.Add(randGen.NextDouble() * (max - min) + min);    
      //Random.NextDouble() returns a value between 0.0 and 1.0 
      //(actually 0.99999999999999978 because of binary representation of a floating point number)
    }

    numbers = randomNumbers;
# ---------- end l_04_randomnumbergenerator ----------
jitter = Jitter(List=l_04_randomnumbergenerator.numbers, Jitter=Slider(0.26, range=0..1), Seed=2)  # -> Values, Indices
jitter_2 = Jitter(List=l_04_randomnumbergenerator.numbers, Jitter=Slider(0.59, range=0..1), Seed=2)  # -> Values, Indices
k_08_gridofpoints_multidimarray = K_08_GridOfPointsMultiDimArray(x=l_04_randomnumbergenerator.numbers, y=jitter.Values, z=jitter_2.Values, spacing=Slider(2.75, range=0..10))  # -> out, ptGrid; inputs x: Int32, y: Int32, z: Int32, spacing: Double
# ---------- k_08_gridofpoints_multidimarray: C# ----------
    Point3d[,,] grid = new Point3d[x, y, z];  //a multidimensional array

    for(int i = 0; i < x; i++)
    {
      for(int j = 0; j < y; j++)
      {
        for(int k = 0; k < z; k++)
        {
          Print("i: {0}, j: {1}, k: {2}", i, j, k);
          grid[i, j, k].X = i * spacing;
          grid[i, j, k].Y = j * spacing;
          grid[i, j, k].Z = k * spacing;
        }
      }
    }

    ptGrid = grid;
# ---------- end k_08_gridofpoints_multidimarray ----------
list_length = ListLength(List=k_08_gridofpoints_multidimarray.ptGrid)
range = Range(Domain=Slider(0.4, range=0..2), Steps=expr("x-1", list_length))
pi = Pi(Factor=range)
polar_array = PolarArray(Geometry=k_08_gridofpoints_multidimarray.ptGrid, Plane=PlaneXY(0, 0, 0), Count=Slider(5, range=0..10), Angle=pi)  # -> simplify(flatten(Geometry)), Transform
flip_matrix = FlipMatrix(Data=polar_array.Geometry)  # -> flatten(Data)
surface_from_points = SurfaceFromPoints(Points=flip_matrix, UCount=Slider(10, range=0..100), Interpolate=False)
