# Grasshopper definition C#_WS_Examples_005.gh (Grasshopper 1.0.7)
# plug-ins: Bifocals

# ----
# C#_WS_Examples_005
constructtreeofnumbers = ConstructTreeOfNumbers(branchNum=Slider(3, range=0..10), countNum=Slider(5, range=0..10), number=Slider(3, range=1..3))  # -> out, Numbers; inputs branchNum: Int32, countNum: Int32, number: Int32
# ---------- constructtreeofnumbers: C# usings ----------
using System.IO;
using System.Linq;
using System.Data;
using System.Drawing;
using System.Reflection;
using System.Windows.Forms;
using System.Xml;
using System.Xml.Linq;
using System.Runtime.InteropServices;

using Rhino.DocObjects;
using Rhino.Collections;
using GH_IO;
using GH_IO.Serialization;
# ---------- constructtreeofnumbers: C# ----------
    DataTree<double> numTree = new DataTree<double>();
    int pathIndex = 0;
    for (int b = 1; b <= branchNum; b++) {
      List<double> numList = new List<double>();
      GH_Path path = new GH_Path(pathIndex);
      pathIndex = pathIndex + 1;
      for (int i = 1; i <= countNum; i++) {
        numList.Add(number * i * b);
      }
      numTree.AddRange(numList, path);
    }
    Numbers = numTree;
# ---------- end constructtreeofnumbers ----------
number_slider = Slider(-1, range=-1..0)
number_slider_2 = Slider(1, range=0..1)
createsinewaveexponential = CreateSineWaveExponential(num=constructtreeofnumbers.Numbers, unit=Slider(0.61, range=0..1))  # -> out, OutCurves, OutSurface, OutLoft; inputs num: Int32, unit: Double
# ---------- createsinewaveexponential: C# ----------
    //list of all points
    List<Point3d> allPoints = new List<Point3d>();
    //list of curves
    List<Curve> curves = new List<Curve>();

    for(int y = 0; y < num; y++)
    {
      //curve points
      List<Point3d> crvPoints = new List<Point3d>();
      for(int x = 0; x < num; x++)
      {
        double z = Math.Sin(Math.PI / unit * (x * y));
        Point3d pt = new Point3d(x, y, z);
        crvPoints.Add(pt);
        allPoints.Add(pt);
      }
      //create a degree 3 curve from control points
      Curve crv = Curve.CreateControlPointCurve(crvPoints, 3);
      curves.Add(crv);
    }
    //create a nurbs surface from control points
    NurbsSurface srf = NurbsSurface.CreateFromPoints(allPoints, num, num, 3, 3);

    //create a loft brep from curves
    Brep[ ] breps = Brep.CreateFromLoft(curves, Point3d.Unset, Point3d.Unset, LoftType.Tight, false);

    //Assign output
    OutCurves = curves;
    OutSurface = srf;
    OutLoft = breps;
# ---------- end createsinewaveexponential ----------
surface = Surface(flatten(createsinewaveexponential.OutLoft))
curve = Curve(createsinewaveexponential.OutCurves)
surface_2 = Surface(createsinewaveexponential.OutSurface)
list_item = ListItem(List=surface, Index=[Slider(7, range=0..11), Slider(3, range=0..11)], Wrap=True)  # -> flatten(Item)
list_length = ListLength(List=list_item)  # -> expr("x-1", Length)
number_slider_3 = Slider(0, range=0..1)
k_06_range = K_06_Range(start=number_slider, end=number_slider_2, steps=list_length)  # -> out, R; inputs start: Double, end: Double, steps: Int32
# ---------- k_06_range: C# ----------
    Component.Message = "Range";

    Interval domain = new Interval(start, end);
    Print("Created domain: {0} To {1}", domain.T0, domain.T1);

    double[] range = new double[steps + 1];

    for(int i = 0; i <= steps; i++)
    {
      range[i] = domain.T0 + i * (domain.Length / steps);
    }

    R = range;
# ---------- end k_06_range ----------
k_06_range_2 = K_06_Range(start=number_slider, end=number_slider_2, steps=list_length)  # -> out, R; inputs start: Double, end: Double, steps: Int32; same code as k_06_range
k_06_range_3 = K_06_Range(start=number_slider, end=number_slider_2, steps=list_length)  # -> out, R; inputs start: Double, end: Double, steps: Int32; same code as k_06_range
pi = Pi(Factor=k_06_range_2.R)
vector_xyz = VectorXYZ(XComponent=number_slider_3, YComponent=number_slider_3, ZComponent=k_06_range.R)  # -> Vector, Length
transformscalerotatemove = TransformScaleRotateMove(objs=list_item, factor=k_06_range_3.R, angle=pi, dir=vector_xyz.Vector)  # -> out, XformGeom; inputs objs: list of GeometryBase, factor: Double, angle: Double, dir: Vector3d
# ---------- transformscalerotatemove: C# ----------
    //Create a new list of geometry objects
    List<GeometryBase> newGeom = new List<GeometryBase>();


    foreach (GeometryBase obj in objs) {
      //scale, rotate And move
      obj.Scale(factor);
      obj.Rotate(angle, Vector3d.YAxis, Point3d.Origin);
      obj.Translate(dir);

      //add to list
      newGeom.Add(obj);
    }

    //Assign output
    XformGeom = newGeom;
# ---------- end transformscalerotatemove ----------
explode_tree = ExplodeTree(Data=transformscalerotatemove.XformGeom)  # -> Branch0, Branch1
dispatch = Dispatch(List=explode_tree.Branch0, DispatchPattern=[True, False])  # -> ListA, ListB
dispatch_2 = Dispatch(List=explode_tree.Branch1, DispatchPattern=[True, False])  # -> ListA, ListB

number_slider_4 = Slider(12, range=0..12)
surface_3 = Surface(flatten(dispatch.ListA))
divide_surface = DivideSurface(Surface=surface_3, UCount=number_slider_4, VCount=number_slider_4)  # -> Points, Normals, Parameters
amplitude = Amplitude(Vector=divide_surface.Normals, Amplitude=Slider(2, range=0.001..2))
vector_display = VectorDisplay(Anchor=divide_surface.Points, Vector=divide_surface.Normals)
move = Move(Geometry=divide_surface.Points, Motion=amplitude)  # -> flatten(Geometry), Transform
expression = Expression(x=number_slider_4, Expression="x+1")
surface_from_points = SurfaceFromPoints(Points=move.Geometry, UCount=expression, Interpolate=False)
deconstruct_brep = DeconstructBrep(Brep=surface_from_points)  # -> Faces, graft(Edges), Vertices
deconstruct_brep_2 = DeconstructBrep(Brep=surface_3)  # -> Faces, graft(Edges), Vertices
loft = Loft(
    Curves=[deconstruct_brep.Edges, deconstruct_brep_2.Edges],
    Options={Adjust=False, Closed=False, LoftEnds=0, LoftSimp=0, LoftType=0, Rebuild=10, Refit=0.01})  # -> flatten(Loft)

merge = Merge(Data1=surface_from_points, Data2=loft, Data3=surface_3)

brep_join = BrepJoin(Breps=merge)  # -> Breps, Closed

number_slider_5 = Slider(8, range=0..12)
surface_4 = Surface(flatten(dispatch_2.ListB))
divide_surface_2 = DivideSurface(Surface=surface_4, UCount=number_slider_5, VCount=number_slider_5)  # -> Points, Normals, Parameters
amplitude_2 = Amplitude(Vector=divide_surface_2.Normals, Amplitude=Slider(2, range=0.001..2))
vector_display_2 = VectorDisplay(Anchor=divide_surface_2.Points, Vector=divide_surface_2.Normals)
move_2 = Move(Geometry=divide_surface_2.Points, Motion=amplitude_2)  # -> flatten(Geometry), Transform
expression_2 = Expression(x=number_slider_5, Expression="x+1")
surface_from_points_2 = SurfaceFromPoints(Points=move_2.Geometry, UCount=expression_2, Interpolate=False)
deconstruct_brep_3 = DeconstructBrep(Brep=surface_from_points_2)  # -> Faces, graft(Edges), Vertices
deconstruct_brep_4 = DeconstructBrep(Brep=surface_4)  # -> Faces, graft(Edges), Vertices
loft_2 = Loft(
    Curves=[deconstruct_brep_3.Edges, deconstruct_brep_4.Edges],
    Options={Adjust=False, Closed=False, LoftEnds=0, LoftSimp=0, LoftType=0, Rebuild=10, Refit=0.01})  # -> flatten(Loft)

merge_2 = Merge(Data1=surface_from_points_2, Data2=loft_2, Data3=surface_4)

brep_join_2 = BrepJoin(Breps=merge_2)  # -> Breps, Closed
