# Grasshopper definition C#_WS_Examples_006b.gh (Grasshopper 1.0.7)
# plug-ins: Bifocals

number_slider = Slider(6, range=0..10)
# C#_WS_Examples_006
number_slider_2 = Slider(4, range=0..10)
createsinewavegeometry = CreateSineWaveGeometry(num=number_slider, unit=number_slider_2)  # -> out, OutCurves, OutSurface, OutLoft; inputs num: Int32, unit: Int32
# ---------- createsinewavegeometry: C# ----------
    Component.Message = "Wickerson Studios";

    //list of all points
    List<Point3d> allPoints = new List<Point3d>();
    //list of curves
    List<Curve> curves = new List<Curve>();

    for(int y = 0; y < num; y++)
    {
      //curve points
      List<Point3d> crvPoints = new List<Point3d>();
      for(int x = 0; x < num; x++)
      {
        double z = Math.Sin(Math.PI / 180 + (x + y));
        Point3d pt = new Point3d(x, y, z);
        crvPoints.Add(pt);
        allPoints.Add(pt);
      }
      //create a degree 3 curve from control points
      Curve crv = Curve.CreateControlPointCurve(crvPoints, 3);
      curves.Add(crv);
    }
    //create a nurbs surface from control points
    NurbsSurface srf = NurbsSurface.CreateFromPoints(allPoints, num, num, 3, 3);

    //create a loft brep from curves
    Brep[ ] breps = Brep.CreateFromLoft(curves, Point3d.Unset, Point3d.Unset, LoftType.Tight, false);

    //Assign output
    OutCurves = curves;
    OutSurface = srf;
    OutLoft = breps;
# ---------- end createsinewavegeometry ----------
geometry = Geometry(createsinewavegeometry.OutLoft)

# ---- group: Graft and Play
methodgetcurveendpoints = MethodgetCurveEndPoints(crv=createsinewavegeometry.OutCurves)  # -> out, graft(A), graft(B); inputs crv: Curve
# ---------- methodgetcurveendpoints: C# ----------
    //Get the start point
      Point3d start_pt = crv.PointAtStart;

      //Get the end point
      Point3d end_pt = crv.PointAtEnd;

      //Output
      A = start_pt;
      B = end_pt;
# ---------- end methodgetcurveendpoints ----------
methodgetcurveendpoints_2 = MethodgetCurveEndPoints(crv=createsinewavegeometry.OutCurves)  # -> out, A, B; inputs crv: Curve
# ---------- methodgetcurveendpoints_2: C# usings ----------
using System.IO;
using System.Linq;
using System.Data;
using System.Drawing;
using System.Reflection;
using System.Windows.Forms;
using System.Xml;
using System.Xml.Linq;
using System.Runtime.InteropServices;

using Rhino.DocObjects;
using Rhino.Collections;
using GH_IO;
using GH_IO.Serialization;
# ---------- methodgetcurveendpoints_2: C# ----------
    //Get the start point
    Point3d start_pt = crv.PointAtStart;

    //Get the end point
    Point3d end_pt = crv.PointAtEnd;

    //Output
    A = start_pt;
    B = end_pt;
# ---------- end methodgetcurveendpoints_2 ----------

# ----
k_06_range = K_06_Range(start=Slider(0.16, range=0..1), end=Slider(0.86, range=0..1), steps=Slider(12, range=0..100))  # -> out, R; inputs start: Double, end: Double, steps: Int32
# ---------- k_06_range: C# ----------
    Component.Message = "Range";

    Interval domain = new Interval(start, end);
    Print("Created domain: {0} To {1}", domain.T0, domain.T1);

    double[] range = new double[steps + 1];

    for(int i = 0; i <= steps; i++)
    {
      range[i] = domain.T0 + i * (domain.Length / steps);
    }

    R = range;
# ---------- end k_06_range ----------
graph_mapper = GraphMapper(
    k_06_range.R,
    x0=0,
    x1=0.4,
    y0=0,
    y1=0.4,
    container_name="Sine",
    Equation_px=[0.4663881958, 0.1627099961],
    Equation_py=[0.1292364597, 0.207695365])
decasteljauinterpolatebeziercurve = DeCasteljauInterpolateBezierCurve(
    pt0=methodgetcurveendpoints.A,
    pt1=methodgetcurveendpoints.B,
    pt2=methodgetcurveendpoints_2.A,
    pt3=methodgetcurveendpoints_2.B,
    segments=number_slider)  # -> out, simplify(BezierCrv); inputs pt0: Point3d, pt1: Point3d, pt2: Point3d, pt3: Point3d, segments: Int32
# ---------- decasteljauinterpolatebeziercurve: C# ----------
    if(segments < 2)
      segments = 2;

    List<Point3d> bezierPts = new List<Point3d>();
    bezierPts.Add(pt0);
    bezierPts.Add(pt1);
    bezierPts.Add(pt2);
    bezierPts.Add(pt3);

    List<Point3d> evalPts = new List<Point3d>();
    double step = 1 / (double) segments;
    for(int i = 0; i <= segments; i++)
    {
      double t = i * step;
      Point3d pt = Point3d.Unset;
      EvalPoint(bezierPts, t, ref pt);

      if(pt.IsValid)
        evalPts.Add(pt);
    }

    Polyline pline = new Polyline(evalPts);
    BezierCrv = pline;
# ---------- decasteljauinterpolatebeziercurve: C# additional code ----------
  void EvalPoint(List<Point3d> points, double t, ref Point3d evalPt)
  {
    if(points.Count < 2)
      return;

    List<Point3d> tPoints = new List<Point3d>();
    for(int i = 1; i < points.Count; i++)
    {
      Line line = new Line(points[i - 1], points[i]);
      Point3d pt = line.PointAt(t);
      tPoints.Add(pt);
    }

    if(tPoints.Count == 1)
      evalPt = tPoints[0];

    EvalPoint(tPoints, t, ref evalPt);

  }
# ---------- end decasteljauinterpolatebeziercurve ----------
pipe_variable = PipeVariable(Curve=reparameterize(decasteljauinterpolatebeziercurve.BezierCrv), Parameters=k_06_range.R, Radii=graph_mapper, Caps=2)
