# Grasshopper definition C#_WS_Examples_009.gh (Grasshopper 1.0.7)
# Copyright: bernhard muller bijoutiers
# plug-ins: Workshop, Bifocals

# ----
# 008
getoriginpoint = GetOriginPoint()  # -> out, Origin; disabled
# ---------- getoriginpoint: C# usings ----------
using System.IO;
using System.Linq;
using System.Data;
using System.Drawing;
using System.Reflection;
using System.Windows.Forms;
using System.Xml;
using System.Xml.Linq;
using System.Runtime.InteropServices;

using Rhino.DocObjects;
using Rhino.Collections;
using GH_IO;
using GH_IO.Serialization;
# ---------- getoriginpoint: C# ----------
    Origin = Point3d.Origin;
# ---------- end getoriginpoint ----------
number_slider = Slider(10, range=0..10)  # disabled
number_slider_2 = Slider(6, range=0..10)  # disabled
number_slider_3 = Slider(10, range=0..10)  # disabled
number_slider_4 = Slider(0.57, range=0..2)  # disabled
getpointcoordinates = GetPointCoordinates(pt=getoriginpoint.Origin)  # -> out, A, B, C; inputs pt: Point3d; disabled
# ---------- getpointcoordinates: C# ----------
    //Assign the point coordinates to output
    A = pt.X;
    B = pt.Y;
    C = pt.Z;
# ---------- end getpointcoordinates ----------
pi = Pi(Factor=number_slider_4)  # disabled
panel = Panel("1")  # disabled
addition = Addition(A=getpointcoordinates.C, B=number_slider_3)  # disabled
addition_2 = Addition(A=getpointcoordinates.B, B=number_slider_2)  # disabled
addition_3 = Addition(A=getpointcoordinates.A, B=number_slider)  # disabled
unit_y = UnitY(Factor=addition_2)  # disabled
unit_x = UnitX(Factor=addition_3)  # disabled
unit_z = UnitZ(Factor=addition)  # disabled
transformscalerotatemove = TransformScaleRotateMove(objs=getoriginpoint.Origin, factor=panel, angle=pi, dir=unit_x)  # -> out, XformGeom; inputs objs: list of GeometryBase, factor: Double, angle: Double, dir: Vector3d; disabled
# ---------- transformscalerotatemove: C# ----------
    //Create a new list of geometry objects
    List<GeometryBase> newGeom = new List<GeometryBase>();


    foreach (GeometryBase obj in objs) {
      //scale, rotate And move
      obj.Scale(factor);
      obj.Rotate(angle, Vector3d.YAxis, Point3d.Origin);
      obj.Translate(dir);

      //add to list
      newGeom.Add(obj);
    }

    //Assign output
    XformGeom = newGeom;
# ---------- end transformscalerotatemove ----------
transformscalerotatemove_2 = TransformScaleRotateMove(objs=getoriginpoint.Origin, factor=panel, angle=pi, dir=unit_z)  # -> out, XformGeom; inputs objs: list of GeometryBase, factor: Double, angle: Double, dir: Vector3d; disabled; same code as transformscalerotatemove
transformscalerotatemove_3 = TransformScaleRotateMove(objs=getoriginpoint.Origin, factor=panel, angle=pi, dir=unit_y)  # -> out, XformGeom; inputs objs: list of GeometryBase, factor: Double, angle: Double, dir: Vector3d; disabled; same code as transformscalerotatemove
createpointintializexyz = CreatePointIntializeXYZ(x=transformscalerotatemove.XformGeom, y=transformscalerotatemove_3.XformGeom, z=transformscalerotatemove_2.XformGeom)  # -> out, Point; inputs x: Double, y: Double, z: Double; disabled
# ---------- createpointintializexyz: C# ----------
    //Create an instance of a point and initialize to x, y and z
    Point3d pt = new Point3d(x, y, z);

    //Assign the point "pt" to output
    Point = pt;
# ---------- end createpointintializexyz ----------
number_slider_5 = Slider(5, range=0..10)  # disabled
transformscalerotatemove_4 = TransformScaleRotateMove(
    objs=[transformscalerotatemove.XformGeom, transformscalerotatemove_3.XformGeom, transformscalerotatemove_2.XformGeom],
    factor=panel,
    angle=pi,
    dir=unit_z)  # -> out, XformGeom; inputs objs: list of GeometryBase, factor: Double, angle: Double, dir: Vector3d; disabled; same code as transformscalerotatemove
point = Point(createpointintializexyz.Point)  # disabled
point_2 = Point(getoriginpoint.Origin)  # disabled
point_3 = Point(transformscalerotatemove.XformGeom)  # disabled
point_4 = Point(transformscalerotatemove_3.XformGeom)  # disabled
point_5 = Point(transformscalerotatemove_2.XformGeom)  # disabled
number_slider_6 = Slider(2, range=1..3)  # disabled
number_slider_7 = Slider(3, range=1..3)  # disabled
structcreatesphere = StructCreateSphere(centerPt=point, radius=number_slider_5)  # -> out, A; inputs centerPt: Point3d, radius: Double; disabled
# ---------- structcreatesphere: C# ----------
    Point3d center = Point3d.Origin;
    Sphere sphere = new Sphere(center, radius);
    A = sphere;
# ---------- end structcreatesphere ----------
boolean_toggle = BooleanToggle(True)  # disabled
methodcreateopenclosedperiodiccurvefromc = MethodCreateOpenClosedPeriodicCurveFromControlPoints(cPoints=[point_4, point_5, point_3], degree=number_slider_6, periodic=boolean_toggle)  # -> out, OutCurve; inputs cPoints: list of Point3d, degree: Int32, periodic: Boolean; disabled
# ---------- methodcreateopenclosedperiodiccurvefromc: C# ----------
    //Create an instance of a periodic (smoothly closed) or clamped (open) NurbsCurve
    //Use the "Create" method in NurbsCurve class
    NurbsCurve nc = NurbsCurve.Create(periodic, degree, cPoints);

    //Check if the curve is valid then assign curve to the output value A
    if (nc != null) {
      OutCurve = nc;
    }
# ---------- end methodcreateopenclosedperiodiccurvefromc ----------
methodcreateopenclosedperiodiccurvefromc_2 = MethodCreateOpenClosedPeriodicCurveFromControlPoints(cPoints=transformscalerotatemove_4.XformGeom, degree=number_slider_7, periodic=boolean_toggle)  # -> out, OutCurve; inputs cPoints: list of Point3d, degree: Int32, periodic: Boolean; disabled; same code as methodcreateopenclosedperiodiccurvefromc
classcreatelinecurvefrompts = ClassCreateLineCurveFromPts(p0=point_2, p1=transformscalerotatemove_4.XformGeom)  # -> out, OutLine; inputs p0: Point3d, p1: Point3d; disabled
# ---------- classcreatelinecurvefrompts: C# ----------
    //Create an instance of a point object and unset
    LineCurve lineCurve = new Rhino.Geometry.LineCurve(p0, p1);
    Print(lineCurve.ToString());

    //assign output
    OutLine = lineCurve;
# ---------- end classcreatelinecurvefrompts ----------
methodcreatesurfacerevolution = MethodCreateSurfaceRevolution(
    revCrv=[methodcreateopenclosedperiodiccurvefromc.OutCurve, methodcreateopenclosedperiodiccurvefromc_2.OutCurve],
    revAxis=classcreatelinecurvefrompts.OutLine)  # -> out, PlanarSurface; inputs revCrv: Curve, revAxis: Line; disabled
# ---------- methodcreatesurfacerevolution: C# ----------
    //Create surface of revolution
    var revSrf = RevSurface.Create(revCrv, revAxis);

    PlanarSurface = revSrf;
# ---------- end methodcreatesurfacerevolution ----------
cap_holes = CapHoles(Brep=methodcreatesurfacerevolution.PlanarSurface)  # disabled
dispatch = Dispatch(List=flatten(cap_holes), DispatchPattern=[True, False])  # -> ListA, ListB; disabled
geometry = Geometry(dispatch.ListB)  # disabled
geometry_2 = Geometry(dispatch.ListA)  # disabled

gene_pool = GenePool(Decimals=2, Maximum=3, Minimum=0, Value=[2.565847493, 0.2832221024, 2.819278132])  # disabled
gene_pool_2 = GenePool(Decimals=2, Maximum=3, Minimum=0, Value=[0.69, 2.937231144, 1.24])  # disabled
panel_2 = Panel(gene_pool)  # disabled
l_02_foreachloop = L_02_ForeachLoop(numList=gene_pool, multiplier=gene_pool_2)  # -> out, multiplied; inputs numList: list of Double, multiplier: Double; disabled
# ---------- l_02_foreachloop: C# ----------
    List<double> numbers = new List<double>();

    foreach(double val in numList)
      numbers.Add(val * multiplier);

    multiplied = numbers;
# ---------- end l_02_foreachloop ----------
number_slider_8 = Slider(44, range=0..100)  # disabled
number_slider_9 = Slider(3, range=0..10)  # disabled
panel_3 = Panel(l_02_foreachloop.multiplied)  # disabled
g_01_whileloop = G_01_WhileLoop(max=l_02_foreachloop.multiplied)  # -> out; inputs max: Double; disabled
# ---------- g_01_whileloop: C# ----------
    int i = 0;
    while(i <= max)
    {
      Print(i.ToString());
      i++;
    }
# ---------- end g_01_whileloop ----------
l_04_randomnumbergenerator = L_04_RandomNumberGenerator(min=flatten(g_01_whileloop), max=g_01_whileloop, count=number_slider_9, seed=number_slider_8)  # -> out, simplify(numbers); inputs min: Double, max: Double, count: Int32, seed: Int32; disabled
# ---------- l_04_randomnumbergenerator: C# ----------
    Component.Message = "Random numbers";

    Random randGen = new Random(seed);
    List<double> randomNumbers = new List<double>();

    for(int i = 0; i < count; i++)
    {
      randomNumbers.Add(randGen.NextDouble() * (max - min) + min);    
      //Random.NextDouble() returns a value between 0.0 and 1.0 
      //(actually 0.99999999999999978 because of binary representation of a floating point number)
    }

    numbers = randomNumbers;
# ---------- end l_04_randomnumbergenerator ----------
panel_4 = Panel(g_01_whileloop)  # disabled
path_mapper = PathMapper(l_04_randomnumbergenerator.numbers, source="{A;B;C}(i)", target="{0;B;i}(C)")  # disabled
path_mapper_2 = PathMapper(l_04_randomnumbergenerator.numbers, source="{A;B;C}(i)", target="{A;B;0}(C)")  # disabled
path_mapper_3 = PathMapper(l_04_randomnumbergenerator.numbers, source="{A;B;C}(i)", target="{A;0;i}(C)")  # disabled
panel_5 = Panel(l_04_randomnumbergenerator.numbers)  # disabled
param_viewer = ParamViewer(path_mapper)  # disabled
param_viewer_2 = ParamViewer(path_mapper)  # disabled
param_viewer_3 = ParamViewer(path_mapper)  # disabled
number_slider_10 = Slider(3, range=0..4)  # disabled
boolean_toggle_2 = BooleanToggle(True)  # disabled
createpointintializexyz_2 = CreatePointIntializeXYZ(x=simplify(path_mapper), y=simplify(path_mapper_3), z=simplify(path_mapper_2))  # -> out, Point; inputs x: Double, y: Double, z: Double; disabled; same code as createpointintializexyz
methodcreateopenclosedperiodiccurvefromc_3 = MethodCreateOpenClosedPeriodicCurveFromControlPoints(cPoints=createpointintializexyz_2.Point, degree=number_slider_10, periodic=boolean_toggle_2)  # -> out, OutCurve; inputs cPoints: list of Point3d, degree: Int32, periodic: Boolean; disabled; same code as methodcreateopenclosedperiodiccurvefromc
param_viewer_4 = ParamViewer(createpointintializexyz_2.Point)  # disabled
param_viewer_5 = ParamViewer(methodcreateopenclosedperiodiccurvefromc_3.OutCurve)  # disabled
loft = Loft(
    Curves=flatten(methodcreateopenclosedperiodiccurvefromc_3.OutCurve),
    Options={Adjust=False, Closed=True, LoftEnds=0, LoftSimp=0, LoftType=0, Rebuild=10, Refit=0.01})  # disabled

number_slider_11 = Slider(2, range=0..10)  # disabled
number_slider_12 = Slider(2, range=0..10)  # disabled
construct_point = ConstructPoint(XCoordinate=0, YCoordinate=0, ZCoordinate=0)  # disabled
itemcreatespheres = ItemCreateSpheres(pt=construct_point, radius=number_slider_11, height=number_slider_12)  # -> out, Sphere, Cone, Cylinder, Box; inputs pt: Point3d, radius: Double, height: Double; disabled
# ---------- itemcreatespheres: C# ----------
    Sphere ptSphere = new Sphere(pt, radius);
    Print("Run# " + Iteration);
    Sphere = ptSphere;

    //Plane ptPlane = new Plane(
    
    Cone ptCone = new Cone(Plane.WorldXY, height, radius);
    Cone = ptCone;

    Circle ptCircle = new Circle(radius);
    
    Cylinder ptCylinder = new Cylinder(ptCircle, height);
    Cylinder = ptCylinder;
# ---------- end itemcreatespheres ----------
geometry_3 = Geometry(itemcreatespheres.Cone)  # disabled
geometry_4 = Geometry(itemcreatespheres.Cylinder)  # disabled
geometry_5 = Geometry(itemcreatespheres.Sphere)  # disabled
geometry_6 = Geometry(itemcreatespheres.Box)  # disabled

d_01_basicoperators = D_01_BasicOperators()  # -> out, addition, difference, multiplication, division; inputs num1: Double, num2: Double; disabled
# ---------- d_01_basicoperators: C# ----------
    addition = num1 + num2;
    difference = num1 - num2;
    multiplication = num1 * num2;
    division = num1 / num2;
# ---------- end d_01_basicoperators ----------
# Rajaa Issa
# C# COMPONENT
wickerson_s_first_grasshopper_component = WickersonsFirstGrasshopperComponent()  # disabled

b_05_othertypes = B_05_OtherTypes()  # -> out, A; inputs someColour: Color, globalUniqueIdentifier: Guid; disabled
# ---------- b_05_othertypes: C# ----------
    //Complex is a structure from Grasshopper.Kernel.Types namespace;
    //DateTime is a structure from System namespace
    //Color is a structure from System.Drawing namespace
    //Guid is a structure from System namespace

    //all of these types are structures, so they are value types

    Print("complexNum is real: {0}", complexNum.IsReal);
    Print(dateAndTime.DayOfWeek.ToString());
    Print("Colour R: {0}, G: {1}, B: {2}", someColour.R, someColour.G, someColour.B);
    Print("Identifier: {0}", globalUniqueIdentifier.ToString());
# ---------- end b_05_othertypes ----------
b_01_inputoutputdata = B_01_InputOutputData()  # -> out, A, B, C; inputs x: Int32, y: Double, z: Boolean; disabled
# ---------- b_01_inputoutputdata: C# ----------
    A = x;
    B = y;
    C = z;
# ---------- end b_01_inputoutputdata ----------
b_01_basicdatatypes = B_01_BasicDataTypes()  # -> out, A; disabled
# ---------- b_01_basicdatatypes: C# ----------
    int myInt = 0;
    int i=0, j = 1, k = 2;
    int otherInt;             //declaration without initialization - reserving memory, creating a blueprint for data
    otherInt = -10;           //initialization

    double myDouble = 0;
    double a, b, c;
    a = 10.3;
    b = -124.4;
    c = Math.PI;

    bool condition = false;   //can only be true or false
    bool flag = true;


    Print("myInt: {0} \ni: {1}, j:{2}, k:{3}", myInt, i, j, k);  //special character '/n' means new line
    Print("otherInt: " + otherInt.ToString());
    Print("myDouble: " + myDouble.ToString());
    Print("a: {0}, b: {1}, c: {2}", a, b, c);
    //when you use formatted string, ToString() method is automatically called for every argument
    Print("condition: " + condition.ToString() + "\n" + "flag: " + flag.ToString()); // '/n' once again
# ---------- end b_01_basicdatatypes ----------
b_04_stringscharacters = B_04_StringsCharacters()  # -> out, A; disabled
# ---------- b_04_stringscharacters: C# ----------
    char character = 'a';  //char stores a single Unicode character and occupies 2 bytes
    Print("character: " + character.ToString());

    char newLine = '\n';  //can store special characters too;

    //string represents an immutable sequence of Unicode characters (an array of chars)
    string someText1 = "Some text";
    string someText2 = @"Verbatim sign
      makes it possible
      to write multi-line text.";
    string someText3 = someText1 + newLine + someText2;

    Print(someText1);
    Print(someText2);
    Print(someText3);
# ---------- end b_04_stringscharacters ----------
b_03_rangesofnumericdatatypes = B_03_RangesOfNumericDataTypes()  # -> out, A; disabled
# ---------- b_03_rangesofnumericdatatypes: C# ----------
    //integral signed types - positive and negative values
    sbyte mySignedByteMin = sbyte.MinValue;
    sbyte mySignedByteMax = sbyte.MaxValue;

    short myInt16Min = short.MinValue;
    short myInt16Max = short.MaxValue;

    int myInt32Min = int.MinValue;
    int myInt32Max = int.MaxValue;

    long myInt64Min = long.MinValue;
    long myInt64Max = long.MaxValue;

    //integral unsigned types - only positive values
    byte myByteMin = byte.MinValue;
    byte myByteMax = byte.MaxValue;

    ushort myUnsignedInt16Min = ushort.MinValue;
    ushort myUnsignedInt16Max = ushort.MaxValue;

    uint myUnsignedInt32Min = uint.MinValue;
    uint myUnsignedInt32Max = uint.MaxValue;

    ulong myUnsignedInt64Min = ulong.MinValue;
    ulong myUnsignedInt64Max = ulong.MaxValue;

    //real numbers - always signed
    float myFloatingPtNumMin = float.MinValue;
    float myFloatingPtNumMax = float.MaxValue;

    double myDoublePrecisionNumMin = double.MinValue;
    double myDoublePrecisionNumMax = double.MaxValue;

    decimal myDecimalMin = decimal.MinValue;
    decimal myDecimalMax = decimal.MaxValue;

    Print("sbyte min: {0}, max: {1}, memory size [bytes]: {2}", mySignedByteMin, mySignedByteMax, sizeof(sbyte));
    Print("short min: {0}, max: {1}, memory size [bytes]: {2}", myInt16Min, myInt16Max, sizeof(short));
    Print("int min: {0}, max: {1}, memory size [bytes]: {2}", myInt32Min, myInt32Max, sizeof(int));
    Print("long min: {0}, max: {1}, memory size [bytes]: {2}", myInt64Min, myInt64Max, sizeof(long));
    Print("byte min: {0}, max: {1}, memory size [bytes]: {2}", myByteMin, myByteMax, sizeof(byte));
    Print("ushort min: {0}, max: {1}, memory size [bytes]: {2}", myUnsignedInt16Min, myUnsignedInt16Max, sizeof(ushort));
    Print("uint min: {0}, max: {1}, memory size [bytes]: {2}", myUnsignedInt32Min, myUnsignedInt32Max, sizeof(uint));
    Print("ulong min: {0}, max: {1}, memory size [bytes]: {2}", myUnsignedInt64Min, myUnsignedInt64Max, sizeof(ulong));
    Print("float min: {0}, max: {1}, memory size [bytes]: {2}", myFloatingPtNumMin, myFloatingPtNumMax, sizeof(float));
    Print("double min: {0}, max: {1}, memory size [bytes]: {2}", myDoublePrecisionNumMin, myDoublePrecisionNumMax, sizeof(double));
    Print("decimal min: {0}, max: {1}, memory size [bytes]: {2}", myDecimalMin, myDecimalMax, sizeof(decimal));
# ---------- end b_03_rangesofnumericdatatypes ----------

# ----
# Text
a_01_helloworld = A_01_HelloWorld()  # -> out, A; disabled
# ---------- a_01_helloworld: C# ----------
    Print("Hello world!");
# ---------- end a_01_helloworld ----------
a_03_cultureinfoformat = A_03_CultureInfoFormat()  # -> out, A; inputs x: Double, y: Double; disabled
# ---------- a_03_cultureinfoformat: C# ----------
    System.Globalization.CultureInfo uk = System.Globalization.CultureInfo.GetCultureInfo("en-GB");
    string formatted = string.Format(uk, "x: {0:P2}; y: {1:C2}", x, y);
    //P means percent and C means currency.
    // Following number stands for number of decimal places you want to show
    Print(formatted);
# ---------- end a_03_cultureinfoformat ----------
a_02_formatstring = A_02_FormatString()  # -> out, A; inputs x: Double, y: Double; disabled
# ---------- a_02_formatstring: C# ----------
    Print("x: {0}; y: {1:.00}", x, y);   //{1:.000} means that a number will be always displayed with 3 decimal places 
    //(could be {1:0.00} for two places aswell). Useful eg. for pretty area display.
# ---------- end a_02_formatstring ----------
# Types
a_05_comments = A_05_Comments()  # -> out, A; disabled
# ---------- a_05_comments: C# ----------
    // a single line comment

    /*
    a multi
    line
    comment
    */

    /* Everything written as a commentary is ommited */

    // Comments should be used when needed and not too obvious
    int i = 0; //declaring variable i   ->  why write that? It's obvious
# ---------- end a_05_comments ----------
a_04_formatlistandoutput = A_04_FormatListAndOutput()  # -> out, formattedText; inputs areasAsNumbers: list of Double; disabled
# ---------- a_04_formatlistandoutput: C# ----------
    List<string> areasAsText = new List<string>();
    for(int i = 0; i < areasAsNumbers.Count; i++){
      areasAsText.Add(string.Format("area[{0}]: {1:0.00}m²", i, areasAsNumbers[i]) );
      // "{0}" is swapped with the first argument after text string -> i
      // "{1}" is swapped with the second argument after text string -> areasAsNumbers[i] (i-th element of areas list)
    }
    
    formattedText = areasAsText; //outputting whole list
# ---------- end a_04_formatlistandoutput ----------
o_01_exceptionsandruntimemessages = O_01_ExceptionsAndRuntimeMessages()  # -> out, A; inputs x: Double, y: Double; disabled
# ---------- o_01_exceptionsandruntimemessages: C# ----------
    Component.Message = "Runtime messages";
    if(x != 0)
      Component.AddRuntimeMessage(GH_RuntimeMessageLevel.Remark, "This is a remark.");
    //Component.AddRuntimeMessage(GH_RuntimeMessageLevel.Warning, "This is a warning.");
    //Component.AddRuntimeMessage(GH_RuntimeMessageLevel.Error, "This is an error!");
    if(x == 0)
      throw new Exception("This is an exception");  //prevents from giving any result
    //although you shouldn't throw generic "Exception". Look for more precise reasons

    A = x * y;
# ---------- end o_01_exceptionsandruntimemessages ----------

c_01_point3dstructure = C_01_Point3DStructure()  # -> out, point; inputs x: Double, y: Double, z: Double; disabled
# ---------- c_01_point3dstructure: C# ----------
    Point3d firstPoint = new Point3d(x, y, z);
    Print("firstPoint X: {0}, Y: {1}, Z: {2}", firstPoint.X, firstPoint.Y, firstPoint.Z);

    point = firstPoint;
# ---------- end c_01_point3dstructure ----------
c_02_referenceandvaluetypes = C_02_ReferenceAndValueTypes()  # -> out, myPointOut, myPolylineOut, myPointCopyOut, myPolylineCopyOut; inputs myPoint: Point3d, myPolyline: Polyline; disabled
# ---------- c_02_referenceandvaluetypes: C# ----------
    Point3d myPointCopy = myPoint;    //copying all values to a different object
    Polyline myPolylineCopy = myPolyline;   //warning! this means a copy of reference, not a copy of an object
    //the statement above created another reference to the same data

    myPointCopy = myPointCopy + new Point3d(10, 10, 10);  //modifies only myPointCopy
    myPolylineCopy.RemoveAt(0);   //modifies a polyline referenced by myPolyline!
    //notice we changed only the copy, but also the main object has been modified! This is how reference types work
    // class -> reference
    // struct -> value

    myPointOut = myPoint;
    myPolylineOut = myPolyline;
    myPointCopyOut = myPointCopy;
    myPolylineCopyOut = myPolylineCopy;
# ---------- end c_02_referenceandvaluetypes ----------

d_03_doubleconversionmathround = D_03_DoubleconversionMathround()  # -> out, convertedIntegerNum, convertedFloatingPtNum; inputs intNum: Int32, floatingPtNum: Double; disabled
# ---------- d_03_doubleconversionmathround: C# ----------
    int myInt = 0;
    double myDouble = 0;

    //myInt = y;      // error: explicit conversion needed (to make sure you know, you would lose data)
    myInt = (int) floatingPtNum; // ok, explicit conversion means "I know I lose fraction values"
    myDouble = intNum;   // ok, implicit conversion allowed, because no information is lost

    //myInt = Math.Round(y); // error: Math.Round returns a floating point number, so you need an explicit conversion
    myInt = (int) Math.Round(floatingPtNum); // ok

    convertedIntegerNum = myInt;
    convertedFloatingPtNum = myDouble;
# ---------- end d_03_doubleconversionmathround ----------
d_03_integerdivision = D_03_IntegerDivision()  # -> out, integerDivision; inputs integerNum1: Int32, integerNum2: Int32; disabled
# ---------- d_03_integerdivision: C# ----------
    integerDivision =  integerNum1 / integerNum2;
    //fraction numbers will be lost
# ---------- end d_03_integerdivision ----------
d_05_integermodulodivision = D_05_IntegerModuloDivision()  # -> out, integerDivision, remainder; inputs num1: Double, num2: Double; disabled
# ---------- d_05_integermodulodivision: C# ----------
    integerDivision = (int) (num1 / num2);
    remainder = num1 % num2;
# ---------- end d_05_integermodulodivision ----------
# Operators
d_01_basicoperators_2 = D_01_BasicOperators()  # -> out, addition, difference, multiplication, division; inputs num1: Double, num2: Double; disabled; same code as d_01_basicoperators
d_07_incrementdecrement = D_07_IncrementDecrement()  # -> out, incrementedY, decrementedZ; inputs x: Double, y: Double, z: Double; disabled
# ---------- d_07_incrementdecrement: C# ----------
    Print("x += 3; \nx == {0}", x += 3);
    Print("x -= 6.4; \nx == {0}", x -= 6.4);
    Print("x *= 2; \nx == {0}", x *= 2);
    Print("x /= 3.5; \nx == {0}", x /= 3.5);


    y++;      //now y equals y+1
    incrementedY = y++; // incrementedY equals y before y++, but afterwards y equals y+2(in summary)
    decrementedZ = --z; // decrementedZ equals (z-1) and z equals (z-1) too.
    // if you put incrementation/ decrementation operator before a variable,
    // then it's computed before the statement. Otherwise it's computed afterwards
# ---------- end d_07_incrementdecrement ----------
d_09_toggleswitchab = D_09_ToggleSwitchAB()  # -> out, result; inputs toggle: Boolean; disabled
# ---------- d_09_toggleswitchab: C# ----------
    result = toggle ? valA : valB;
# ---------- end d_09_toggleswitchab ----------
d_06_equalityvsassignment = D_06_EqualityVSAssignment()  # -> out, equal; inputs x: Int32, y: Int32; disabled
# ---------- d_06_equalityvsassignment: C# ----------
    bool flag = false;

    flag = (x == y);  // == equality operator returns true or false, a boolean type
    //flag2 = (x = y);  // error! = is an assignment operator;

    equal = flag;
# ---------- end d_06_equalityvsassignment ----------
d_10_precedence = D_10_Precedence()  # -> out; inputs x: Double, y: Double, z: Double; disabled
# ---------- d_10_precedence: C# ----------
    Print("x + y / z = {0}", x + y / z);
    Print("(x + y) / z = {0}", (x + y) / z);
    Print("x + y / z++ = {0}", x + y / z++);
    Print("z after last operation = {0}", z);
    Print("z--... = {0}", --z);
    Print("(x + y) / ++z = {0}", x + y / ++z);
# ---------- end d_10_precedence ----------
d_02_naninfinity_infinity = D_02_NANInfinityInfinity()  # -> out, A; disabled
# ---------- d_02_naninfinity_infinity: C# ----------
    Print("double special values: \nNot a number: {0}\nPositiveInfinity: {1}\nNegativeInfinity: {2}", double.NaN, double.PositiveInfinity, double.NegativeInfinity);
# ---------- end d_02_naninfinity_infinity ----------
d_08_conditionaloperator = D_08_ConditionalOperator()  # -> out, notZero; inputs x: Int32; disabled
# ---------- d_08_conditionaloperator: C# ----------
    bool flag = false;
    flag = x != 0 ? true : false;
    
    //above instruction is equivalent to:
    // if(x!=0)
    //    flag = true;
    // else
    //    flag = false;
    
    // ...it is an elegant alternative
    
    notZero = flag;
# ---------- end d_08_conditionaloperator ----------

# ----
# Basic C#
# Custom Nodes
numequalstarget = CheckIfNumEqualToTarget()  # -> out, A; inputs myNumber: Double, numTarget: Double; disabled
# ---------- numequalstarget: C# ----------
    //Using if statement to check if a number is equal to zero
    if (myNumber == numTarget)
    {
      Print("myNumber is the target number: " + numTarget);
    }
    A = numTarget;
# ---------- end numequalstarget ----------
checkifnumbetweennums = MyNumIsBetweenNum1AndNum2()  # -> out; inputs num1: Double, myNumber: Double, num2: Double; disabled
# ---------- checkifnumbetweennums: C# ----------
    //Using if, else statement to check if a number is between 0 and 100
    if (myNumber >= num1 && myNumber <= num2)
    {
      Print("myNumber is between " +num1 + " and " + num2 + ".");
    }
# ---------- end checkifnumbetweennums ----------
test_if_a_number_is_even = TestNumberEven()  # -> out, IsEven; inputs num: Int32; disabled
# ---------- test_if_a_number_is_even: C# ----------
    int mod = num % 2;
    IsEven = (mod == 0 ? true : false);
# ---------- end test_if_a_number_is_even ----------
# Rajaa Issa
# C# RHINO GEOMETRY
positivezeronegative = PositiveZeroNegative()  # -> out; inputs myNumber: Double; disabled
# ---------- positivezeronegative: C# ----------
    if (myNumber > 0)
    {
      Print("myNumber is positive");
    }
    else if (myNumber < 0)
    {
      Print("myNumber is negative");
    }
    else
    {
      Print("myNumber is zero");
    }
# ---------- end positivezeronegative ----------
loopnumbers = LoopToPrintNumbers()  # -> out, A; inputs count: Int32; disabled
# ---------- loopnumbers: C# ----------
    int i;
    for (i = 1; i <= count; i++)
    {
      //Convert a number to string
      Print(i.ToString());
      //Another way to print
      //Print("" + i);
    }
# ---------- end loopnumbers ----------
enumeratetrafficlights = EnumerateTrafficLights()  # -> out; inputs signal: Int32; disabled
# ---------- enumeratetrafficlights: C# ----------
    //Use if statement
    if( signal == (int) Traffic.Red)
      Print("STOP");
    else if(signal == (int) Traffic.Yellow)
      Print("YEILD");
    else if(signal == (int) Traffic.Green)
      Print("GO");
    else
      Print("This is not a traffic signal color!");
# ---------- enumeratetrafficlights: C# additional code ----------
  //Define enum with traffic lights
  enum Traffic
  {
    Red = 1,
    Yellow = 2,
    Green = 3
  }
# ---------- end enumeratetrafficlights ----------
arrayweekdays = CreateArrayWeekdays()  # -> out, A; disabled
# ---------- arrayweekdays: C# ----------
    //Declare and initialize the days of the week array
    string[ ] weekdays = {"Sunday","Monday","Tuesday","Wednesday","Thursday","Friday","Saturday"};

    //Assign myArray to the output A
    A = weekdays;
# ---------- end arrayweekdays ----------
createlistworkdays = CreateListWorkdays()  # -> out, A; disabled
# ---------- createlistworkdays: C# ----------
    //Declare a dynamic ordered collection using “List”
    List<string> myWorkDays = new List<string>();

    //Add any number of new elements to the list
    myWorkDays.Add("Tuesday");
    myWorkDays.Add("Wednesday");
    myWorkDays.Add("Thursday");
    myWorkDays.Add("Friday");

    //Assign myArray to output
    A = myWorkDays;
# ---------- end createlistworkdays ----------
loopalpha = LoopThroughAlphabet()  # -> out, A; disabled
# ---------- loopalpha: C# ----------
    string alphabet = "ABCDEFGHIJKLMNOPQRSTUVWXYZ";
    char[ ] letters = alphabet.ToCharArray();
    for (int i = 0; i <= letters.Length - 1; i++)
    {
      Print("" + letters[i]);
    }
# ---------- end loopalpha ----------
loopindicieslist = LoopIndiciesInList()  # -> out, A; disabled
# ---------- loopindicieslist: C# ----------
    //List Of places
    List< String > places_list = new List<String >();
    places_list.Add("Paris");
    places_list.Add("NY");
    places_list.Add("Beijing");
    places_list.Add("Mexico");
    places_list.Add("Toronto");
    places_list.Add("London");

    //Loop counter
    int i = 0;
    int count = places_list.Count();

    //Loop starting from 0 to count -1 (count = 3, but last index of the places_list is 2)
    for (i = 0; i < count; i++)
    {
      Print("I have been to " + places_list[i]);
    }
# ---------- end loopindicieslist ----------
foreachlooplist = ForeachElementInList()  # -> out, A; disabled
# ---------- foreachlooplist: C# ----------
    //List of places
    var places_list = new List< string >();
    places_list.Add("Paris");
    places_list.Add("NY");
    places_list.Add("Beijing");

    //Loop
    foreach (string place in places_list)
    {
      Print(place);
    }
# ---------- end foreachlooplist ----------
whilelooplist = WhileLoopElementsInList()  # -> out, A; disabled
# ---------- whilelooplist: C# ----------
    //Array Of places
    List<string> places_list = new List<string>();
    places_list.Add("Paris");
    places_list.Add("NY");
    places_list.Add("Beijing");

    int i = 0;
    string place = null;
    int count = places_list.Count();

    //Loop
    i = 0;
    //(i < count) evaluates To True Or False
    while (i < count)
    {
      place = places_list[i];
      Print(place);
      i = i + 1;
    }
# ---------- end whilelooplist ----------

j_02_specialconversionstextparsing = J_02_SpecialConversionsTextParsing()  # -> out, booleanToInt, parsedText, parsingResult; inputs boolean: Boolean, text: String; disabled
# ---------- j_02_specialconversionstextparsing: C# ----------
    int myInt = 0;
    double myDouble = 0;
    bool resultTest = false;

    //myInt = _boolean; // error: explicit type conversion required
    //myDouble = _text; // error: how to convert text to a number?

    //myInt = (int) _boolean; // still not ok, because converting false or true into a number
    // requires a special procedure
    //myDouble = (double) _text; // same here

    myInt = Convert.ToInt32(_boolean); // one way of converting is calling a special generic method from Convert class
    //myDouble = Convert.ToDouble(_text);  // you can use Convert.ToDouble method when parsing text
    //myDouble = Double.Parse(_text);      // this is another way of parsing
    resultTest = Double.TryParse(_text, out myDouble);  // this is the best way, because failure doesn't result in program crashing

    booleanToInt = myInt;
    parsedText = myDouble;
    parsingResult = resultTest;
# ---------- end j_02_specialconversionstextparsing ----------
j_01_typecheckingspecialconversions = J_01_TypeCheckingSpecialConversions()  # -> out, A, B; disabled
# ---------- j_01_typecheckingspecialconversions: C# ----------
    Component.Message = "Unboxing conversion";

    double num = 0;
    Point3d myPt = new Point3d();
    Polyline myPolyline = new Polyline(); //creates an empty reference

    //GetType() is a method of every object instance
    Print("Type of val: {0}", val.GetType());
    Print("Type of geometry: {0}", geometry.GetType());

    if(val.GetType() == typeof(int))
      num = (int) val;    // works because you can assign an integer to a double

    if(val is double) //another way of checking if unboxing would succeed
      num = (double) val;

    if(geometry is Point3d)
    {
      myPt = (Point3d) geometry;
      B = myPt;
    }

    if(geometry is PolylineCurve)
    {
      ((PolylineCurve) geometry).TryGetPolyline(out myPolyline);    // unboxing followed by calling a method to get a Polyline object
      if(myPolyline != null)  //we have to check if reference is not null
        B = myPolyline;
    }

    A = num;
# ---------- end j_01_typecheckingspecialconversions ----------

e_03_elseif = E_03_ElseIf()  # -> out, A; inputs yourAge: Int32; disabled
# ---------- e_03_elseif: C# ----------
    if(yourAge >= 40)
      Print("You can be a president in Germany!");
    else if(yourAge >= 18)    // instead of if(yourAge < 40 && yourAge >= 18)
      Print("You can vote in election");
    else
      Print("You can watch TV");
# ---------- end e_03_elseif ----------
e_05_disjunctionconjunctionnegation = E_05_DisjunctionConjunctionNegation()  # -> out, aAndB, aOrB, notA, notB; inputs a: Boolean, b: Boolean; disabled
# ---------- e_05_disjunctionconjunctionnegation: C# ----------
    if(a == true && b == true)
      aAndB = true;
    else
      aAndB = false;

    aOrB = (a || b) ? true : false;   //same with ternary operator. Also: you don't have to check true/false equality with booleans, because they are true/false themselves

    notA = !a;
    notB = !b;
# ---------- end e_05_disjunctionconjunctionnegation ----------
e_7_caseswitchstatement = E_7_CaseSwitchStatement()  # -> out, letter; inputs x: Int32; disabled
# ---------- e_7_caseswitchstatement: C# ----------
    switch(x)
    {
      case 0: letter = 'a';
        break;
      case 1: letter = 'b';
        break;
      case 2: letter = 'c';
        break;
      case 3: letter = 'd';
        break;
      default: letter = "No match!";
        Component.AddRuntimeMessage(GH_RuntimeMessageLevel.Warning, "Unpredicted result!");
        break;
    }
# ---------- end e_7_caseswitchstatement ----------
# Conditionals
e_01_ifstatement = E_01_IfStatement()  # -> out; inputs x: Double, y: Double; disabled
# ---------- e_01_ifstatement: C# ----------
    // Curly braces {} separate a block of code (multiple statements) that will be executed inside an "if()" statement
    
    // Remember! If there is only a single instruction after "if()" you may omit the braces!
    
    if(x > y) 
    {
      Print("x is larger than y");
    }
    if(x < y) 
    {
      Print("x is smaller than y");
    }
    if(x == y) 
    {
      Print("x is equal to y");
    }
# ---------- end e_01_ifstatement ----------
e_02_ifelse = E_02_IfElse()  # -> out; inputs x: Double; disabled
# ---------- e_02_ifelse: C# ----------
    if(x > 0) {
      Print("x is larger than zero");
    }
    else {
      Print("x is equal or smaller than zero");
    }
# ---------- end e_02_ifelse ----------
e_04_changeflowwitbraces = E_04_ChangeFlowWitBraces()  # -> out; disabled
# ---------- e_04_changeflowwitbraces: C# ----------
    //Remember! If there is only a single instruction after "if()" you may omit the braces!

    if(true)
    {
      Print("Always true");
      if(false)
        Print("Never here");
    }
    else
      Print("It depends on braces");
# ---------- end e_04_changeflowwitbraces ----------
e_06_quadraticequation = E_06_QuadraticEquation()  # -> out, del, x1, x2; inputs paramA: Double, paramB: Double, paramC: Double; disabled
# ---------- e_06_quadraticequation: C# ----------
    char pow2 = '\u00B2';
    Print("Equation: {0}x{3} + {1}x + {2}", paramA, paramB, paramC, pow2);

    if(paramA == 0)
    {
      Print("This is not a quadratic equation!");
      // this is how you can add some warnings or remarks:
      Component.AddRuntimeMessage(GH_RuntimeMessageLevel.Error, "This is not a quadratic equation!");
      return; // return means quitting execution
    }
    else
    {
      double delta = Math.Pow(paramB, 2) - 4 * paramA * paramC;
      del = delta;

      if(delta < 0)
      {
        Print("Delta < 0. No real number solution!");
        Component.AddRuntimeMessage(GH_RuntimeMessageLevel.Warning, "Delta < 0. No real number solution!");
        return;
      }
      else if(delta == 0)
      {
        Print("Delta == 0. Single solution.");
        Component.AddRuntimeMessage(GH_RuntimeMessageLevel.Remark, "Delta == 0. Single solution.");
        x1 = x2 = -paramB / (2 * paramA);
      }
      else
      {
        Print("Delta > 0. Two solutions.");
        x1 = -paramB - Math.Sqrt(delta) / (2 * paramA);
        x2 = -paramB + Math.Sqrt(delta) / (2 * paramA);
      }
    }
# ---------- end e_06_quadraticequation ----------

# ----
# Loops
f_01_loops = F_01_Loops()  # -> out; inputs iterations: Int32; disabled
# ---------- f_01_loops: C# ----------
    for(int i = 0; i < iterations; i++)
      Print(i.ToString());
# ---------- end f_01_loops ----------
f_03_evennumbersloop = F_03_EvenNumbersLoop()  # -> out; inputs iterations: Int32; disabled
# ---------- f_03_evennumbersloop: C# ----------
    Component.Message = "Even numbers";
    
    for(int i = 0; i < iterations; i++)
    {
      if(i%2 != 0)
        continue;
      Print(i.ToString());
    }
# ---------- end f_03_evennumbersloop ----------
f_02_psuedoseriesloop = F_02_PsuedoSeriesLoop()  # -> out, A; inputs start: Int32, step: Int32, count: Int32; disabled
# ---------- f_02_psuedoseriesloop: C# ----------
    for(int i = 0; i < count; i++)
    {
      A = i * step + start;
      Print("i: {0}, A = {1}", i, A);
    }
# ---------- end f_02_psuedoseriesloop ----------
f_04_breakcontinueloopwithcomponentmessa = F_04_BreakContinueLoopWithComponentMessage()  # -> out; inputs iterations: Int32, smallerThan: Int32; disabled
# ---------- f_04_breakcontinueloopwithcomponentmessa: C# ----------
    Component.Message = "Uneven numbers";

    for(int i = 0; i < iterations; i++)
    {
      if(i >= smallerThan)
        break;
      if(i % 2 != 0)
        continue;
      Print(i.ToString());
    }
# ---------- end f_04_breakcontinueloopwithcomponentmessa ----------
f_05_riskyloopvariation = F_05_RiskyLoopVariation()  # -> out; inputs iterations: Int32; disabled
# ---------- f_05_riskyloopvariation: C# ----------
    Component.Message = "for() loop variations";

    int i = 0;
    for(; ;)  //risky infinite loop
    {
      if(i >= iterations)
        break;
      if(i++ % 2 != 0)
        continue;
      Print(i.ToString());
    }
# ---------- end f_05_riskyloopvariation ----------
g_01_whileloop_2 = G_01_WhileLoop()  # -> out; inputs max: Double; disabled; same code as g_01_whileloop
f_11_foreachloop = F_11_ForeachLoop()  # -> out, multiplied; inputs numList: list of Double, multiplier: Double; disabled; same code as l_02_foreachloop
i_01_gotoreturninstruction = I_01_GotoReturnInstruction()  # -> out, biggerNumber; inputs x: Double, y: Double; disabled
# ---------- i_01_gotoreturninstruction: C# ----------
    if(x>y)
      goto labelX;
    else
      goto labelY;
    
    labelX: 
    biggerNumber = x; 
    return;       // means we are not going anywhere further
    
    labelY: 
    biggerNumber = y;
# ---------- end i_01_gotoreturninstruction ----------
g_02_whileloopbreakcontinue = G_02_WhileLoopBreakContinue()  # -> out; inputs max: Double, breakVal: Int32; disabled
# ---------- g_02_whileloopbreakcontinue: C# ----------
    int i = 0;
    while(i <= max)
    {
      if(i == breakVal)
        break;
      if(i % 3 != 0)
      {
        i++;
        continue;
      }
      Print((++i).ToString());
    }
# ---------- end g_02_whileloopbreakcontinue ----------
h_01_dowhileloop = H_01_DoWhileLoop()  # -> out; inputs start: Int32, max: Double; disabled
# ---------- h_01_dowhileloop: C# ----------
    int i = start;
    do
    {
      Print(i.ToString());
      i++;
      if(i > max)
        break;
    }
    while(i < int.MaxValue);  //checking for overflow only
# ---------- end h_01_dowhileloop ----------
i_02_exitloopwithgoto = I_02_ExitLoopWithGoto()  # -> out; inputs start: Int32; disabled
# ---------- i_02_exitloopwithgoto: C# ----------
    Component.Message = "Countdown";

    int i = start;

    while(true) //infinite loop warning!
    {
      if(i < 0)
        goto exit;
      Print(i.ToString());
      i--;
    }

    exit:
      return;
# ---------- end i_02_exitloopwithgoto ----------

k_03_createemptyarraypolyline = K_03_CreateEmptyArrayPolyline()  # -> out, myArray; inputs count: Int32; disabled
# ---------- k_03_createemptyarraypolyline: C# ----------
    if(default(Polyline) == null)
      Print("Polyline defualt value: <null>");

    Polyline[] pLineArray = new Polyline[count];    //creates an array of <count> elements and initializes them with default values
    myArray = pLineArray;
# ---------- end k_03_createemptyarraypolyline ----------
# Arrays
k_01_createemptyarray = K_01_CreateEmptyArray()  # -> out, myArray; inputs count: Int32; disabled
# ---------- k_01_createemptyarray: C# ----------
    int[] intArray = new int[count];    //creates an array of <count> elements and initializes them with default values
    myArray = intArray;
# ---------- end k_01_createemptyarray ----------
k_createarray3dpoints = K_CreateArray3DPoints()  # -> out, myArray; inputs count: Int32; disabled
# ---------- k_createarray3dpoints: C# ----------
    Print("Point3d default value: {0}", default(Point3d));
    
    Point3d[] ptArray = new Point3d[count];    //creates an array of <count> elements and initializes them with default values
    myArray = ptArray;
# ---------- end k_createarray3dpoints ----------
k_05_series = K_05_Series()  # -> out, S; inputs start: Int32, step: Int32, count: Int32; disabled
# ---------- k_05_series: C# ----------
    Component.Message = "Series";

    int[] series = new int[count];

    for(int i = 0; i < count; i++)
    {
      series[i] = start + i * step;
      Print("i: {0}, series[i]: {1} + {2} * {3} = {4}", i, start, i, step, series[i]);
    }

    S = series;
# ---------- end k_05_series ----------
k_fillingarray = K_FillingArray()  # -> out, array1, array2; disabled
# ---------- k_fillingarray: C# ----------
    int[] intArray = new int[4];
    intArray[0] = 1;
    intArray[1] = 3;
    intArray[2] = 3;
    intArray[3] = 7;

    int[] intArray2 = {3, 4, 6, 1, 10};

    array1 = intArray;
    array2 = intArray2;
# ---------- end k_fillingarray ----------
k_08_gridofpoints_multidimarray = K_08_GridOfPointsMultiDimArray()  # -> out, ptGrid; inputs x: Int32, y: Int32, z: Int32, spacing: Double; disabled
# ---------- k_08_gridofpoints_multidimarray: C# ----------
    Point3d[,,] grid = new Point3d[x, y, z];  //a multidimensional array

    for(int i = 0; i < x; i++)
    {
      for(int j = 0; j < y; j++)
      {
        for(int k = 0; k < z; k++)
        {
          Print("i: {0}, j: {1}, k: {2}", i, j, k);
          grid[i, j, k].X = i * spacing;
          grid[i, j, k].Y = j * spacing;
          grid[i, j, k].Z = k * spacing;
        }
      }
    }

    ptGrid = grid;
# ---------- end k_08_gridofpoints_multidimarray ----------
k_06_gripof3dpoints_nestedloops = K_06_GripOf3DPointsNestedLoops()  # -> out, ptGrid; inputs x: Int32, y: Int32, z: Int32, spacing: Double; disabled
# ---------- k_06_gripof3dpoints_nestedloops: C# ----------
    Point3d[] grid = new Point3d[x * y * z];
    int index = 0;

    for(int i = 0; i < x; i++)
    {
      for(int j = 0; j < y; j++)
      {
        for(int k = 0; k < z; k++)
        {
          Print("i: {0}, j: {1}, k: {2}", i, j, k);
          index = i * y * z + j * z + k;
          grid[index].X = i * spacing;
          grid[index].Y = j * spacing;
          grid[index].Z = k * spacing;
        }
      }
    }

    ptGrid = grid;
# ---------- end k_06_gripof3dpoints_nestedloops ----------
k_06_range = K_06_Range()  # -> out, R; inputs start: Double, end: Double, steps: Int32; disabled
# ---------- k_06_range: C# ----------
    Component.Message = "Range";

    Interval domain = new Interval(start, end);
    Print("Created domain: {0} To {1}", domain.T0, domain.T1);

    double[] range = new double[steps + 1];

    for(int i = 0; i <= steps; i++)
    {
      range[i] = domain.T0 + i * (domain.Length / steps);
    }

    R = range;
# ---------- end k_06_range ----------

# ----
# Lists
l_01_createemptylists = L_01_CreateEmptyLists()  # -> out, pointListNoInitialCap, pointListInitialCap; inputs count: Int32; disabled
# ---------- l_01_createemptylists: C# ----------
    List<Point3d> noInitCap = new List<Point3d>();
    List<Point3d> initCap = new List<Point3d>(count);

    Print("noInitCap.Count: {0}", noInitCap.Count);
    Print("initCap.Count: {0}", initCap.Count);

    pointListNoInitialCap = noInitCap;
    pointListInitialCap = initCap;
# ---------- end l_01_createemptylists ----------
l_02_foreachloop_2 = L_02_ForeachLoop()  # -> out, multiplied; inputs numList: list of Double, multiplier: Double; disabled; same code as l_02_foreachloop
l_04_randomnumbergenerator_2 = L_04_RandomNumberGenerator()  # -> out, numbers; inputs min: Double, max: Double, count: Int32, seed: Int32; disabled; same code as l_04_randomnumbergenerator
l_03_removeitemfromlist = L_03_RemoveItemFromList()  # -> out, culledList; inputs numList: list of Double; disabled
# ---------- l_03_removeitemfromlist: C# ----------
    Component.Message = "Cull negative numbers";

    //Wrong approach: it would omit the second of every two consecutive negative numbers!
    /*
    for(int i = 0; i < numList.Count; i++)
    {
      if(numList[i] < 0)
        numList.RemoveAt(i);
    }
    */
    
    //Good approach:
    for(int i = numList.Count - 1; i >= 0; i--)
    {
      if(numList[i] < 0)
        numList.RemoveAt(i);
    }

    culledList = numList;
# ---------- end l_03_removeitemfromlist ----------
l_05_list3dpointandrandomclass = L_05_List3DPointAndRandomClass()  # -> out, points; inputs height: Int32, spacing: Double, amplitude: Double, seed: Int32; disabled
# ---------- l_05_list3dpointandrandomclass: C# ----------
    Component.Message = "Point tower";

    Random myRandGen = new Random(seed);
    List<Point3d> ptList = new List<Point3d>(height); //no need to provide initial capacity, but it's faster
    Vector3d translation = new Vector3d(amplitude, 0, 0);
    Point3d lastPt = new Point3d();

    int i = 0;
    while(i < height)
    {
      double radAngle = (double) myRandGen.Next(0, 359) / 180 * Math.PI;
      translation.Rotate(radAngle, Vector3d.ZAxis);
      lastPt += translation;
      lastPt.Z = i * spacing;
      ptList.Add(lastPt);
      i++;
    }

    points = ptList;
# ---------- end l_05_list3dpointandrandomclass ----------

m_06_paramsmodifiersreturnvalue = M_06_ParamsModifiersReturnValue()  # -> out, concatenatedString; inputs partA: String, partB: String, partC: String; disabled
# ---------- m_06_paramsmodifiersreturnvalue: C# ----------
    Component.Message = "Concatenation with params";

    concatenatedString = Concat("Concatenated: ", partA, partB, partC);
# ---------- m_06_paramsmodifiersreturnvalue: C# additional code ----------
  string Concat(params string[] text)
  {
    string concatenated = null;
    foreach(string part in text)  //not very good, because a new string is created every time
      concatenated += part;

    return concatenated;
  }
# ---------- end m_06_paramsmodifiersreturnvalue ----------
m_02_noreturnsingleparam = M_02_NoReturnSingleParam()  # -> out; inputs num: Double; disabled
# ---------- m_02_noreturnsingleparam: C# ----------
    PrintNumber(num);
# ---------- m_02_noreturnsingleparam: C# additional code ----------
  void PrintNumber(double n)
  {
    Print("The current number is: {0}", n);
  }
# ---------- end m_02_noreturnsingleparam ----------
m_04_overloadingmethodwitparams = M_04_OverloadingMethodWitParams()  # -> out; inputs num: Double, label: String; disabled
# ---------- m_04_overloadingmethodwitparams: C# ----------
    PrintNumber(num);
    PrintNumber(num, label);
# ---------- m_04_overloadingmethodwitparams: C# additional code ----------
  void PrintNumber(double n)
  {
    Print("The current number is: {0}", n);
  }

  //this is called method overloading:
  //same name, different parameters -> different method signature
  void PrintNumber(double n, string label)
  {
    Print("{0} {1}", label, n);
  }
# ---------- end m_04_overloadingmethodwitparams ----------
m_05_settingdefaultvalues = M_05_SettingDefaultValues()  # -> out; inputs num: Double, label: String; disabled
# ---------- m_05_settingdefaultvalues: C# ----------
    PrintNumber(num); //equivalent to PrintNumber(num, "label:");
    PrintNumber(num, label);
# ---------- m_05_settingdefaultvalues: C# additional code ----------
  //if you don't want to overload a method, you can use optional parameters:
  //if an optional argument is not provided, the default value will be passed
  void PrintNumber(double n, string label = "default label:")
  {
    Print("{0} {1}", label, n);
  }
# ---------- end m_05_settingdefaultvalues ----------
m_17_arrayfromstartendvalues = M_17_ArrayFromStartEndValues()  # -> out, A; inputs start: Int32, end: Int32; disabled
# ---------- m_17_arrayfromstartendvalues: C# ----------
    Component.Message = "Array start/end";
    A = Range(start, end);
# ---------- m_17_arrayfromstartendvalues: C# additional code ----------
  int[] Range(int start, int end)
  {
    int count = (end - start) + 1;
    if(count < 1)
      return null;
    int[] range = new int[count];
    for(int i = 0; i != count; ++i)
    {
      range[i] = start + i;
    }
    return range;
  }
# ---------- end m_17_arrayfromstartendvalues ----------
m_03_returningvalue = M_03_returningValue()  # -> out, result; inputs x: Double; disabled
# ---------- m_03_returningvalue: C# ----------
    result = TwoTimes(x);
# ---------- m_03_returningvalue: C# additional code ----------
  public double TwoTimes(double a)
  {
    return a * 2;
  }
# ---------- end m_03_returningvalue ----------
m_07_passargumentsbyvalue = M_07_PassArgumentsByValue()  # -> out; inputs x: Double; disabled
# ---------- m_07_passargumentsbyvalue: C# ----------
    Component.Message = "By Value";
    NumIncrement(x);
    Print("After NumIncrement... x = {0}", x);
    //if you pass an argument by value, then a copy is created
    // every change made to that copy is not affecting the original data
# ---------- m_07_passargumentsbyvalue: C# additional code ----------
  void NumIncrement(double num)
  {
    num++;
    Print("In NumIncrement... x = {0}", num);
  }
# ---------- end m_07_passargumentsbyvalue ----------
m_08_passargsbyreference = M_08_PassArgsByReference()  # -> out; inputs x: Double; disabled
# ---------- m_08_passargsbyreference: C# ----------
    Component.Message = "By Reference";
    NumIncrement(ref x);
    Print("After NumIncrement... x = {0}", x);
    //if you pass an argument by reference, then a reference to an object is passed
    // you're in fact changing the original object
# ---------- m_08_passargsbyreference: C# additional code ----------
  void NumIncrement(ref double num)
  {
    num++;
    Print("In NumIncrement... x = {0}", num);
  }
# ---------- end m_08_passargsbyreference ----------
# Methods
m_01_simplestmethod = M_01_SimplestMethod()  # -> out; disabled
# ---------- m_01_simplestmethod: C# ----------
    SayHello();
# ---------- m_01_simplestmethod: C# additional code ----------
  //takes no arguments and returns no value
  void SayHello()
  {
    Print("Hello");
  }
# ---------- end m_01_simplestmethod ----------
m_15_idealelasticbounce = M_15_IdealElasticBounce()  # -> out, bounceVector; inputs speedVector: Vector3d, localNormal: Vector3d; disabled
# ---------- m_15_idealelasticbounce: C# ----------
    Component.Message = "Calculate bounce";
    Component.Description = "Calculates an ideally elastic bounce";

    bounceVector = ComputeBounceVector(speedVector, localNormal);
# ---------- m_15_idealelasticbounce: C# additional code ----------
  private Vector3d ComputeBounceVector(Vector3d speed, Vector3d normalVectorAtBounce)
  {
    Vector3d perpSpeed = ((speed * normalVectorAtBounce) / (normalVectorAtBounce * normalVectorAtBounce)) * normalVectorAtBounce;
    Vector3d parallelSpeed = speed - perpSpeed;
    return parallelSpeed - perpSpeed;
  }
# ---------- end m_15_idealelasticbounce ----------
m_16_returnsymetryplane = M_16_ReturnSymetryPlane()  # -> out, symmetryPlane; inputs point1: Point3d, point2: Point3d, point3: Point3d; disabled
# ---------- m_16_returnsymetryplane: C# ----------
    Component.Message = "Plane of symmetry";

    symmetryPlane = SymmetryPlane3Pt(point1, point2, point3);
# ---------- m_16_returnsymetryplane: C# additional code ----------
  private Plane SymmetryPlane3Pt(Point3d pt1, Point3d midPt, Point3d pt2)
  {
    Vector3d vec1 = new Vector3d(pt1 - midPt);
    Vector3d vec2 = new Vector3d(pt2 - midPt);

    vec1.Unitize();
    vec2.Unitize();
    double dotProduct = vec1 * vec2;

    if(dotProduct == 1 || dotProduct == -1) //parallel vectors
    {
      return new Plane(midPt, -vec1);
    }
    else
    {
      return new Plane(midPt, Vector3d.CrossProduct(vec1, vec2), vec1 + vec2);
    }
  }
# ---------- end m_16_returnsymetryplane ----------
m_14_calculatorenumswitch = M_14_CalculatorEnumSwitch()  # -> out, result; inputs calculationType: Int32, A: Double, B: Double; disabled
# ---------- m_14_calculatorenumswitch: C# ----------
    Component.Message = "Calculator";
    CalcType option;

    switch(calculationType)
    {
      case 0: option = CalcType.addition; break;
      case 1: option = CalcType.subtraction; break;
      case 2: option = CalcType.multiplication; break;
      case 3: option = CalcType.division; break;
      default: option = CalcType.error; break;
    }

    result = Compute(A, B, option);
# ---------- m_14_calculatorenumswitch: C# additional code ----------
  private double Compute(double num1, double num2, CalcType type)
  {
    //in case your switch case ends with return, you don't need "break;'s"
    //this is because other statements wouldn't execute anyway
    switch(type)
    {
      case CalcType.addition: return num1 + num2;
      case CalcType.subtraction: return num1 - num2;
      case CalcType.multiplication: return num1 * num2;
      case CalcType.division: return num1 / num2;
      default: return 0;
    }
  }

  enum CalcType
  {
    addition,
    subtraction,
    multiplication,
    division,
    error = 100
  }
# ---------- end m_14_calculatorenumswitch ----------
m_13_parsedtodouble = M_13_ParsedtoDouble()  # -> out, parsedToDouble; inputs text: String; disabled
# ---------- m_13_parsedtodouble: C# ----------
    Component.Message = "Parsing";

    double result;
    bool flag = false;

    flag = double.TryParse(text, out result);

    if(flag)
      parsedToDouble = result;
    else
      throw new InvalidCastException("Parsing from text to double failed");
# ---------- end m_13_parsedtodouble ----------
m_09_swapdatavaluevsreference = M_09_SwapDataValueVSReference()  # -> out, prevX, prevY; inputs x: Double, y: Double; disabled
# ---------- m_09_swapdatavaluevsreference: C# ----------
    Component.Message = "Swap values";
    Swap(x, y);
    prevX = x;
    prevY = y;
# ---------- m_09_swapdatavaluevsreference: C# additional code ----------
  void Swap (double a, double b)
  {
    //these changes happen only localy in this scope (between these braces)
    double temp = a;
    a = b;
    b = temp;
  }
# ---------- end m_09_swapdatavaluevsreference ----------
m_10_swapdatabyreference = M_10_SwapDataByReference()  # -> out, prevX, prevY; inputs x: Double, y: Double; disabled
# ---------- m_10_swapdatabyreference: C# ----------
    Component.Message = "Swap values";
    Swap(ref x, ref y); //notice ref keyword is needed both in method definition and method call
    prevX = x;
    prevY = y;
# ---------- m_10_swapdatabyreference: C# additional code ----------
  void Swap (ref double a, ref double b)
  {
    double temp = a;
    a = b;
    b = temp;
  }
# ---------- end m_10_swapdatabyreference ----------
m_11_returnvaluewithoutmodifier = M_11_ReturnValueWithOutModifier()  # -> out, result; inputs x: Double, y: Double; disabled
# ---------- m_11_returnvaluewithoutmodifier: C# ----------
    double myResult;  // one of the differences between out and ref is when you use out, you don't need to initialize passed arguments
    bool success = TryDivide(x, y, out myResult);
    if(!success)
    {
      throw new DivideByZeroException("Division by zero is not allowed");
    }
    else
    {
      Print("Everything went well");
      result = myResult;
    }
# ---------- m_11_returnvaluewithoutmodifier: C# additional code ----------
  bool TryDivide(double num1, double num2, out double result)
  {
    if(num2 == 0)
    {
      result = -1;
      return false;
    }
    else
    {
      result = num1 / num2;
      return true;
    }
  }
# ---------- end m_11_returnvaluewithoutmodifier ----------
m_12_outmodifierexample_1 = M_12_OutModifierExample1()  # -> out, P, t, D; inputs pt: Point3d, crv: Curve; disabled
# ---------- m_12_outmodifierexample_1: C# ----------
    Component.Message = "Curve closest point";

    bool flag = false;
    double parameter;
    flag = crv.ClosestPoint(pt, out parameter);
    if(flag)
    {
      Print("Success!");
      P = crv.PointAt(parameter);
      t = parameter;
      D = pt.DistanceTo((Point3d) P); //unboxing conversion needed here
    }
    else
    {
      throw new InvalidOperationException("Finding closest point failed");
    }
# ---------- end m_12_outmodifierexample_1 ----------

# ----
# Intermediate C#
#  Custom Nodes
iterationexercise_1conch = IterationExercise1Conch()  # -> out, Lines; inputs inputLine: Line, angle: Double, minLength: Double; disabled
# ---------- iterationexercise_1conch: C# ----------
    //Declare all lines
    var allLines = new List<Line>();
    //Find current length
    double length = inputLine.Length;
    Line newLine = default(Line);
    newLine = inputLine;
    //Loop until length is less than min length
    while (length > minLength) {
      //Generate the new line
      newLine = DivideAndRotate(newLine, angle);
      //Add to list
      allLines.Add(newLine);
      //Stopping condition
      length = newLine.Length;
    }
    //Assign return value
    Lines = allLines;
# ---------- iterationexercise_1conch: C# additional code ----------
  public Line DivideAndRotate(Line currLine, double angle)
  {
    //Take a portion of the line
    Line newLine = new Line();
    newLine = currLine;
    Point3d endPt = new Point3d();
    endPt = newLine.PointAt(0.95);
    newLine.To = endPt;
    //Rotate
    newLine.Transform(Transform.Rotation(angle, Vector3d.ZAxis, newLine.From));
    //Function return
    return newLine;
  }
# ---------- end iterationexercise_1conch ----------
incrementtolimit = IncrementUntilPosLimit()  # -> out, A; inputs increment: Int32, posLimit: Int32; disabled
# ---------- incrementtolimit: C# ----------
    int sum = 0;
    int counter = 0;
    int number = 1;

    //Loop
    while (sum < posLimit)
    {
      sum = sum + number;
      //Make sure you increment the counter and the number
      counter = counter + 1;
      number = number + increment;
    }
    //Remove last number
    sum -= number;
    counter--;

    Print("Count = " + counter);
    Print("Sum = " + sum);
# ---------- end incrementtolimit ----------
checkprimeandfactors = CheckPrimeAndFactors()  # -> out, IsPrime, Factors; inputs num: Int32; disabled
# ---------- checkprimeandfactors: C# ----------
    //Assign variables to output
    List<int> factors = new List<int>();
    IsPrime = isPrimeNumber(num, factors);

    //Assign output
    Factors = factors;
# ---------- checkprimeandfactors: C# additional code ----------
  //Addition method
  bool isPrimeNumber(int num, List<int> factors)
  {
    //all numbers are divisible by 1
    factors.Add(1);
    bool primeFlag = true;
    for( int i = 2; i < (num / 2); i++)
    {
      if( num % i == 0)
      {
        primeFlag = false;
        factors.Add(i);
      }
    }
    //all numbers are divisible by the number itself
    factors.Add(num);

    return primeFlag;
  }
# ---------- end checkprimeandfactors ----------
processoneitemattimeadd = ProcessOneItemAtATimeAddNumber()  # -> out, A; inputs x: Double, number: Double; disabled
# ---------- processoneitemattimeadd: C# ----------
    A = x + number;
    Print("Run# " + Iteration);
# ---------- end processoneitemattimeadd ----------
processwholelistadd = ProcessWholeListAddNumber()  # -> out, A; inputs xList: list of Double, number: Double; disabled
# ---------- processwholelistadd: C# ----------
    List<double> newList = new List<double>();
    foreach( var x in xList)
      newList.Add(x + number);
    Print("Run# " + Iteration);
    A = newList;
# ---------- end processwholelistadd ----------
process_the_whole_list_to_calculate_the = ProcessWholeListSum()  # -> out, Sum; "Process the whole list to calculate the sum"; inputs xList: list of Double; disabled
# ---------- process_the_whole_list_to_calculate_the: C# ----------
    double xSum = 0;
    foreach( var x in xList)
      xSum = xSum + x;
    Print("Run# " + Iteration);
    Sum = xSum;
# ---------- end process_the_whole_list_to_calculate_the ----------
numberofletters = OutputNumberOfLetter()  # -> out, A; inputs fruits: list of String; disabled
# ---------- numberofletters: C# ----------
    //Declare and initialize the count
    int count = 0;

    //Loop through the fruits

    foreach (string fruit in fruits)
    {
      //loop through the letters in each fruit

      foreach (char letter in fruit)
      {
        //compare to see if the letter is the same as input "x"
        if (letter == 'a')
        {
          count = count + 1;
        }
      }
    }
    Print("Letter a is repeated " + count + " times");
    A = count;
# ---------- end numberofletters ----------
checkforstringandnumberofletters = CheckForStringAndNumberOfLetters()  # -> out, A; inputs fruits: list of String; disabled
# ---------- checkforstringandnumberofletters: C# ----------
    //Check if there is at least one orange
    foreach (string fruit in fruits)
    {
      //Check if it is an orange
      if (fruit == "orange")
      {
        //Check if the letter is ‘a"
        Print("Found an orange");
        //No need to check the rest of the list, exit the loop
        break;
      }
    }
    //Check how many fruits has at least one letter ‘r’ in the name
    int count = 0;
    //Loop through the fruits
    foreach (string fruit in fruits)
    {
      //loop through the letters in each fruit
      foreach (char letter in fruit)
      {
        //Check if the letter is ‘r"
        if(letter == 'r')
        {
          count = count + 1;
          //No need to check the rest of the letters, and skip to the next fruit
          continue;
        }
      }
    }
    Print("Number of fruits that has at least one letter r is: " + count);
    A = count;
# ---------- end checkforstringandnumberofletters ----------
sumtreenum = FindSumOfNumbersInTree()  # -> out, Sum; inputs x: tree of Double; disabled
# ---------- sumtreenum: C# ----------
    double xSum = 0;
    foreach (List<double> branch in x.Branches)
    {
      foreach (double num in branch)
      {
        xSum = xSum + num;
      }
    }
    Sum = xSum;
# ---------- end sumtreenum ----------
whileloopcollatz = WhileLoopCollatzConjecture()  # -> out, A; inputs x: Int32; disabled
# ---------- whileloopcollatz: C# ----------
    while(x > 1)
    {
      Print(x.ToString());
      if(x % 2 == 0)
        x = x / 2;
      else
        x = x * 3 + 1;
    }
    Print(x.ToString());
# ---------- end whileloopcollatz ----------
methodaddmultitwonums = MethodAddMultiTwoNums()  # -> out, A, B; inputs x: Double, y: Double; disabled
# ---------- methodaddmultitwonums: C# ----------
    //Declare and initialize the variables
    double add_xy = 0.0;
    double multiply_xy = 0.0;

    //Assign function result to to the addition result variable
    add_xy = Add(x, y);

    //Pass the multiplication result variable by reference to allow changing its value inside the sub
    Multiply(x, y, ref multiply_xy);

    //Assign variables to output
    A = add_xy;
    B = multiply_xy;
# ---------- methodaddmultitwonums: C# additional code ----------
  
  //Addition method
  public double Add(double x, double y)
  {
    return x + y;
  }

  //Multiplication method
  public void Multiply(double x, double y, ref double rc)
  {
    rc = x * y;
  }
# ---------- end methodaddmultitwonums ----------
dividefunctionpassbyreference = DivideFunctionPassByReference()  # -> out, A; inputs x: Double, y: Double; disabled
# ---------- dividefunctionpassbyreference: C# ----------
    //Declare and initialize the result variable
    double rc = 0.0;

    //Pass the divide result variable by reference to allow changing its value inside the method
    bool valid = Divide(x, y, ref rc);
    if( valid)
    {
      //Assign variables to output
      A = rc;
    }
    else
    {
      Print("Divide by zero error");
    }
# ---------- dividefunctionpassbyreference: C# additional code ----------
  //Divide method
  public bool Divide(double x, double y, ref double rc)
  {
    if (Math.Abs(y) < 1e-100)
      return false;
    else
      rc = x / y;
    return true;
  }
# ---------- end dividefunctionpassbyreference ----------
createarrayassignweekdays = CreateArrayAndAssignValuesWeekdays()  # -> out, A; disabled
# ---------- createarrayassignweekdays: C# ----------
    //Declare the days of the week in one statement, then assign the values later
    string[ ] weekdays = new string[7];
    weekdays[0] = "Sunday";
    weekdays[1] = "Monday";
    weekdays[2] = "Tuesday";
    weekdays[3] = "Wednesday";
    weekdays[4] = "Thursday";
    weekdays[5] = "Friday";
    weekdays[6] = "Saturday";

    //Assign myArray to the output A
    A = weekdays;
# ---------- end createarrayassignweekdays ----------
listcreatespheres = ListCreateSpheres()  # -> out, Spheres; inputs ptList: list of Point3d, raduis: Double; disabled
# ---------- listcreatespheres: C# ----------
    List<Sphere> sphereList = new List<Sphere>();
    foreach (Point3d pt in ptList) {
      Sphere sphere = new Sphere(pt, 0.5);
      sphereList.Add(sphere);
    }
    Print("Run# " + Iteration);
    Spheres = sphereList;
# ---------- end listcreatespheres ----------

number_slider_13 = Slider(10, range=0..10)  # disabled
number_slider_14 = Slider(2, range=0..10)  # disabled
number_slider_15 = Slider(3, range=-10..10)  # disabled
constructorcreaterotatedellispes = ConstructorCreateRotatedEllispes()  # -> out, OutCurves; inputs radAngles: Double, count: Int32, XShift: Double; disabled
# ---------- constructorcreaterotatedellispes: C# ----------
    double R = radAngles; //angle in radian
    int N = count; //number of ellipses
    double X = XShift; // shift along X axis

    //Declare a new list of ellipse curve type
    List<Ellipse> eList = new List<Ellipse>();

    //Use a loop to create a number of ellipse curves
    Plane plane = Plane.WorldXY;

    for (Int32 i = 1; i <= N; i++) {
      Point3d pt = new Point3d(X, 0, 0);
      Vector3d Y = new Vector3d(0, 1, 0);
      plane.Rotate(R * i, Y, pt);

      //Declare and instantiate a new ellipse
      Ellipse C = new Ellipse(plane, (double) i / 2, i);

      //Add the ellipse to the list
      eList.Add(C);
    }

    //Assign the list to the output value A
    OutCurves = eList;
# ---------- end constructorcreaterotatedellispes ----------
structcreatesphere_2 = StructCreateSphere()  # -> out, A; inputs centerPt: Point3d, radius: Double; disabled; same code as structcreatesphere
methodmultipleoffsetofcurve = MethodMultipleOffsetOfCurve()  # -> out, OutCurves; inputs crv: Curve, num: Int32, dis: Double, tol: Double, plane: Plane; disabled
# ---------- methodmultipleoffsetofcurve: C# ----------
    //Declare the list of curve
    List<Curve> crvs = new List<Curve>();

    //The curve to offset
    Curve last_crv = crv;

    //Create offset curves
    for (int i = 1; i <= num; i++) {
      //offset
      Curve[] crv_array = last_crv.Offset(plane, dis, tol, CurveOffsetCornerStyle.None);

      //Ignore if output is multiple offset curves
      if (crv.IsValid && crv_array.Count() == 1) {
        //append offset curve to array
        crvs.Add(crv_array[0]);

        //update the next curve to offset
        last_crv = crv_array[0];
      } else {
        break;
      }
    }

    //Assign output
    OutCurves = crvs;
# ---------- end methodmultipleoffsetofcurve ----------
methodgetcontrolpointsofnurbscurve = MethodGetControlPointsOfNURBSCurve()  # -> out, CPoints; inputs crv: Curve; disabled
# ---------- methodgetcontrolpointsofnurbscurve: C# ----------
    //Find the nurbs form of the curve
    NurbsCurve nc = crv.ToNurbsCurve();

    List<Point3d> cp_list = new List<Point3d>();
    int count = 0;
    count = nc.Points.Count;
    int i = 0;

    //Loop to get all cv points
    for (i = 0; i <= count - 1; i++) {
      ControlPoint cp = new ControlPoint();
      cp = nc.Points[i];
      cp_list.Add(cp.Location);
    }

    //Output control points
    CPoints = cp_list;
# ---------- end methodgetcontrolpointsofnurbscurve ----------
methodgetknotlistofnurbscurve = MethodGetKnotListOfNURBSCurve()  # -> out, Knots; inputs crv: Curve; disabled
# ---------- methodgetknotlistofnurbscurve: C# ----------
    //Find the nurbs form of the curve
    NurbsCurve nc = crv.ToNurbsCurve();

    List<double> knotList = new List<double>();
    int count = 0;
    count = nc.Points.Count;
    int i = 0;

    //Loop to get all knots values
    for (i = 0; i <= count - 1; i++) {
      double knot = nc.Knots[i];
      knotList.Add(knot);
    }

    //Output knots
    Knots = knotList;
# ---------- end methodgetknotlistofnurbscurve ----------
operatorcalculatevectorbetweenvectors = OperatorCalculateVectorBetweenVectors()  # -> out, A; inputs v0: Vector3d, v1: Vector3d; disabled
# ---------- operatorcalculatevectorbetweenvectors: C# ----------
    //Check input
    if(v0.IsZero || v1.IsZero)
    {
      Print("Invalid input");
      return;
    }
    // Unitize the input vectors
    v0.Unitize();
    v1.Unitize();
    double dot = v0 * v1;
    Print("v0 dot v1 = " + dot);
    // Force the dot product of the two input vectors to
    // fall within the domain for inverse cosine, which
    // is -1 <= x <= 1. This will prevent runtime
    // "domain error" math exceptions.
    if ((dot < -1.0))
      dot = -1.0;
    if ((dot > 1.0))
      dot = 1.0;
    A = System.Math.Acos(dot);
# ---------- end operatorcalculatevectorbetweenvectors ----------
structcreatecirclerandom = StructCreateCircleRandom(
    m=number_slider_13,
    x=number_slider_14,
    y=number_slider_14,
    z=number_slider_14,
    u=number_slider_15,
    v=number_slider_15,
    w=number_slider_15)  # -> out, A, B; inputs m: Int32, x: Int32, y: Int32, z: Int32, u: Int32, v: Int32, w: Int32; disabled
# ---------- structcreatecirclerandom: C# ----------
    //Generate a random radius of a circle
    Random rand = new Random();
    double radius = rand.Next(m, 2 * m);
    //Create xy_plane using the Plane static function WorldXY
    Plane plane = Plane.WorldXY;
    //Set plane origin to (x,y,z)
    Point3d center = new Point3d(u, v, w);
    plane.Origin = center;
    //Create a circle from plane and radius
    Circle circle = new Circle(plane, radius);

    A = circle;
    B = center;
# ---------- end structcreatecirclerandom ----------
staticmethodcreatesurfacebetweentwosurfa = StaticMethodCreateSurfaceBetweenTwoSurfaces()  # -> out, OutSurfaces; inputs srfA: Surface, srfB: Surface, radius: Double, tol: Double; disabled
# ---------- staticmethodcreatesurfacebetweentwosurfa: C# ----------
    //Declare an array of surfaces
    Surface[] surfaces = {};

    //Check for a valid input
    if (srfA != null && srfB != null) {
      //Create fillet surfaces
      surfaces = Surface.CreateRollingBallFillet(srfA, srfB, radius, tol);
    }

    //Output
    OutSurfaces = surfaces;
# ---------- end staticmethodcreatesurfacebetweentwosurfa ----------
methodffsetsurfaces = MethodffSetSurfaces()  # -> out, OutSrf; inputs srf: Surface, num: Int32, dis: Double, tol: Double; disabled
# ---------- methodffsetsurfaces: C# ----------
    //Declare the list of curve
    List<Surface> srfs = new List<Surface>();

    //The surface to offset
    Surface last_srf = srf;

    //Create offset curves
    for (int i = 1; i <= num; i++) {
      //offset
      Surface offset_srf = last_srf.Offset(dis, tol);

      //Ignore if output is multiple offset curves
      if (srf.IsValid) {
        //append offset curve to array
        srfs.Add(offset_srf);

        //update the next curve to offset
        last_srf = offset_srf;
      } else {
        break;
      }
    }

    //Assign output
    OutSrf = srfs;
# ---------- end methodffsetsurfaces ----------
methodeveluatesurface = MethodEveluateSurface()  # -> out, EvalPt, TanU, TanV; inputs srf: Surface, u: Double, v: Double; disabled
# ---------- methodeveluatesurface: C# ----------
    //Declare and intentiate the evaluation point and derivative vectors
    Point3d point = new Point3d(Point3d.Unset);
    Vector3d[] derivatives = {};

    //Evaluate the surface and extract only the first derivative to get u & v tangents
    srf.Evaluate(u, v, 1, out point, out derivatives);


    EvalPt = point;
    TanU = derivatives[0];
    TanV = derivatives[1];
# ---------- end methodeveluatesurface ----------
methodtrygetconefromrevolvedsurface = MethodTryGetConeFromRevolvedSurface()  # -> out, RevSrf, ConeSrf; disabled
# ---------- methodtrygetconefromrevolvedsurface: C# ----------
    //Declare and instantiate an axis and a curve
    Line axis = new Line (Point3d.Origin, new Point3d(0, 0, 10));
    LineCurve crv = new LineCurve(new Point3d(2, 0, 0), new Point3d(3.5, 0, 5));

    //Create surface of revolution
    RevSurface revSrf = RevSurface.Create(crv, axis);
    RevSrf = revSrf;

    //Try to get a Cone
    Cone cone;
    if( revSrf.TryGetCone(out cone))
      ConeSrf = cone;
# ---------- end methodtrygetconefromrevolvedsurface ----------
calculateoutlineofmesh = CalculateOutlineOfMesh()  # -> out, MeshOutline; inputs mesh: Mesh; disabled
# ---------- calculateoutlineofmesh: C# ----------
    // Get the mesh's topology
    Rhino.Geometry.Collections.MeshTopologyEdgeList mesh_edges = mesh.TopologyEdges;
    List<Line> lines = new List<Line>();

    // Find all of the mesh edges that have only a single mesh face
    for (int i = 0; i <= mesh_edges.Count - 1; i++) {
      int num_of_faces = mesh_edges.GetConnectedFaces(i).Length;

      if ((num_of_faces == 1)) {
        Line line = mesh_edges.EdgeLine(i);
        lines.Add(line);
      }
    }

    //Assign output
    MeshOutline = lines;
# ---------- end calculateoutlineofmesh ----------
changeverticieslocationsrandomly1 = ChangeVerticiesLocationsRandomly1()  # -> out, OutMesh; inputs mesh: Mesh, amp: Int32; disabled
# ---------- changeverticieslocationsrandomly1: C# ----------
    //Change mesh vertex location
    int index = 0;
    Random rand = new Random();
    foreach (Point3f loc in mesh.Vertices) {
      Point3f new_loc = loc;
      new_loc.Z = rand.Next(amp) / 3;
      mesh.Vertices[index] = new_loc;
      index = index + 1;
    }

    //Assign output
    OutMesh = mesh;
# ---------- end changeverticieslocationsrandomly1 ----------
deletesfacesandsplitsdisjointed = DeletesFacesAndSplitsDisjointed()  # -> out, OutMesh; inputs mesh: Mesh; disabled
# ---------- deletesfacesandsplitsdisjointed: C# ----------
    List<int> face_indeces = new List<int>();

    //Loop through faces and delete every other face
    for (int i = 0; i <= mesh.Faces.Count - 1; i += 2) {
      face_indeces.Add(i);
    }

    //delete faces
    mesh.Faces.DeleteFaces(face_indeces);

    Mesh[] mesh_array = mesh.SplitDisjointPieces();

    //Assign output
    OutMesh = mesh_array;
# ---------- end deletesfacesandsplitsdisjointed ----------
changeverticieslocationsrandomly2 = ChangeVerticiesLocationsRandomly2()  # -> out, OutMesh; inputs mesh: Mesh, amp: Int32; disabled
# ---------- changeverticieslocationsrandomly2: C# ----------
    //Create a new instance of random generator
    Random rand = new Random();

    for (int i = 0; i <= mesh.Vertices.Count - 1; i++)
    {
      //Get vertex
      Point3f loc = mesh.Vertices[i];
      loc.Z = rand.Next(amp) / 3;

      //Assign new location
      mesh.Vertices.SetVertex(i, loc);
    }

    //Assign output
    OutMesh = mesh;
# ---------- end changeverticieslocationsrandomly2 ----------
createmeshfromscratch = CreateMeshFromScratch()  # -> out, OutMesh; disabled
# ---------- createmeshfromscratch: C# ----------
    //Create simple rectangular mesh
    //Create a new instance of a mesh
    Rhino.Geometry.Mesh mesh = new Rhino.Geometry.Mesh();

    //Add mesh vertices
    mesh.Vertices.Add(0.0, 0.0, 0.0);//0
    mesh.Vertices.Add(5.0, 0.0, 0.0);//1
    mesh.Vertices.Add(5.0, 5.0, 0.0);//2
    mesh.Vertices.Add(0.0, 5.0, 0.0);//3

    //Add mesh faces
    mesh.Faces.AddFace(0, 1, 2, 3);

    //Compute mesh normals
    mesh.Normals.ComputeNormals();

    //Generate any additional mesh data
    mesh.Compact();

    //Assign output
    OutMesh = mesh;
# ---------- end createmeshfromscratch ----------
createmeshfrom2triangularfaces = CreateMeshFrom2TriangularFaces()  # -> out, OutMesh; disabled
# ---------- createmeshfrom2triangularfaces: C# ----------
    //Create simple triangular mesh
    //Create a new instance of a mesh
    Rhino.Geometry.Mesh mesh = new Rhino.Geometry.Mesh();

    //Add mesh vertices
    mesh.Vertices.Add(0.0, 0.0, 0.0);//0
    mesh.Vertices.Add(5.0, 0.0, 2.0);//1
    mesh.Vertices.Add(5.0, 5.0, 0.0);//2
    mesh.Vertices.Add(0.0, 5.0, 2.0);//3

    //Add mesh faces
    mesh.Faces.AddFace(0, 1, 2);
    mesh.Faces.AddFace(0, 2, 3);

    //Compute mesh normals
    mesh.Normals.ComputeNormals();

    //Generate any additional mesh data
    mesh.Compact();

    //Assign output
    OutMesh = mesh;
# ---------- end createmeshfrom2triangularfaces ----------
navigatingtopologyofbrep = NavigatingTopologyOfBrep()  # -> out, Faces, FaceSurfaces, Loops2DCurves, Loops3DCurves, Edges, Trims2DCurves, Vertices; inputs brep: Brep; disabled
# ---------- navigatingtopologyofbrep: C# ----------
    Rhino.Geometry.Collections.BrepFaceList faces = brep.Faces;
    List<Rhino.Geometry.Surface> surfaces = new List<Rhino.Geometry.Surface>();
    for(int fi = 0; fi < faces.Count; fi++)
    {
      BrepFace face = faces[fi];
      //Get Adjacent faces
      var aFaces = face.AdjacentFaces();
      //Get Adjacent edges
      var aEdges = face.AdjacentEdges();
      //Get face loops
      var faceLoops = face.Loops;
      //Get the 3D untrimmed surface
      var face3dSurface = face.UnderlyingSurface();
      surfaces.Add(face3dSurface);
    }
    Faces = faces;
    FaceSurfaces = surfaces;

    //BrepLoop topology (2D parameter space)
    Rhino.Geometry.Collections.BrepLoopList loops = brep.Loops;
    List<Rhino.Geometry.Curve> loops2DCrvs = new List<Rhino.Geometry.Curve>();
    List<Rhino.Geometry.Curve> loops3DCrvs = new List<Rhino.Geometry.Curve>();
    for(int li = 0; li < loops.Count; li++)
    {
      BrepLoop loop = loops[li];
      //Get loop face
      var loopFace = loop.Face;
      //Get loop trims
      var loopTrims = loop.Trims;
      //Get loop 2D and 3D curves
      var loop2dCurve = loop.To2dCurve();
      var loop3dCurve = loop.To3dCurve();
      loops2DCrvs.Add(loop2dCurve);
      loops3DCrvs.Add(loop3dCurve);
    }
    Loops2DCurves = loops2DCrvs;
    Loops3DCurves = loops3DCrvs;

    //BrepEdge topology (3D modeling space)
    Rhino.Geometry.Collections.BrepEdgeList edges = brep.Edges;
    for(int ei = 0; ei < edges.Count; ei++)
    {
      BrepEdge edge = edges[ei];
      //Get edge faces
      var eFaces_i = edge.AdjacentFaces();
      //Get edge start and end vertices
      var eStartVertex = edge.StartVertex;
      var eEndVertex = edge.EndVertex;
      //Get edge trim indices
      var eTrimIndeces = edge.TrimIndices();
      //Get edge 3D curve
      var e3dCurve = edge.EdgeCurve;
    }
    Edges = edges;

    //BrepTrim topology (2D parameter space)
    Rhino.Geometry.Collections.BrepTrimList trims = brep.Trims;
    for(int ti = 0; ti < trims.Count; ti++)
    {
      BrepTrim trim = trims[ti];
      //Get the edge
      var trimEdge = trim.Edge;
      //Get trim start and end vertices
      var trimStartVertex = trim.StartVertex;
      var trimEndVertex = trim.EndVertex;
      //Get trim loop
      var trimLoop = trim.Loop;
      //Get trim face
      var trimFace = trim.Face;
      //Get trim 2D curve
      var trim2dCurve = trim.TrimCurve;
    }
    Trims2DCurves = trims;

    //BrepVertex topology (3D modeling space)
    Rhino.Geometry.Collections.BrepVertexList vertices = brep.Vertices;
    for(int vi = 0; vi < vertices.Count; vi++)
    {
      BrepVertex vertex = vertices[vi];
      //Get vertex edges
      var vEdges = vertex.EdgeIndices();
      //Get vertex location
      var vPoint = vertex.Location;
    }
    Vertices = vertices;
# ---------- end navigatingtopologyofbrep ----------
calculateareavolumecentroid = CalculateAreaVolumeCentroid()  # -> out, Area, Vol, Centroid; inputs brep: Brep; disabled
# ---------- calculateareavolumecentroid: C# ----------
    //Declare variable
    double volume = 0;
    double area = 0;
    Point3d vc = default(Point3d);

    //Create a new instance of the mass properties classes
    VolumeMassProperties volume_mass = VolumeMassProperties.Compute(brep);
    AreaMassProperties area_mass = AreaMassProperties.Compute(brep);

    //Calculate area, volume and centroid
    area = brep.GetArea();
    //or: area = area_mass.Area
    volume = brep.GetVolume();
    //or: volume = volume_mass.Volume
    vc = volume_mass.Centroid;


    //Print
    Print(string.Format("Area = {0:F2}", area));
    Print(string.Format("Volume = {0:F2}", volume));
    Print(string.Format("Volume centroid = ({0:F2},{1:F2},{2:F2})", vc.X, vc.Y, vc.Z));

    //Assign output
    Area = area;
    Vol = volume;
    Centroid = vc;
# ---------- end calculateareavolumecentroid ----------
extractoutlineandignorholes = ExtractOutlineAndIgnorHoles()  # -> out, Outline; inputs brep: Brep; disabled
# ---------- extractoutlineandignorholes: C# ----------
    //declare outline list of curves
    List<Curve> outlineCrvs = new List<Curve>();

    //check all the loops

    foreach (BrepLoop e_loop in brep.Loops) {
      //Make sure the loop type is outer

      if (e_loop.LoopType == BrepLoopType.Outer) {
        //Navigate through the trims of the loop

        foreach (BrepTrim trim in e_loop.Trims) {
          //Get the edge of each trim
          BrepEdge edge = trim.Edge;

          //Check if the edge has only one trim

          if (edge.TrimCount == 1) {
            //Add a copy of the edge curve to the list
            outlineCrvs.Add(edge.DuplicateCurve());
          }
        }
      }
    }

    //Assign output
    Outline = outlineCrvs;
# ---------- end extractoutlineandignorholes ----------
movefacesawayfromcenter = MoveFacesAwayFromCenter()  # -> out, A; inputs brep: Brep; disabled
# ---------- movefacesawayfromcenter: C# ----------
    //Declare a new ist of faces
    List<Brep> faces = new List<Brep>();

    //Find the center
    Point3d center = brep.GetBoundingBox(true).Center;

    //Check all the faces
    for (int i = 0; i <= brep.Faces.Count - 1; i++) {
      //extract the faces
      int[] i_list = { i };
      Brep face = brep.DuplicateSubBrep(i_list);

      //Find face center
      Point3d face_center = face.GetBoundingBox(true).Center;

      //Find moving direction
      Vector3d dir = new Vector3d();
      dir = face_center - center;

      //move the face
      face.Translate(dir);

      //Add to the list
      faces.Add(face);
    }

    //Assign output
    A = faces;
# ---------- end movefacesawayfromcenter ----------
projectlistofcurvesontoplane = ProjectListOfCurvesOntoPlane()  # -> out, ProjectedGeom; inputs geomList: list of GeometryBase; disabled
# ---------- projectlistofcurvesontoplane: C# ----------
    //Create a new list of geometry objects
    List<GeometryBase> projList = new List<GeometryBase>();

    foreach (GeometryBase geom in geomList) {
      //Create a project transform
      geom.Transform(Transform.PlanarProjection(Plane.WorldXY));

      //add to list
      projList.Add(geom);
    }

    //Assign output
    ProjectedGeom = projList;
# ---------- end projectlistofcurvesontoplane ----------

classcreatenewnurbscurve = ClassCreateNewNURBSCurve()  # -> out, InterpolateCrv, NurbsCrv; inputs points: list of Point3d, degree: Int32; disabled
# ---------- classcreatenewnurbscurve: C# ----------
    //Declare a curve variable
    Rhino.Geometry.Curve interCrv = default(Rhino.Geometry.Curve);
    //Create new instance of a curve from interpolate points
    interCrv = Rhino.Geometry.Curve.CreateInterpolatedCurve(points, degree);

    //Declare a curve variable
    Rhino.Geometry.Curve nurbsCrv = default(Rhino.Geometry.Curve);
    //Create new instance of a curve from control points
    nurbsCrv = Rhino.Geometry.Curve.CreateControlPointCurve(points, degree);


    Rhino.Geometry.Curve crv = Curve.CreateControlPointCurve(points, degree);
    Rhino.Geometry.NurbsCurve nc = crv as Rhino.Geometry.NurbsCurve;

    //Assign output
    InterpolateCrv = interCrv;
    NurbsCrv = nurbsCrv;
# ---------- end classcreatenewnurbscurve ----------
getpointcoordinates_2 = GetPointCoordinates()  # -> out, A, B, C; inputs pt: Point3d; disabled; same code as getpointcoordinates
methodpointdistance = MethodPointDistance()  # -> out, Point, Distance; inputs x: Double, y: Double, z: Double, other: Point3d; disabled
# ---------- methodpointdistance: C# ----------
    //Create an instance of a point and initialize to x, y and z
    Point3d pt = new Point3d(x, y, z);

    //Declare a distance variable and initialize to "0"
    double dis = 0;

    //Calculate the distance from "pt" to the "other" input point
    dis = pt.DistanceTo(other);

    //Assign the point "pt" to the A output
    Point = pt;

    //Assign the distance to the B output
    Distance = dis;
# ---------- end methodpointdistance ----------
methodtestpointsforcoplanar = MethodTestPointsForCoPlanar()  # -> out, IsCoplanar; inputs pts: list of Point3d, tol: Double; disabled
# ---------- methodtestpointsforcoplanar: C# ----------
    //Test if the list of input points are co-planar
    bool coplanar = Point3d.ArePointsCoplanar(pts, tol);

    //Assign the co-planar test to output
    IsCoplanar = coplanar;
# ---------- end methodtestpointsforcoplanar ----------
methodpointtransformx = MethodPointTransformX()  # -> out, Point; inputs pt: Point3d, xform: Transform; disabled
# ---------- methodpointtransformx: C# ----------
    //Create an instance of a point and initialize to input point
    Point3d newPt = new Point3d(pt);

    //Transform the point
    newPt.Transform(xform);

    //Assign the point "new_pt" to the A output
    Point = newPt;
# ---------- end methodpointtransformx ----------
operatorsvectors = OperatorsVectors()  # -> out, Pt0, Pt1, Vec0, Vec1, AddVec, SubtractVec, DotVec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; disabled
# ---------- operatorsvectors: C# ----------
    //Create a New instance Of a point And a vector:
    Point3d p0 = new Point3d(3, 6, 0);
    Vector3d v0 = new Vector3d(4, 1.5, 0);
    double factor = 0.5;

    //Move a point by a vector:
    Point3d p1 = new Point3d(Point3d.Unset);
    p1 = p0 + v0;

    //Distance between 2 points:
    double distance = 0;
    distance = p0.DistanceTo(p1);

    //Point subtraction(create vector between two points):
    Vector3d v1 = new Vector3d(Vector3d.Unset);
    v1 = Point3d.Origin - p0;

    //Vector addition (create average vector):
    Vector3d addVectors = new Vector3d(Vector3d.Unset);
    addVectors = v0 + v1;

    //Vector subtraction:
    Vector3d subVectors = new Vector3d(Vector3d.Unset);
    subVectors = v0 - v1;

    //Vector dot product (if result Is positive number then vectors are In the same direction):
    double dot = 0;
    dot = v0 * v1;

    //Vector cross product (result is a vector normal to the 2 input vectors)
    Vector3d corss = new Vector3d(Vector3d.Unset);
    corss = Vector3d.CrossProduct(v0, v1);

    //Scale a vector:
    Vector3d scaleV0 = new Vector3d(Vector3d.Unset);
    scaleV0 = factor * v0;

    //Get vector length:
    double v0Length = v0.Length;

    //Assign output
    Pt0 = p0;
    Pt1 = p1;
    Vec0 = v0;
    Vec1 = v1;
    AddVec = addVectors;
    SubtractVec = subVectors;
    DotVec = dot;
    CrossVec = corss;
    ScaleVec0 = scaleV0;
    LengthVec0 = v0Length;
# ---------- end operatorsvectors ----------
operatoraddtwopoints = OperatorAddTwoPoints()  # -> out, Point; inputs pt1: Point3d, pt2: Point3d; disabled
# ---------- operatoraddtwopoints: C# ----------
    //Add 2 points and assign result to output
    Point = pt1 + pt2;
# ---------- end operatoraddtwopoints ----------
createpointintializexyz_3 = CreatePointIntializeXYZ()  # -> out, Point; inputs x: Double, y: Double, z: Double; disabled; same code as createpointintializexyz
structpointpassedbyvalue = StructPointPassedByValue()  # -> out, Point; inputs x: Double, y: Double, z: Double; disabled
# ---------- structpointpassedbyvalue: C# ----------
    Point3d pt = new Point3d(x, y, z);
    Print("pt.X before ChaneX: " + pt.X);

    //Call a function to change the value of X in the point
    ChangeX(pt);

    Print("pt.X after ChaneX: x=" + pt.X);

    Point = pt;
# ---------- structpointpassedbyvalue: C# additional code ----------
  public void ChangeX(Point3d pt)
  {
    pt.X = 100;
    Print("pt.X inside ChaneX: x=" + pt.X);
  }
# ---------- end structpointpassedbyvalue ----------
classcreatelinecurvefrompts_2 = ClassCreateLineCurveFromPts()  # -> out, OutLine; inputs p0: Point3d, p1: Point3d; disabled; same code as classcreatelinecurvefrompts
getoriginpoint_2 = GetOriginPoint()  # -> out, Origin; disabled; same code as getoriginpoint
methodsetgetdataforclassandstructpropert = MethodSetGetDataForClassAndStructProperties()  # -> out, A; inputs x: Double; disabled
# ---------- methodsetgetdataforclassandstructpropert: C# ----------
    //Create an instance of a point object and initialize to origin (0,0,0)
      Point3d pt = new Point3d(0, 0, 0);

      //Get coordinates and print to "output"
      Print("X = " + pt.X);

      //Set the x coordinate to a new value from input
      pt.X = x;

      //Print the new x value
      Print("X = " + pt.X);

      //Get the pt "x" value and assign to output
      A = pt.X;
# ---------- end methodsetgetdataforclassandstructpropert ----------
classcreatepolylinefrompoints = ClassCreatePolylineFromPoints()  # -> out, Crv, Type; inputs pts: list of Point3d; disabled
# ---------- classcreatepolylinefrompoints: C# ----------
    //Declare and create a new instance of a polyline curve from points
    var crv = new Rhino.Geometry.PolylineCurve(pts);

    //Assign curve to A output
    Crv = crv;

    //Assign curve type to B output
    Type = crv.GetType();
# ---------- end classcreatepolylinefrompoints ----------
methodcopythreepointsduplicatecurve = MethodCopyThreePointsDuplicateCurve()  # -> out, newCrv, A, B, C; inputs pt: Point3d, crv: Curve; disabled
# ---------- methodcopythreepointsduplicatecurve: C# ----------
    //Different ways to copy data between objects
    //Use the constructor when you instantiate an instance Of the Point3d class
    Point3d newPt1 = new Point3d(pt);
    Print("new pt1 = " + newPt1.ToString());
    A = newPt1;

    //Use the “= Operator” If the Class provides one
    Point3d newPt2 = new Point3d(Point3d.Unset);
    newPt2 = pt;
    Print("new pt2 = " + newPt2.ToString());
    B = newPt2;

    //Copy the properties one by one
    Point3d newPt3 = new Point3d(Point3d.Unset);
    newPt3.X = pt.X;
    newPt3.Y = pt.Y;
    newPt3.Z = pt.Z;
    Print("new pt3 = " + newPt3.ToString());
    C = newPt3;

    //Some geometry  classes provide “Duplicate” method that Is very efficient to use
    newCrv = crv.DuplicateCurve();
# ---------- end methodcopythreepointsduplicatecurve ----------
navigatepointclassmembersautocomplete = NavigatePointClassMembersAutoComplete()  # -> out; disabled
# ---------- navigatepointclassmembersautocomplete: C# ----------
    //Create an instance of a point object and initialize to origin (0,0,0)
    Rhino.Geometry.Point3d pt = new Rhino.Geometry.Point3d(0, 0, 0);

    //type "pt." to navigate Point3d members
    //pt.
# ---------- end navigatepointclassmembersautocomplete ----------
constructorcreatearc = ConstructorCreateArc()  # -> out, OutArc; inputs p0: Point3d, p1: Point3d, p2: Point3d; disabled
# ---------- constructorcreatearc: C# ----------
    //Create an instance of an Arc
    Arc arc = new Arc(p0, p1, p2);

    //check if arc is valid
    if (arc.IsValid) {
      //Assign arc to output
      OutArc = arc;
    }
# ---------- end constructorcreatearc ----------
constructorcreatelinecurvefromlineanddom = ConstructorCreateLineCurveFromLineAndDomain()  # -> out, OutLine; inputs line: Line, a: Double, b: Double; disabled
# ---------- constructorcreatelinecurvefromlineanddom: C# ----------
    //Create an instance of a point object and unset
    LineCurve lineCurve = new Rhino.Geometry.LineCurve(line, a, b);
    Print(lineCurve.ToString());

    //assign output
    OutLine = lineCurve;
# ---------- end constructorcreatelinecurvefromlineanddom ----------
# WARSAW
# UNIVERSITY OF TECHNOLOGY
constructorcreatecirclefromclass = ConstructorCreateCircleFromClass()  # -> out, OutCircle; inputs c: Point3d, r: Double; disabled
# ---------- constructorcreatecirclefromclass: C# ----------
    //Create an instance of a circle
    Circle cir = new Circle(c, r);

    OutCircle = cir;
# ---------- end constructorcreatecirclefromclass ----------
setpointcoordinatesunset = SetPointCoordinatesUnset()  # -> out, Point; inputs x: Double, y: Double, z: Double; disabled
# ---------- setpointcoordinatesunset: C# ----------
    //Declare a new point
    Point3d new_pt = new Point3d(Point3d.Unset);

    //Set "new_pt" coordinates
    new_pt.X = x;
    new_pt.Y = y;
    new_pt.Z = z;

    //Assign the point coordinates to output
    Point = new_pt;
# ---------- end setpointcoordinatesunset ----------
constructorcreatepolylinecurvefromclass = ConstructorCreatePolylineCurveFromClass()  # -> out, OutPolyline; inputs points: list of Point3d; disabled
# ---------- constructorcreatepolylinecurvefromclass: C# ----------
    //Create a new instance of a polyline
    Polyline pline = new Polyline(points);

    OutPolyline = pline;
# ---------- end constructorcreatepolylinecurvefromclass ----------
methodcreatecurveoffset = MethodCreateCurveOffset()  # -> out, OffsetCrv; inputs crv: Curve, offset: Double; disabled
# ---------- methodcreatecurveoffset: C# ----------
    Curve[] curves = crv.Offset(Plane.WorldXY, offset, 0.01, CurveOffsetCornerStyle.None);
    OffsetCrv = curves;
# ---------- end methodcreatecurveoffset ----------
constructorconvertlinecurvetonurbscurve = ConstructorConvertLineCurveToNURBSCurve()  # -> out, OutLineCurve, OutNurbsCurve, Pt0, Pt1; inputs x: Int32, y: Int32, z: Int32, u: Int32, v: Int32, w: Int32; disabled
# ---------- constructorconvertlinecurvetonurbscurve: C# ----------
    //Create an instance of a line curve
    Point3d p0 = new Point3d(x, y, z);
    Point3d p1 = new Point3d(u, v, w);

    LineCurve line_crv = new LineCurve(p0, p1);
    OutLineCurve = line_crv;

    //convert LineCurve to a NurbsCurve
    NurbsCurve nc = line_crv.ToNurbsCurve();
    OutNurbsCurve = nc;

    Pt0 = p0;
    Pt1 = p1;
# ---------- end constructorconvertlinecurvetonurbscurve ----------
number_slider_16 = Slider(0.56, range=0..2)  # disabled
number_slider_17 = Slider(0.34, range=0..1)  # disabled
classstaticmethodcreatecurvefromarc = ClassStaticMethodCreateCurveFromArc()  # -> out, OutLine; disabled
# ---------- classstaticmethodcreatecurvefromarc: C# ----------
    //Create an instance of a point object and unset
    Rhino.Geometry.NurbsCurve nc = NurbsCurve.CreateFromArc(arc);
    Print(nc.ToString());
    //assign output
    OutLine = nc;
# ---------- end classstaticmethodcreatecurvefromarc ----------
constructorcreatelinefromlinecurveclass = ConstructorCreateLineFromLineCurveClass()  # -> out, OutLine; disabled
# ---------- constructorcreatelinefromlinecurveclass: C# ----------
    //Create an instance of a point object and unset
    LineCurve lineCurve = new Rhino.Geometry.LineCurve();
    Print(lineCurve.ToString());

    //assign output
    OutLine = lineCurve;
# ---------- end constructorcreatelinefromlinecurveclass ----------
methodcreateopenclosedperiodiccurvefromc_4 = MethodCreateOpenClosedPeriodicCurveFromControlPoints()  # -> out, OutCurve; inputs cPoints: list of Point3d, degree: Int32, periodic: Boolean; disabled; same code as methodcreateopenclosedperiodiccurvefromc
methodcreatesphere = MethodCreateSphere()  # -> out, OutSphere; disabled
# ---------- methodcreatesphere: C# ----------
    Point3d center = Point3d.Origin;
    double radius = 7.5;

    Sphere sp = new Sphere(center, radius);

    OutSphere = sp;
# ---------- end methodcreatesphere ----------
methodcreatecylinder = MethodCreateCylinder()  # -> out, OutCylinder; disabled
# ---------- methodcreatecylinder: C# ----------
    double height = 7.5;
    double radius = 2.5;
    Point3d center = Point3d.Origin;
    Circle base_circle = new Circle(center, radius);

    Cylinder cy = new Cylinder(base_circle, height);

    OutCylinder = cy;
# ---------- end methodcreatecylinder ----------
methodcreatetorus = MethodCreateTorus()  # -> out, OutTorus; disabled
# ---------- methodcreatetorus: C# ----------
    double minorRadius = 2.5;
    double majorRadius = 7.5;

    Torus to = new Torus(Plane.WorldXY, majorRadius, minorRadius);

    OutTorus = to;
# ---------- end methodcreatetorus ----------
methodcreatecone = MethodCreateCone()  # -> out, OutCone; disabled
# ---------- methodcreatecone: C# ----------
    double height = 7.5;
    double radius = 7.5;

    Cone co = new Cone(Plane.WorldXY, height, radius);

    OutCone = co;
# ---------- end methodcreatecone ----------
staticmethodcreatecurvefromtwocurves = StaticMethodCreateCurveFromTwoCurves()  # -> out, OutLine; inputs crv1: Curve, crv2: Curve; disabled
# ---------- staticmethodcreatecurvefromtwocurves: C# ----------
    //Create an instance of a point object and unset
    Rhino.Geometry.Curve crv= Curve.CreateMeanCurve(crv1, crv2);
    Print(crv.ToString());
    //assign output
    OutLine = crv;
# ---------- end staticmethodcreatecurvefromtwocurves ----------
constructorcreatearcusingnewkeyword = ConstructorCreateArcUsingNewKeyword()  # -> out, OutArcCurve, OutNurbsCurve, Pt0, Pt1, Pt2; inputs x: Int32, y: Int32, z: Int32, u: Int32, v: Int32, w: Int32, xx: Int32, xy: Int32, xz: Int32; disabled
# ---------- constructorcreatearcusingnewkeyword: C# ----------
    var p0 = new Point3d(x, y, z);
    var p1 = new Point3d(u, v, w);
    var p2 = new Point3d(xx, xy, xz);

    //Create an instance of an Arc
    Arc arc = new Arc(p0, p1, p2);

    //Create a new instance of ArcCurve
    ArcCurve arcCurve = new ArcCurve(arc);
    OutArcCurve = arcCurve;

    //convert ArcCurve to a NurbsCurve
    var nc = arcCurve.ToNurbsCurve();
    OutNurbsCurve = nc;

    Pt0 = p0;
    Pt1 = p1;
    Pt2 = p2;
# ---------- end constructorcreatearcusingnewkeyword ----------
constructorcreatepolylinecurvefrompoints = ConstructorCreatePolylineCurveFromPoints()  # -> out, OutPlineCurve, Points; inputs x: Double, y: Double, z: Double, u: Double, v: Double, w: Double, xx: Double, xy: Double, xz: Double; disabled
# ---------- constructorcreatepolylinecurvefrompoints: C# ----------
    var p0 = new Point3d(x, y, z);
    var p1 = new Point3d(u, v, w);
    var p2 = new Point3d(xx, xy, xz);
    Point3d[] pointList = {p0, p1, p2};

    //Create a new instance of ArcCurve
    PolylineCurve plineCurve = new PolylineCurve(pointList);

    //Check if the curve is valid then assign curve to the output value A
    if (plineCurve != null)
      OutPlineCurve = plineCurve;

    Points = pointList;
# ---------- end constructorcreatepolylinecurvefrompoints ----------
constructorcreatelinecurvefromline = ConstructorCreateLineCurveFromLine()  # -> out, OutLine; inputs line: Line; disabled
# ---------- constructorcreatelinecurvefromline: C# ----------
    //Create an instance of a point object and unset
    LineCurve lineCurve = new Rhino.Geometry.LineCurve(line);
    Print(lineCurve.ToString());

    //assign output
    OutLine = lineCurve;
# ---------- end constructorcreatelinecurvefromline ----------
methodcreatenurbscrvfromcontrolpoints = MethodCreateNURBSCrvFromControlPoints()  # -> out, OutCurve; inputs points: list of Point3d, degree: Int32; disabled
# ---------- methodcreatenurbscrvfromcontrolpoints: C# ----------
    //Declare a variable of type Curve
    Curve nc = default(Curve);

    //Create an instance of a Nurbs Curve using input points as control points
    // and input degree
    //nc = Rhino.Geometry.Curve.CreateControlPointCurve(points, degree);

    //Assign curve to the output value A
    OutCurve = nc;
# ---------- end methodcreatenurbscrvfromcontrolpoints ----------
structcreateclyindersphereatendpoints = StructCreateClyinderSphereAtEndPoints()  # -> out, C, S1, SC1; inputs line1: Line, line2: Line, divHeight: Double, parameter: Double; disabled
# ---------- structcreateclyindersphereatendpoints: C# ----------
    //Create a cyliner at line1 with radius = divHeight the length
    double height = line1.Length;
    double radius = height / divHeight;
    Circle c_circle = new Circle(line1.From, radius);
    Cylinder cylinder = new Cylinder(c_circle, height);

    //Create a sphere at the center of lines with radius = divHeight the length
    Point3d s_center1 = line1.PointAt(parameter);
    Sphere sphere1 = new Sphere(s_center1, radius);

    //Assign output
    C = cylinder;
    S1 = sphere1;
    SC1 = s_center1;
# ---------- end structcreateclyindersphereatendpoints ----------
structcreattorus = StructCreatTorus()  # -> out, A; inputs plane: Plane, major_radius: Double, minor_radius: Double; disabled
# ---------- structcreattorus: C# ----------
    var torus = new Rhino.Geometry.Torus(plane, major_radius, minor_radius);
    if (torus.IsValid)
      A = torus.ToNurbsSurface();
# ---------- end structcreattorus ----------
structcreatecylinder = StructCreateCylinder()  # -> out, A; inputs radius: Double, height: Double, centerPt: Point3d; disabled
# ---------- structcreatecylinder: C# ----------
    Circle baseCircle = new Circle(centerPt, radius);
    Cylinder cy = new Cylinder(baseCircle, height);
    A = cy;
# ---------- end structcreatecylinder ----------
structcreatecone = StructCreateCone()  # -> out, A; inputs radius: Double, height: Double, centerPt: Point3d; disabled
# ---------- structcreatecone: C# ----------
    Cone cone = new Cone(Plane.WorldXY, height, radius);
    A = cone;
# ---------- end structcreatecone ----------
structcreatearc = StructCreateArc(circle=structcreatecirclerandom.A, range=number_slider_16)  # -> out, A; inputs range: Double; disabled
# ---------- structcreatearc: C# ----------
    //Create an arc from circle and interval
    Interval angleInterval = new Interval(range * Math.PI, Math.PI);
    Arc arc = new Arc(circle, angleInterval);

    A = arc;
# ---------- end structcreatearc ----------
structcreatevertlinesatendpoints = StructCreateVertLinesAtEndPoints(arc=structcreatearc.A)  # -> out, P1, P2, L1, L2; inputs len: Double; disabled
# ---------- structcreatevertlinesatendpoints: C# ----------
    //Extract end points
    Point3d start_pt = arc.StartPoint;
    Point3d end_pt = arc.EndPoint;

    //Create a vertical vector with length = 10
    Vector3d vec = Vector3d.ZAxis;
    //Use the multiplication operation to scale the vector
    vec = vec * 10;

    //Create start and end lines
    Line line_1 = new Line(start_pt, vec);
    Line line_2 = new Line(end_pt, vec);

    //Assign output
    P1 = start_pt;
    P2 = end_pt;
    L1 = line_1;
    L2 = line_2;
# ---------- end structcreatevertlinesatendpoints ----------
methodgetcurvetangentvectoratstartcurve = MethodGetCurveTangentVectorAtStartCurve()  # -> out, StartPoint, TangentVector; inputs crv: Curve; disabled
# ---------- methodgetcurvetangentvectoratstartcurve: C# ----------
    //Get the tangent at start
    Vector3d tangent = crv.TangentAtStart;

    //Get the start point
    Point3d pt = crv.PointAtStart;

    //Output
    StartPoint = pt;
    TangentVector = tangent;
# ---------- end methodgetcurvetangentvectoratstartcurve ----------
methodcreatecurvesbetweentwocurves = MethodCreateCurvesBetweenTwoCurves()  # -> out, Curves; inputs curve0: Curve, curve1: Curve, count: Int32; disabled
# ---------- methodcreatecurvesbetweentwocurves: C# ----------
    //Declare a variable of type Curve
    Curve[] tweenCrvs = null;

    //Create an array of tween curves from two input curves and number
    tweenCrvs = Rhino.Geometry.Curve.CreateTweenCurves(curve0, curve1, count, 0.01);

    //Assign curve to the output value A
    Curves = tweenCrvs;
# ---------- end methodcreatecurvesbetweentwocurves ----------
methodextractisocurvefromsurface = MethodExtractIsoCurveFromSurface()  # -> out, OutIsoCurve; inputs srf: Surface, p: Double; disabled
# ---------- methodextractisocurvefromsurface: C# ----------
    var isoCurve = srf.IsoCurve(0, p);
    OutIsoCurve = isoCurve;
# ---------- end methodextractisocurvefromsurface ----------
methodgetcurvedomain = MethodGetCurveDomain()  # -> out, CrvDomain; inputs crv: Curve; disabled
# ---------- methodgetcurvedomain: C# ----------
    //Get the domain or interval of the curve
    Interval domain = crv.Domain;

    //Output the domain
    CrvDomain = domain;
# ---------- end methodgetcurvedomain ----------
methoddividecurvebynumber = MethodDivideCurveByNumber()  # -> out, A; inputs crv: Curve, num: Int32; disabled
# ---------- methoddividecurvebynumber: C# ----------
    //Declare an array of points
    Point3d[] points = {};

    //Divide the curve by number
    crv.DivideByCount(num, true, out points);

    //Output
    A = points;
# ---------- end methoddividecurvebynumber ----------
methodgetcurveendpoints = MethodgetCurveEndPoints()  # -> out, A, B; inputs crv: Curve; disabled
# ---------- methodgetcurveendpoints: C# ----------
    //Get the start point
      Point3d start_pt = crv.PointAtStart;

      //Get the end point
      Point3d end_pt = crv.PointAtEnd;

      //Output
      A = start_pt;
      B = end_pt;
# ---------- end methodgetcurveendpoints ----------
constructorcreatelinecurveusingnewkeywor = ConstructorCreateLineCurveUsingNewKeyword()  # -> out, OutLineCurve, OutNurbsCurve, Pt0, Pt1; inputs x: Int32, y: Int32, z: Int32, u: Int32, v: Int32, w: Int32; disabled; same code as constructorconvertlinecurvetonurbscurve
createnurbssurfacefromcurveanddirection = CreateNurbsSurfaceFromCurveAndDirection()  # -> out, A, B; inputs crv: Curve, dir: Vector3d; disabled
# ---------- createnurbssurfacefromcurveanddirection: C# ----------
    //Create a nurbs surface from extruding a curve in some dir
    var nSrf = NurbsSurface.CreateExtrusion(crv, dir);
    //Output the Nurbs Surface
    A = nSrf;

    //Create an extrusion from extruding a curve in some dir
    var ex = Extrusion.Create(crv, 10, false);
    //Grasshopper outputs the Extrusion as a Nurbs Surface
    B = ex;


    //Note that in Grasshopper 1.0 there is not explicit support to extrusion surfaces
    //  and hence the output is converted to a nurbs surface.
    //  the only way to bake an Extrusion instance is to add the object to the active
    //  document from within the scripting component as in the following:
    //  (uncomment the following line to add the extrusion object directly to Rhino)
    //Rhino.RhinoDoc.ActiveDoc.Objects.AddExtrusion(ex);
# ---------- end createnurbssurfacefromcurveanddirection ----------
createrevsurfacefromlineandcurve = CreateRevSurfaceFromLineAndCurve()  # -> out, RevolutionSurface; inputs revCrv: Curve, revAxis: Line; disabled
# ---------- createrevsurfacefromlineandcurve: C# ----------
    var revSrf = RevSurface.Create(revCrv, revAxis);

    RevolutionSurface = revSrf;
# ---------- end createrevsurfacefromlineandcurve ----------
methodcreatesurfacerevolution_2 = MethodCreateSurfaceRevolution()  # -> out, PlanarSurface; inputs revCrv: Curve, revAxis: Line; disabled; same code as methodcreatesurfacerevolution
methodcheckifsurfaceisclosedandplanar = MethodCheckIFSurfaceIsClosedAndPlanar()  # -> out, IsClosedU, IsClosedV, IsPlanar; inputs srf: Surface; disabled
# ---------- methodcheckifsurfaceisclosedandplanar: C# ----------
    //Check if the input surface is closed in the u or v direction
    IsClosedU = srf.IsClosed(0);
    IsClosedV = srf.IsClosed(1);

    //Check if the surface is planar at zero tolerance
    IsPlanar = srf.IsPlanar();
# ---------- end methodcheckifsurfaceisclosedandplanar ----------
methodcreatenurbssurfacefromcontroppoint = MethodCreateNurbsSurfaceFromContropPoints()  # -> out, PlanarSurface; inputs points: list of Point3d; disabled
# ---------- methodcreatenurbssurfacefromcontroppoint: C# ----------
    //Create nurbs surface from control points
    NurbsSurface ns = null;
    ns = NurbsSurface.CreateThroughPoints(points, 2, 2, 1, 1, false, false);

    PlanarSurface = ns;
# ---------- end methodcreatenurbssurfacefromcontroppoint ----------
constructorcreateplanarsurfacefromplanea = ConstructorCreatePlanarSurfaceFromPlaneAnd2Intervals()  # -> out, PlanarSurface; disabled
# ---------- constructorcreateplanarsurfacefromplanea: C# ----------
    var plane = Plane.WorldXY;
    var x_interval = new Interval(1.0, 3.5);
    var y_interval = new Interval(2.0, 6.0);

    var planeSrf = new PlaneSurface(plane, x_interval, y_interval);

    PlanarSurface = planeSrf;
# ---------- end constructorcreateplanarsurfacefromplanea ----------
createnurbssurfacefrompoints = CreateNurbsSurfaceFromPoints()  # -> A; inputs points: list of Point3d; disabled
# ---------- createnurbssurfacefrompoints: C# ----------
    //Create a surface from points
      NurbsSurface ns = default(NurbsSurface);
      ns = NurbsSurface.CreateThroughPoints(points, 2, 2, 1, 1, false, false);

      //Output
      A = ns;
# ---------- end createnurbssurfacefrompoints ----------
methodcreaenurbssurfacefromextrusioncurv = MethodCreaeNurbsSurfaceFromExtrusionCurve()  # -> out, PlanarSurface; inputs crv: Curve, dir: Vector3d; disabled
# ---------- methodcreaenurbssurfacefromextrusioncurv: C# ----------
//Create a nurbs surface from extruding a curve in some dir
    var nSrf = NurbsSurface.CreateExtrusion(crv, dir);
    //Create an extrusion from extruding a curve in some dir
    var ex = Extrusion.Create(crv, 10, false);
    //Note that in Grasshopper 1.0 there is no support to extrusion objects and hence the output within GH is converted to a nurbs surface. The only way to bake an Extrusion instance is to add the object to the active document from within the scripting component as in the following
    
    //Rhino.RhinoDoc.ActiveDoc.Objects.AddExtrusion(ex);

    PlanarSurface = nSrf;
# ---------- end methodcreaenurbssurfacefromextrusioncurv ----------
extractnakededges = ExtractNakedEdges()  # -> out, NakedEdges; inputs mesh: Mesh; disabled
# ---------- extractnakededges: C# ----------
    //Declare an array of polylines
    Polyline[] meshNakedEdges = {};

    //Create a new mesh from polyline
    meshNakedEdges = mesh.GetNakedEdges();

    //Output
    NakedEdges = meshNakedEdges;
# ---------- end extractnakededges ----------
deletevertexremovefaces = DeleteVertexRemoveFaces()  # -> out, OutMesh; inputs mesh: Mesh, i: Int32; disabled
# ---------- deletevertexremovefaces: C# ----------
    //Remove a mesh vertex (make sure index falls within range)
    if (i >= 0 & i < mesh.Vertices.Count)
    {
      mesh.Vertices.Remove(i, true);
    }

    //Assign output
    OutMesh = mesh;
# ---------- end deletevertexremovefaces ----------
createmeshusingclosedployline = CreateMeshUsingClosedPloyline()  # -> out, OutMesh; inputs pline: Polyline; disabled
# ---------- createmeshusingclosedployline: C# ----------
    //Create a new mesh from polyline
    var new_mesh = Mesh.CreateFromClosedPolyline(pline);

    //Output
    OutMesh = new_mesh;
# ---------- end createmeshusingclosedployline ----------
createmeshfrombrep = CreateMeshFromBrep()  # -> out, OutMesh; inputs brep: Brep; disabled
# ---------- createmeshfrombrep: C# ----------
    //Set mesh parameters to default
    MeshingParameters mp = MeshingParameters.Default;

    //Create meshes from brep
    var new_mesh = Mesh.CreateFromBrep(brep, mp);

    //Output
    OutMesh = new_mesh;
# ---------- end createmeshfrombrep ----------
testpointinsidemesh = TestPointInsideMesh()  # -> out, IsInside; inputs mesh: Mesh, pt: Point3d, tol: Double; disabled
# ---------- testpointinsidemesh: C# ----------
    //Test if a given point is inside a mesh
    IsInside = mesh.IsPointInside(pt, tol, true);
# ---------- end testpointinsidemesh ----------
booleanunion2breps = BooleanUnion2Breps()  # -> out, BooleanedBreps; inputs breps: list of Brep, tol: Double; disabled
# ---------- booleanunion2breps: C# ----------
    //Boolean union the input breps
    Brep[] unionBrep = Brep.CreateBooleanUnion(breps, tol);

    BooleanedBreps = unionBrep;
# ---------- end booleanunion2breps ----------
mergecoplanarfaces = MergeCoPlanarFaces()  # -> out, MergedBrep; inputs brep: Brep, tol: Double; disabled
# ---------- mergecoplanarfaces: C# ----------
    //merge all coplanar faces
    if( brep.MergeCoplanarFaces(tol) )
      MergedBrep = brep;
# ---------- end mergecoplanarfaces ----------
findboundingboxandcenter = FindBoundingBoxAndCenter()  # -> out, BBox, BBoxCenter; inputs brep: Brep; disabled
# ---------- findboundingboxandcenter: C# ----------
    //Declare variables
    BoundingBox bbox = new BoundingBox();
    Point3d center = default(Point3d);

    //Find the boundingbox
    bbox = brep.GetBoundingBox(true);

    //Find the center of the bounding box
    center = bbox.Center;

    //Assign output
    BBox = bbox;
    BBoxCenter = center;
# ---------- end findboundingboxandcenter ----------
createsolidbrep = CreateSolidBrep()  # -> out, SolidBrep; inputs breps: list of Brep, tol: Double; disabled
# ---------- createsolidbrep: C# ----------
    //Build the brep from corners
    Brep[] solids = Brep.CreateSolid(breps, tol);

    //Assign output
    SolidBrep = solids;
# ---------- end createsolidbrep ----------
countbreptopologyandextractgeometry = CountBrepTopologyAndExtractGeometry()  # -> out, Vertices, Curves, Surfaces; inputs brep: Brep; disabled
# ---------- countbreptopologyandextractgeometry: C# ----------
    //print the number of geometry elements
    Print("brep.Vertices.Count = {0}", brep.Vertices.Count);
    Print("brep.Curves3D.Count = {0}", brep.Curves3D.Count);
    //untrimmed curves of all edges
    Print("brep.Curves2D.Count = {0}", brep.Curves2D.Count);
    Print("brep.Surfaces.Count = {0}", brep.Surfaces.Count);
    //untrimed surface of all faces

    //print the number of topology elements
    Print("brep.Trims.Count = {0}", brep.Trims.Count);
    Print("brep.Loops.Count = {0}", brep.Loops.Count);
    Print("brep.Faces.Count = {0}", brep.Faces.Count);
    Print("brep.Edges.Count = {0}", brep.Edges.Count);

    //extract 3d geometry elements
    Vertices = brep.Vertices;
    Curves = brep.Curves3D;
    Surfaces = brep.Surfaces;
# ---------- end countbreptopologyandextractgeometry ----------
createbrepbox = CreateBrepBox()  # -> out, BrepBox; inputs corners: list of Point3d; disabled
# ---------- createbrepbox: C# ----------
    //Build the brep from corners
    Brep twistedBox = Brep.CreateFromBox(corners);

    BrepBox = twistedBox;
# ---------- end createbrepbox ----------
createbrepfromedges = CreateBrepFromEdges()  # -> out, EdgeBrep; inputs crvs: list of Curve; disabled
# ---------- createbrepfromedges: C# ----------
    //Build the brep from edges
    Brep brep = Brep.CreateEdgeSurface(crvs);

    //Assign output
    EdgeBrep = brep;
# ---------- end createbrepfromedges ----------
findifbrepsolid_oneatatime = FindIfBrepSolidOneAtATime()  # -> out, A; inputs brep: Brep; disabled
# ---------- findifbrepsolid_oneatatime: C# ----------
    //Assign output
    if(brep.IsValid)
      A = brep.IsSolid;
# ---------- end findifbrepsolid_oneatatime ----------
findifbrepissolid_aslist = FindIfBrepIsSolidAsList()  # -> out, A; inputs breps: list of Brep; disabled
# ---------- findifbrepissolid_aslist: C# ----------
    List<bool> isSolid = new List<bool>();
    foreach( Brep brep in breps)
      if( brep.IsValid )
        isSolid.Add(brep.IsSolid);

    A = isSolid;
# ---------- end findifbrepissolid_aslist ----------
transformscalerotatemove_5 = TransformScaleRotateMove()  # -> out, XformGeom; inputs objs: list of GeometryBase, factor: Double, angle: Double, dir: Vector3d; disabled; same code as transformscalerotatemove
transformationmatrixshear = TransformationMatrixShear()  # -> out, outBrep, Xform; inputs brep: Brep; disabled
# ---------- transformationmatrixshear: C# ----------
    //create a shear Transform
    Transform xform = Transform.Shear(Plane.WorldXY, new Vector3d(0.5, 0.5, 0), Vector3d.YAxis, Vector3d.ZAxis);

    //shear the brep
    brep.Transform(xform);

    //Assign output
    outBrep = brep;
    Xform = xform;
# ---------- end transformationmatrixshear ----------

n_03_classparticle = N_03_ClassParticle()  # -> out, currentPosition; inputs reset: Boolean, run: Boolean, particleLocation: Point3d, particleVelocity: Vector3d, acceleration: Double; disabled
# ---------- n_03_classparticle: C# ----------
    if(reset)
    {
      myParticle = new Particle(particleLocation, particleVelocity);
    }
    else if (run)
    {
      myParticle.Move();
      myParticle.Accelerate(acceleration);
    }
    currentPosition = myParticle.Location;
# ---------- n_03_classparticle: C# additional code ----------
  Particle myParticle = new Particle();

  class Particle
  {
    ///////   Constructors here     ////////
    public Particle()
    {
      Location = new Point3d(0, 0, 0);
      Velocity = new Vector3d(1, 0.5, 0);
    }

    public Particle(Point3d initLoc, Vector3d initVelo) : this()
    {
      Location = initLoc;
      Velocity = initVelo;
    }

    ///    End of constructors

    /// Properties:
    public Point3d Location {private set; get;}
    public Vector3d Velocity {private set; get;}

    // Methods:
    public void Move()
    {
      Location += Velocity;
    }

    public void Accelerate(double factor)
    {
      Velocity *= factor;
    }
  }
# ---------- end n_03_classparticle ----------
# Classes
n_01_classpoint2d = N_01_ClassPoint2D()  # -> out, A; inputs x: Double, y: Double; disabled
# ---------- n_01_classpoint2d: C# ----------
    Component.Message = "Point2d";
    Point2d myPoint = new Point2d();  //default constructor
    myPoint.X = x;
    myPoint.Y = y;

    Print("myPoint x: {0}, y: {1}", myPoint.X, myPoint.Y);
# ---------- n_01_classpoint2d: C# additional code ----------
  class Point2d
  {
    public double X;
    public double Y;
  }
# ---------- end n_01_classpoint2d ----------
n_05_staticmemberexample_1 = N_05_StaticMemberExample1()  # -> out, A; disabled
# ---------- n_05_staticmemberexample_1: C# ----------
    Cat myCat1 = new Cat();
    Cat myCat2 = new Cat();
    Cat myCat3 = new Cat();
    Cat myCat4 = new Cat();

    Print(Cat.Count.ToString());    // static members belong to a type(a class)
# ---------- n_05_staticmemberexample_1: C# additional code ----------
  class Cat
  {
    static Cat()  // no access modifiers!
    {
      Count = 0;
    }
    public Cat()
    {
      Count++;
    }

    public static int Count {private set; get;}
  }
# ---------- end n_05_staticmemberexample_1 ----------
n_08_genericlistprintingcopying = N_08_GenericListPrintingCopying()  # -> out, A; inputs count: Int32; disabled
# ---------- n_08_genericlistprintingcopying: C# ----------
    List < BiNumber > numbers = new List<BiNumber>();
    List < BiNumber > numbers2 = new List<BiNumber>();
    List < BiNumber > numbers3 = new List<BiNumber>();

    for(int i = 0; i < count; i++)
    {
      numbers.Add(new BiNumber(i, count - i));
    }

    foreach(BiNumber num in numbers)
      numbers2.Add(num);
    /*for(int i = 0; i < numbers.Count; i++)
    {
      numbers2.Add(numbers[i]);
      //numbers2[i] = numbers[i];
    }*/

    numbers3 = CopyList(numbers2);

    PrintList(numbers, "First list");
    PrintList(numbers2, "Second list");

    numbers2[0].a = 3.14;
    PrintList(numbers, "First list changed");
    PrintList(numbers2, "Second list changed");
    numbers3[0].b = -3.14;
    PrintList(numbers, "First list changed");
    PrintList(numbers2, "Second list changed");
    PrintList(numbers3, "Third list changed");
# ---------- n_08_genericlistprintingcopying: C# additional code ----------
 
  void PrintList<T>(List<T> list, string label = "label") // an example of a generic method (<Type> is characteristic).
  {
    Print("{0}:", label);
    for(int i = 0; i < list.Count; i++)
    {
      Print("{0}: {1}", i, list[i]);
    }
  }

  List<T> CopyList<T>(List<T> list) where T:new()
  {
    List<T> newList = new List<T>();
    foreach(T elem in list)
      newList.Add(elem);

    return newList;
  }

  class BiNumber
  {
    public BiNumber()
    {
      a = 0;
      b = 0;
    }

    public BiNumber(int a, int b)
    {
      this.a = a;
      this.b = b;
    }

    public BiNumber(double a, double b)
    {
      this.a = a;
      this.b = b;
    }

    public double a;
    public double b;

    public override string ToString()
    {
      return a.ToString() + ", " + b.ToString();
    }
  }
# ---------- end n_08_genericlistprintingcopying ----------
n_07_classinheritance = N_07_ClassInheritance()  # -> out, A; disabled
# ---------- n_07_classinheritance: C# ----------
    Person myExamplePerson = new Person();
    Student myExampleStudent = new Student();

    Print(myExamplePerson.SayHello());
    Print(myExampleStudent.SayHello());
    Print(myExamplePerson.ToString());

    Print("myPerson: {0}", myExamplePerson);

    myExampleStudent._grades.Clear();
# ---------- n_07_classinheritance: C# additional code ----------
  
  
  class Student : Person
    // Student derives from Person and has all of its functionality extended by student-specific properties and methods
  {
    public Student()
    {
      _grades = new List<int>();
      _grades.Add(3);
    }

    public Student(string name, int age) : base(name, age)
    {
      _grades = new List<int>();
      _grades.Add(3);
    }

    public List<int> _grades;
  }

  class Person
  {
    static Person() //no access modifiers!
    {
      Count = 0;
    }

    public Person()
    {
      this.Name = "default";
      this.Age = 0;
      Count++;
    }

    public Person(string name, int age)
    {
      this.Name = name;
      this.Age = age;
      Count++;
    }

    private string _name;
    private int _age;

    public static int Count;

    public string Name
    {
      set {_name = value;}
      get {return _name;}
    }

    public int Age
    {
      set {if(value > 0) _age = value; else _age = 0;}
      get {return _age;}
    }

    public string SayHello()
    {
      return string.Format("Hello! My name is {0}", this.Name);
    }

    public string Introduce()
    {
      return string.Format("Name: {0}, Age: {1}", this.Name, this.Age);
    }

    public override string ToString()
    {
      return string.Format("Name: {0}, Age: {1}", this.Name, this.Age);
    }
  }
# ---------- end n_07_classinheritance ----------
n_06_fullclassexample_1 = N_06_FullClassExample1()  # -> out, A; disabled
# ---------- n_06_fullclassexample_1: C# ----------
    List<Person> myPeople = new List<Person>();
    for(int i = 0; i < 3; i++)
    {
      myPeople.Add(new Person("Person no. " + i.ToString(), i * 2));
    }

    Print("People count: {0}", Person.Count);

    foreach(Person myPerson in myPeople)
    {
      Print(myPerson.SayHello());
      Print(myPerson.Introduce());
    }
# ---------- n_06_fullclassexample_1: C# additional code ----------
  class Person
  {
    static Person() //no access modifiers!
    {
      Count = 0;
    }

    public Person()
    {
      this.Name = "default";
      this.Age = 0;
      Count++;
    }

    public Person(string name, int age)
    {
      this.Name = name;
      this.Age = age;
      Count++;
    }

    private string _name;
    private int _age;

    public static int Count;

    public string Name
    {
      set {_name = value;}
      get {return _name;}
    }

    public int Age
    {
      set {if(value > 0) _age = value; else _age = 0;}
      get {return _age;}
    }

    public string SayHello()
    {
      return string.Format("Hello! My name is {0}", this.Name);
    }

    public string Introduce()
    {
      return string.Format("Name: {0}, Age: {1}", this.Name, this.Age);
    }
  }
# ---------- end n_06_fullclassexample_1 ----------
n_02_classproperties = N_02_ClassProperties()  # -> out, A; disabled
# ---------- n_02_classproperties: C# ----------
    Human myHuman = new Human();
    Human customer = new Human("Jerry", 25);
    Point3d myPoint = new Point3d(12, 15.5, 0);

    Print("Human's name: {0}, age: {1}", myHuman.Name, myHuman.Age);
    Print("Customer's name: {0}, age {1}", customer.Name, customer.Age);

    myHuman.Age = 4;
    Print(myHuman.Age.ToString());
# ---------- n_02_classproperties: C# additional code ----------
  public class Human
  {
    //A default constructor:
    public Human()
    {
      Name = "default";
      Age = 1;
    }
    public Human(string nameArgument, int ageArgument)
    {
      Name = nameArgument;
      Age = ageArgument;
    }

    public string Name { get; private set; }
    //automatic fields are only created for automatic properties

    private int _age;   // backing field for a property
    //StackOverflow Exception :(
    public int Age {
      get { return _age; }
      set {
        if(value > 0)
          _age = value;
        else
          _age = 1;
      }
    }
  }
# ---------- end n_02_classproperties ----------
n_03_namingconvention = N_03_NamingConvention()  # -> out, A; disabled
# ---------- n_03_namingconvention: C# ----------
    Component.Message = "Class naming convention";
# ---------- n_03_namingconvention: C# additional code ----------
  //Our class naming convention:
  class ClassName  // class' name is PascalCase (UpperCase)
  {
    //STATIC CONSTRUCTOR (called only once at the beginning of everything)
    static ClassName()
    {
      YourCounter = 0;
    }
    //CONSTRUCTORS
    public ClassName()   //Constructors have the same name as the class (C# syntax)
    {
      YourCounter++;
    }
    //STATIC member (common to all objects of a class, not specific to an object instance)
    static public int YourCounter { get; private set; }
    //FIELDS (contain data)
    private double _someMember;  //Fields are moslty private, start with underscore and
    // are camelCase
    //PROPERTIES (handle data - write and read fields)
    public double SomeMember  //Properties should have the same name as corresponding
    {                         //fields but without underscore and PascalCase
      get { return _someMember; }
      set { _someMember = value; }
    }

    //METHODS (do something)
    public void MethodsName() //Methods should have a descriptive name written PascalCase
    {
    }
  }
# ---------- end n_03_namingconvention ----------

deleterandommeshfaces = DeleteRandomMeshFaces()  # -> out, OutMesh; inputs mesh: Mesh; disabled
# ---------- deleterandommeshfaces: C# ----------
    List<int> face_indices = new List<int>();
    int count = mesh.Faces.Count;

    //Create a new instance of random generator
    Random rand = new Random();

    for (int i = 0; i <= count - 1; i += 2)
    {
      int index = rand.Next(count);
      //Assign new location
      face_indices.Add(index);
    }

    //delete duplicate indices
    List<int> distinct_indices = face_indices.Distinct().ToList();

    //delete faces
    mesh.Faces.DeleteFaces(distinct_indices);

    //Assign output
    OutMesh = mesh;
# ---------- end deleterandommeshfaces ----------

# ----
# Exercises
p_01_pointtower = P_01_PointTower()  # -> out, points; inputs reset: Boolean, run: Boolean, xCount: Int32, yCount: Int32, zCount: Int32, span: Double, amplitude: Double, seed: Int32; disabled
# ---------- p_01_pointtower: C# ----------
    Component.Message = "Point pillars";

    if(reset)
      limit = 1;
    else if(run)
    {
      List<GH_Point> ptListGH = new List<GH_Point>(); //GH_Point - fast
      //List<Point3d> ptList = new List<Point3d>(); // Point3d - slow

      Point3d startPt = new Point3d(0, 0, 0);
      double radAngle = 0;

      for(int i = 0; i < xCount; i++)
      {
        for(int j = 0; j < yCount; j++)
        {
          Polyline pLine = new Polyline();
          Random randomGen = new Random(seed + i * xCount + j); // different generators for different pillars
          Vector3d translation = new Vector3d(amplitude, 0, 0);

          double x = (i * span) + startPt.X;
          double y = (j * span) + startPt.Y;
          double z = startPt.Z;
          Point3d lastPt = new Point3d(x, y, z);
          for(int k = 0; k < limit; k++)
          {
            radAngle = (double) randomGen.Next(0, 359) / (double) 180 * Math.PI;
            translation.Rotate(radAngle, Vector3d.ZAxis);
            lastPt += translation;
            lastPt.Z = k * span;

            ptListGH.Add(new GH_Point(lastPt));
            //ptList.Add(lastPt);

          }
        }
      }

      points = ptListGH;
      //points = ptList;
      limit++;
      if(limit <= zCount)
        Component.ExpireSolution(true);
    }
# ---------- p_01_pointtower: C# additional code ----------
  int limit = 1;
# ---------- end p_01_pointtower ----------
p_05_elapsedstopwatchexercise = P_05_ElapsedStopwatchExercise()  # -> out, pointList; inputs count: Int32; disabled
# ---------- p_05_elapsedstopwatchexercise: C# ----------
    System.Diagnostics.Stopwatch st = System.Diagnostics.Stopwatch.StartNew();

    List<Point3d> pts = new List<Point3d>(count);
    for(int i = 0; i < count; i++)
      pts.Add(new Point3d(i, i, i));
    pointList = pts;
    st.Stop();

    Component.Message = "List<Point3d> + init cap: " + st.ElapsedMilliseconds.ToString() + "ms";
# ---------- end p_05_elapsedstopwatchexercise ----------
p_02_numbersorting = P_02_NumberSorting()  # -> out, sorted; inputs intList: list of Int32; disabled
# ---------- p_02_numbersorting: C# ----------
    int[] myArray = intList.ToArray();
    BubbleSort(myArray);
    sorted = myArray;
# ---------- p_02_numbersorting: C# additional code ----------
  void BubbleSort(int[] array)
  {
    int temp = 0;
    for(int i = array.Length - 1; i >= 1; i--)
    {
      for(int j = 0; j < i; j++)
      {
        if(array[j] > array[j + 1])
        {
          temp = array[j];
          array[j] = array[j + 1];
          array[j + 1] = temp;
        }
      }
    }
  }
# ---------- end p_02_numbersorting ----------
p_03_bubblesortingexercise = P_03_BubbleSortingExercise()  # -> out, A; inputs reset: Boolean, run: Boolean, values: list of Double; disabled
# ---------- p_03_bubblesortingexercise: C# ----------
    Component.Message = "Bubble sorting visualisation";

    if(reset)
    {
      ptList = new List<Point3d>(values.Count);
      maxIndex = values.Count - 1;
      for(int i = 0; i < values.Count; i++)
        ptList.Add(new Point3d(values[i], i, 0));
    }
    else if(run && maxIndex >= 1)
    {
      Point3d ptA, ptB;
      for(int j = 0; j < maxIndex; j++)
      {
        if(ptList[j].X > ptList[j + 1].X)
        {
          ptA = ptList[j];
          ptB = ptList[j + 1];

          ptA.Y = j + 1;
          ptB.Y = j;

          ptList[j] = ptB;
          ptList[j + 1] = ptA;
        }
      }
      maxIndex--;
    }

    A = ptList;
# ---------- p_03_bubblesortingexercise: C# additional code ----------
  List<Point3d> ptList;
  int maxIndex;
# ---------- end p_03_bubblesortingexercise ----------
p_05_variableoverflowexercise = P_05_VariableOverflowExercise()  # -> out, sbyte, byte, short, ushort; inputs num: Double; disabled
# ---------- p_05_variableoverflowexercise: C# ----------
    //byte myOverflowedByte = (byte) 256; //error! You can't cause an obvious overflow (initialization is always checked)
    unchecked{
      byte myOverflowedByte = (byte) 257; //explicit unchecked instructions
      Print("Initialized overflow(byte): {0}", myOverflowedByte);
      //if you declared something inside braces then you can use it only in this region
    }

    //these are unchecked by default:
    sbyte mySByte = (sbyte) num;
    byte myUByte = (byte) num;
    short myShort = (short) num;
    ushort myUShort = (ushort) num;

    //you could force overflow checking:
    /*checked{
    myUShort = (ushort) num; // if num is smaller than minimal or bigger than maximal value of ushort, then an exception will be thrown
    }*/

    // checking is useful if some transformations might cause unexpected errors
    // think of moving points so far away that their coordinates exceed max double values
    // not very likely however, because double maxValue is 10 to power of 287 times bigger than
    // the distance from the Sun to the Earth in nanometers(1.496*10 to power of 20)

    //integral signed types - positive and negative values
    sbyte mySignedByteMin = sbyte.MinValue;
    sbyte mySignedByteMax = sbyte.MaxValue;

    short myInt16Min = short.MinValue;
    short myInt16Max = short.MaxValue;

    //integral unsigned types - only positive values
    byte myByteMin = byte.MinValue;
    byte myByteMax = byte.MaxValue;

    ushort myUnsignedInt16Min = ushort.MinValue;
    ushort myUnsignedInt16Max = ushort.MaxValue;

    Print("sbyte min: {0}, max: {1}, memory size [bytes]: {2}", mySignedByteMin, mySignedByteMax, sizeof(sbyte));
    Print("short min: {0}, max: {1}, memory size [bytes]: {2}", myInt16Min, myInt16Max, sizeof(short));
    Print("byte min: {0}, max: {1}, memory size [bytes]: {2}", myByteMin, myByteMax, sizeof(byte));
    Print("ushort min: {0}, max: {1}, memory size [bytes]: {2}", myUnsignedInt16Min, myUnsignedInt16Max, sizeof(ushort));


    _sbyte = mySByte;
    _byte = myUByte;
    _short = myShort;
    _ushort = myUShort;
# ---------- end p_05_variableoverflowexercise ----------
p_04_bubblesortingexerciseotherway = P_04_bubbleSortingExerciseOtherWay()  # -> out, A; inputs reset: Boolean, run: Boolean, values: list of Double; disabled
# ---------- p_04_bubblesortingexerciseotherway: C# ----------
    Component.Message = "Bubble sorting visualisation";
    List<GH_Point> ptList = new List<GH_Point>(values.Count);

    if(reset)
    {
      minIndex = values.Count - 1;
      scriptValues = values;
    }
    else if(run && minIndex >= 1)
    {
      double temp = 0;
      for(int i = values.Count - 1; i >= minIndex; i--)
      {
        for(int j = 0; j < i; j++)
        {
          if(values[j] > values[j + 1])
          {
            temp = values[j];
            values[j] = values[j + 1];
            values[j + 1] = temp;
          }
        }
      }
      minIndex--;
      scriptValues = values;
      Component.ExpireSolution(true);
    }
    for(int i = 0; i < scriptValues.Count; i++)
      ptList.Add(new GH_Point(new Point3d(scriptValues[i], i, 0)));

    A = ptList;
# ---------- p_04_bubblesortingexerciseotherway: C# additional code ----------
  int minIndex;
  List<double> scriptValues;
# ---------- end p_04_bubblesortingexerciseotherway ----------

# ---- group: ClassAbstractError
extract2ddrawingmake2d = Extract2DDrawingMake2D()  # -> out, VCurves, HCurves, VCut, HCut; inputs geomList: list of GeometryBase, cplaneList: list of Plane; disabled
# ---------- extract2ddrawingmake2d: C# ----------
    //Use the active view in the Rhino document
    var _view = doc.Views.ActiveView;
    //Set Make2D Parameters
    var _hldParams = new HiddenLineDrawingParameters
      {
        AbsoluteTolerance = doc.ModelAbsoluteTolerance,
        IncludeTangentEdges = false,
        IncludeHiddenCurves = true
        };
    _hldParams.SetViewport(_view.ActiveViewport);

    //add objects to hld_param
    foreach (var geom in geomList){
      _hldParams.AddGeometry(geom, Transform.Identity, null);
    }

    //Add clipping planes
    foreach (var cplane in cplaneList ){
      _hldParams.AddClippingPlane(cplane);
    }

    //perform HLD calculation
    var  visibleList = new List<Curve>();
    var  hiddenList = new List<Curve>();
    var  secVisibleList = new List<Curve>();
    var  secHiddenList = new List<Curve>();
    var _hld = HiddenLineDrawing.Compute(_hldParams, true);
    if (_hld != null)
    {
      //transform
      var flatten = Transform.PlanarProjection(Plane.WorldXY);
      BoundingBox pageBox = _hld.BoundingBox(true);
      var delta2D = new Vector2d(0, 0);
      delta2D = delta2D - new Vector2d(pageBox.Min.X, pageBox.Min.Y);
      var delta3D = Transform.Translation(new Vector3d(delta2D.X, delta2D.Y, 0.0));
      flatten = delta3D * flatten;
      //add curves to lists
      foreach (HiddenLineDrawingSegment hldCurve in _hld.Segments)
      {
        if (hldCurve == null ||
          hldCurve.ParentCurve == null ||
          hldCurve.ParentCurve.SilhouetteType == SilhouetteType.None)
          continue;
        var crv = hldCurve.CurveGeometry.DuplicateCurve();
        if (crv != null)
        {
          crv.Transform(flatten);
          if (hldCurve.SegmentVisibility == HiddenLineDrawingSegment.Visibility.Visible)
          {
            if (hldCurve.ParentCurve.SilhouetteType == SilhouetteType.SectionCut)
              secVisibleList.Add(crv);
            else
              visibleList.Add(crv);
          }
          else if (hldCurve.SegmentVisibility == HiddenLineDrawingSegment.Visibility.Hidden)
          {
            if (hldCurve.ParentCurve.SilhouetteType == SilhouetteType.SectionCut)
              secHiddenList.Add(crv);
            else
              hiddenList.Add(crv);
          }
        }
      }
    }

    VCurves = visibleList;
    HCurves = hiddenList;
    VCut = secVisibleList;
    HCut = secHiddenList;
# ---------- end extract2ddrawingmake2d ----------
recursivepenrosestring = RecursivePenroseString()  # -> out, PenroseString; inputs startString: String, rule6: String, rule7: String, rule8: String, rule9: String, num: Int32; disabled
# ---------- recursivepenrosestring: C# ----------
    // Declare string
    string finalString;
    finalString = startString;

    // Generate the string
    GrowString(ref num, ref finalString, rule6, rule7, rule8, rule9);

    // Return the string
    PenroseString = finalString;
# ---------- recursivepenrosestring: C# additional code ----------
  void GrowString(ref int num, ref string finalString, string rule6, string rule7, string rule8, string rule9)
  {
    // Decrement the count with each new execution  of the grow function
    num = num - 1;
    char rule;

    // Create new string
    string newString = "";
    for (int i = 0; i < finalString.Length; i++)
    {
      rule = finalString[i];
      if (rule == '6')
        newString = newString + rule6;
      if (rule == '7')
        newString = newString + rule7;
      if (rule == '8')
        newString = newString + rule8;
      if (rule == '9')
        newString = newString + rule9;

      if (rule == '[' || rule == ']' || rule == '+' || rule == '-')
        newString = newString + rule;
    }

    finalString = newString;

    // Stopper condition
    if (num == 0)
      return;

    // Grow again
    GrowString(ref num, ref finalString, rule6, rule7, rule8, rule9);
  }
# ---------- end recursivepenrosestring ----------
recursivedragonstring = RecursiveDragonString()  # -> out, DragonString; inputs startString: String, ruleX: String, ruleY: String, num: Int32; disabled
# ---------- recursivedragonstring: C# ----------
    // Declare string
    string finalString = startString;

    // Generate the string
    GrowString(ref num, ref finalString, ruleX, ruleY);

    // Return the string
    DragonString = finalString;
# ---------- recursivedragonstring: C# additional code ----------
  void GrowString(ref int num, ref string finalString, string ruleX, string ruleY)
  {
    // Decrement the count with each new excution of the grow function
    num = num - 1;
    char rule;

    // Create new string
    string newString = "";
    for (int i = 0; i < finalString.Length ; i++)
    {
      rule = finalString[i];
      if (rule == 'X')
        newString = newString + ruleX;
      if (rule == 'Y')
        newString = newString + ruleY;
      if (rule == 'F' | rule == '+' | rule == '-')
        newString = newString + rule;
    }
    finalString = newString;

    // Stopper condition
    if (num == 0)
      return;

    // Grow again
    GrowString(ref num, ref finalString, ruleX, ruleY);
  }
# ---------- end recursivedragonstring ----------
subdividingsurface = SubdividingSurface()  # -> out, OutPolylines, OutMesh; inputs srf: Surface, inPolylines: list of Polyline, degree: Int32; disabled
# ---------- subdividingsurface: C# ----------
    //create a collection of all panels
    List<Polyline> outPanels = new List<Polyline>();

    //limit the degree to 6
    if( degree > 6)
      degree = 6;

    for(int i = 0; i < degree; i++)
    {
      //outer polylines
      List<Polyline> plines = new List<Polyline>();

      //mid polylines
      List<Polyline> midPlines = new List<Polyline>();

      //generate subdivided panels
      bool result = SubPanelOnSurface(srf, inPolylines.ToArray(), ref plines, ref midPlines);
      if( result == false)
        break;
      //add outer panels
      outPanels.AddRange(plines);

      //add mid panels only in the last iteration
      if(i == degree - 1) //add mid panels
        outPanels.AddRange(midPlines);
      else //subdivide mid panels only
        inPolylines = midPlines;
    }

    //Create a mesh from all polylines
    Mesh joinedMesh = new Mesh();
    for(int i = 0; i < outPanels.Count; i++)
    {
      var mesh = Mesh.CreateFromClosedPolyline(outPanels[i]);
      joinedMesh.Append(mesh);
    }
    //make sure all mesh faces normals are in the same general direction
    joinedMesh.UnifyNormals();

    //Assign output
    OutPolylines = outPanels;
    OutMesh = joinedMesh;
# ---------- subdividingsurface: C# additional code ----------
  public bool SubPanelOnSurface(
    Surface srf,
    Polyline[] inputPanels,
    ref List<Polyline> outPanels,
    ref List<Polyline> midPanels)
  {
    //check for a valid input
    if (inputPanels.Length == 0 || null == srf)
      return false;

    for (int i = 0; i < inputPanels.Length; i++)
    {
      Polyline ipline = inputPanels[i];
      if (!ipline.IsValid || !ipline.IsClosed)
        continue;

      //stack of points
      List<Point3d> stack = new List<Point3d>();
      Polyline newPline = new Polyline();
      for (int j = 1; j < ipline.Count; j++)
      {
        Line line = new Line(ipline[j - 1], ipline[j]);
        if (line.IsValid)
        {
          Point3d mid = line.PointAt(0.5);
          double s, t;
          srf.ClosestPoint(mid, out s, out t);
          mid = srf.PointAt(s, t);
          newPline.Add(mid);

          stack.Add(ipline[j - 1]);
          stack.Add(mid);
        }
      }
      //add the first 2 point to close last triangle
      stack.Add(stack[0]);
      stack.Add(stack[1]);

      //close
      newPline.Add(newPline[0]);
      midPanels.Add(newPline);

      for (int j = 2; j < stack.Count; j = j + 1)
      {
        Polyline p = new Polyline { stack[j - 2], stack[j - 1], stack[j], stack[j - 2] };

        outPanels.Add(p);
      }
    }

    return true;
  }
# ---------- end subdividingsurface ----------
recursivefractaltreestring = RecursiveFractalTreeString()  # -> out, FractalString; inputs startString: String, ruleX: String, ruleY: String, num: Int32; disabled
# ---------- recursivefractaltreestring: C# ----------
    // Declare string
    string fractalString = startString;

    // Generate the string
    GrowString(ref num, ref fractalString, ruleX, ruleY);

    // Return the string
    FractalString = fractalString;
# ---------- recursivefractaltreestring: C# additional code ----------
  void GrowString(ref int num, ref string finalString, string ruleX, string ruleF)
  {
    // Decrement the count with each new excution of the grow function
    num = num - 1;
    char rule;

    // Create new string
    string newString = "";
    for (int i = 0; i < finalString.Length; i++)
    {
      rule = finalString[i];

      if (rule == 'X')
        newString = newString + ruleX;

      if (rule == 'F')
        newString = newString + ruleF;

      if (rule == '[' || rule == ']' || rule == '+' || rule == '-')
        newString = newString + rule;
    }

    finalString = newString;

    // Stopper condition
    if (num == 0)
      return;

    // Grow again
    GrowString(ref num, ref finalString, ruleX, ruleF);
  }
# ---------- end recursivefractaltreestring ----------
decasteljauinterpolatebeziercurve = DeCasteljauInterpolateBezierCurve()  # -> out, BezierCrv; inputs pt0: Point3d, pt1: Point3d, pt2: Point3d, pt3: Point3d, segments: Int32; disabled
# ---------- decasteljauinterpolatebeziercurve: C# ----------
    if(segments < 2)
      segments = 2;

    List<Point3d> bezierPts = new List<Point3d>();
    bezierPts.Add(pt0);
    bezierPts.Add(pt1);
    bezierPts.Add(pt2);
    bezierPts.Add(pt3);

    List<Point3d> evalPts = new List<Point3d>();
    double step = 1 / (double) segments;
    for(int i = 0; i <= segments; i++)
    {
      double t = i * step;
      Point3d pt = Point3d.Unset;
      EvalPoint(bezierPts, t, ref pt);

      if(pt.IsValid)
        evalPts.Add(pt);
    }

    Polyline pline = new Polyline(evalPts);
    BezierCrv = pline;
# ---------- decasteljauinterpolatebeziercurve: C# additional code ----------
  void EvalPoint(List<Point3d> points, double t, ref Point3d evalPt)
  {
    if(points.Count < 2)
      return;

    List<Point3d> tPoints = new List<Point3d>();
    for(int i = 1; i < points.Count; i++)
    {
      Line line = new Line(points[i - 1], points[i]);
      Point3d pt = line.PointAt(t);
      tPoints.Add(pt);
    }

    if(tPoints.Count == 1)
      evalPt = tPoints[0];

    EvalPoint(tPoints, t, ref evalPt);

  }
# ---------- end decasteljauinterpolatebeziercurve ----------
createsinewavegeometry = CreateSineWaveGeometry()  # -> out, OutCurves, OutSurface, OutLoft; inputs num: Int32, unit: Int32; disabled
# ---------- createsinewavegeometry: C# ----------
    //list of all points
    List<Point3d> allPoints = new List<Point3d>();
    //list of curves
    List<Curve> curves = new List<Curve>();

    for(int y = 0; y < num; y++)
    {
      //curve points
      List<Point3d> crvPoints = new List<Point3d>();
      for(int x = 0; x < num; x++)
      {
        double z = Math.Sin(Math.PI / 180 + (x + y));
        Point3d pt = new Point3d(x, y, z);
        crvPoints.Add(pt);
        allPoints.Add(pt);
      }
      //create a degree 3 curve from control points
      Curve crv = Curve.CreateControlPointCurve(crvPoints, 3);
      curves.Add(crv);
    }
    //create a nurbs surface from control points
    NurbsSurface srf = NurbsSurface.CreateFromPoints(allPoints, num, num, 3, 3);

    //create a loft brep from curves
    Brep[ ] breps = Brep.CreateFromLoft(curves, Point3d.Unset, Point3d.Unset, LoftType.Tight, false);

    //Assign output
    OutCurves = curves;
    OutSurface = srf;
    OutLoft = breps;
# ---------- end createsinewavegeometry ----------
createsinewaveexponential = CreateSineWaveExponential()  # -> out, OutCurves, OutSurface, OutLoft; inputs num: Int32, unit: Double; disabled
# ---------- createsinewaveexponential: C# ----------
    //list of all points
    List<Point3d> allPoints = new List<Point3d>();
    //list of curves
    List<Curve> curves = new List<Curve>();

    for(int y = 0; y < num; y++)
    {
      //curve points
      List<Point3d> crvPoints = new List<Point3d>();
      for(int x = 0; x < num; x++)
      {
        double z = Math.Sin(Math.PI / unit * (x * y));
        Point3d pt = new Point3d(x, y, z);
        crvPoints.Add(pt);
        allPoints.Add(pt);
      }
      //create a degree 3 curve from control points
      Curve crv = Curve.CreateControlPointCurve(crvPoints, 3);
      curves.Add(crv);
    }
    //create a nurbs surface from control points
    NurbsSurface srf = NurbsSurface.CreateFromPoints(allPoints, num, num, 3, 3);

    //create a loft brep from curves
    Brep[ ] breps = Brep.CreateFromLoft(curves, Point3d.Unset, Point3d.Unset, LoftType.Tight, false);

    //Assign output
    OutCurves = curves;
    OutSurface = srf;
    OutLoft = breps;
# ---------- end createsinewaveexponential ----------
gameoflife = GameOfLife()  # -> out, PointGrid, StateGrid; inputs srf: Surface, uNum: Int32, vNum: Int32, seed: Int32; disabled
# ---------- gameoflife: C# ----------
    if(uNum < 2)
      uNum = 2;
    if(vNum < 2)
      vNum = 2;

    double uStep = srf.Domain(0).Length / uNum;
    double vStep = srf.Domain(1).Length / vNum;
    double uMin = srf.Domain(0).Min;
    double vMin = srf.Domain(1).Min;

    //create a grid of points and a grid of states
    DataTree<Point3d> pointsTree = new DataTree<Point3d>();
    DataTree<int> statesTree = new DataTree<int>();
    int pathIndex = 0;
    Random rand = new Random(seed);
    for (int i = 0; i <= uNum; i++)
    {
      List<Point3d> ptList = new List<Point3d>();
      List<int> stateList = new List<int>();
      GH_Path path = new GH_Path(pathIndex);
      pathIndex = pathIndex + 1;
      for (int j = 0; j <= vNum; j++)
      {
        Point3d srfPt = srf.PointAt(uMin + i * uStep, vMin + j * vStep);
        ptList.Add(srfPt);
        int randState = rand.Next(0, 2);
        stateList.Add(randState);
      }
      pointsTree.AddRange(ptList, path);
      statesTree.AddRange(stateList, path);
    }

    PointGrid = pointsTree;
    StateGrid = statesTree;
# ---------- end gameoflife ----------
decasteljauevaluatebeziercurve = DeCasteljauEvaluateBezierCurve()  # -> out, BezierCrv, EvalPt; inputs pt0: Point3d, pt1: Point3d, pt2: Point3d, pt3: Point3d, t: Double; disabled
# ---------- decasteljauevaluatebeziercurve: C# ----------
    List<Point3d> points = new List<Point3d>();
    points.Add(pt0);
    points.Add(pt1);
    points.Add(pt2);
    points.Add(pt3);

    Point3d pt = Point3d.Unset;
    EvalPoint(points, t, ref pt);

    if(pt.IsValid)
      EvalPt = pt;

    BezierCurve crv = new BezierCurve(points);
    BezierCrv = crv.ToNurbsCurve();
# ---------- decasteljauevaluatebeziercurve: C# additional code ----------
  void EvalPoint(List<Point3d> points, double t, ref Point3d evalPt)
  {
    if(points.Count < 2)
      return;

    List<Point3d> tPoints = new List<Point3d>();
    for(int i = 1; i < points.Count; i++)
    {
      Line line = new Line(points[i - 1], points[i]);
      Point3d pt = line.PointAt(t);
      tPoints.Add(pt);
    }

    if(tPoints.Count == 1)
      evalPt = tPoints[0];

    EvalPoint(tPoints, t, ref evalPt);

  }
# ---------- end decasteljauevaluatebeziercurve ----------

# ----
# Advanced C#
#  Custom Nodes
file_path = FilePath()  # disabled
constructnumtree = ConstructTreeOfNumbers()  # -> out, Numbers; inputs branchNum: Int32, countNum: Int32, number: Int32; disabled
# ---------- constructnumtree: C# ----------
    DataTree<double> numTree = new DataTree<double>();
    int pathIndex = 0;
    for (int b = 1; b <= branchNum; b++) {
      List<double> numList = new List<double>();
      GH_Path path = new GH_Path(pathIndex);
      pathIndex = pathIndex + 1;
      for (int i = 1; i <= countNum; i++) {
        numList.Add(number * i * b);
      }
      numTree.AddRange(numList, path);
    }
    Numbers = numTree;
# ---------- end constructnumtree ----------
structexample_2colorpoints = StructExample2ColorPoints()  # -> out, MatchLoc, MatchColor, AverageColor, AveragePoint; inputs x: Double, y: Double, z: Double, c: Color, x1: Double, y1: Double, z1: Double, c1: Color; disabled
# ---------- structexample_2colorpoints: C# usings ----------
using System.Drawing;
# ---------- structexample_2colorpoints: C# ----------
    ColorPoint cp0 = new ColorPoint(x, y, z, c);
    Print("ColorPoint 0: X=" + cp0.X + ", Y=" + cp0.Y + ", Z=" + cp0.Z + ", Color=" + cp0.C.Name + ", Saturation=" + cp0.Saturation());

    ColorPoint cp1 = new ColorPoint(x1, y1, z1, c1);
    Print("ColorPoint 1: X=" + cp1.X + ", Y=" + cp1.Y + ", Z=" + cp1.Z + ", Color=" + cp1.C.Name + ", Saturation=" + cp1.Saturation());

    //compare locationusing the static function "isEqualLocation" in ColorPoint
    MatchLoc = ColorPoint.isEqualLocation(cp0, cp1);

    //compare color using the static function "isEqualColor" in ColorPoint
    MatchColor = ColorPoint.isEqualColor(cp0, cp1);

    //Output average point and color
    ColorPoint aPt = ColorPoint.Average(cp0, cp1);
    AverageColor = aPt.C;
    AveragePoint = new Point3d(aPt.X, aPt.Y, aPt.Z);

    //First point passed by value
    Print("\nPass point1 by value");
    Print(" Before function call =(" + cp0.X + "," + cp0.Y + "," + cp0.Z + ")");
    ChangeLocationByValue(cp0);
    Print(" After function call =(" + cp0.X + "," + cp0.Y + "," + cp0.Z + ")");

    //Second points passed by reference
    Print("\nPass point2 by reference");
    Print(" Before function call =(" + cp1.X + "," + cp1.Y + "," + cp1.Z + ")");
    ChangeLocationByReference(ref cp1);
    Print(" After function call =(" + cp1.X + "," + cp1.Y + "," + cp1.Z + ")");
# ---------- structexample_2colorpoints: C# additional code ----------
  struct ColorPoint{
    //fields
    private double _x;
    private double _y;
    private double _z;
    private System.Drawing.Color _c;

    //constructor
    public ColorPoint(double x, double y, double z, System.Drawing.Color c)
    {
      _x = x;
      _y = y;
      _z = z;
      _c = c;
    }

    //properties
    public double X { get { return _x; } set { _x = value; } }
    public double Y { get { return _y; } set { _y = value; } }
    public double Z { get { return _z; } set { _z = value; } }
    public System.Drawing.Color C { get { return _c; } set { _c = value; } }
    public double Saturation(){return _c.GetSaturation();}

    //static methods
    public static bool isEqualLocation(ColorPoint p1, ColorPoint p2)
    {
      return (p1.X == p2.X && p1.Y == p2.Y && p1.Z == p2.Z);
    }
    public static bool isEqualColor(ColorPoint p1, ColorPoint p2)
    {
      return p1.C.Equals(p2.C);
    }
    public static ColorPoint Average (ColorPoint a, ColorPoint b)
    {
      ColorPoint avPt = new ColorPoint();
      avPt.X = (a.X + b.X) / 2;
      avPt.Y = (a.Y + b.Y) / 2;
      avPt.Z = (a.Z + b.Z) / 2;
      avPt.C = Color.FromArgb((a.C.A + b.C.A) / 2, (a.C.R + b.C.R) / 2, (a.C.G + b.C.G) / 2, (a.C.B + b.C.B) / 2);
      return avPt;
    }

  }

  void ChangeLocationByValue(ColorPoint cp)
  {
    cp.X += 10;
    cp.Y += 10;
    cp.Z += 10;
    Print(" Inside change location= (" + cp.X + "," + cp.Y + "," + cp.Z + ")");
  }

  void ChangeLocationByReference(ref ColorPoint cp)
  {
    cp.X += 10;
    cp.Y += 10;
    cp.Z += 10;
    Print(" Inside change location= (" + cp.X + "," + cp.Y + "," + cp.Z + ")");
  }
# ---------- end structexample_2colorpoints ----------
classcolorpoints = ClassColorPoints()  # -> out, MatchLoc, MatchColor, AverageColor, AveragePoint; inputs x: Double, y: Double, z: Double, c: Color, x1: Double, y1: Double, z1: Double, c1: Color; disabled
# ---------- classcolorpoints: C# ----------
    CColorPoint cp0 = new CColorPoint(x, y, z, c);
    Print("ColorPoint 0: X=" + cp0.X + ", Y=" + cp0.Y + ", Z=" + cp0.Z + ", Color=" + cp0.C.Name + ", Saturation=" + cp0.Saturation());

    CColorPoint cp1 = new CColorPoint(x1, y1, z1, c1);
    Print("ColorPoint 1: X=" + cp1.X + ", Y=" + cp1.Y + ", Z=" + cp1.Z + ", Color=" + cp1.C.Name + ", Saturation=" + cp1.Saturation());

    //compare locationusing the static function "isEqualLocation" in ColorPoint
    MatchLoc = CColorPoint.IsEqualLocation(cp0, cp1);

    //compare color using the static function "isEqualColor" in ColorPoint
    MatchColor = CColorPoint.isEqualColor(cp0, cp1);

    //Output average point and color
    CColorPoint aPt = CColorPoint.Average(cp0, cp1);
    AverageColor = aPt.C;
    AveragePoint = new Point3d(aPt.X, aPt.Y, aPt.Z);

    //First point passed by value
    Print("\nPass point1 by value");
    Print(" Before function call =(" + cp0.X + "," + cp0.Y + "," + cp0.Z + ")");
    ChangeLocationByValue(cp0);
    Print(" After function call =(" + cp0.X + "," + cp0.Y + "," + cp0.Z + ")");

    //Second points passed by reference
    Print("\nPass point2 by reference");
    Print(" Before function call =(" + cp1.X + "," + cp1.Y + "," + cp1.Z + ")");
    ChangeLocationByReference(ref cp1);
    Print(" After function call =(" + cp1.X + "," + cp1.Y + "," + cp1.Z + ")");

    //Note: class instances are ALWAYS passed by reference with or without "ref"
# ---------- classcolorpoints: C# additional code ----------
  class CPoint{
    //fields
    private double _x;
    private double _y;
    private double _z;
    //constructors
    public CPoint() : this(0, 0, 0) //default calls another constructor
    {
    }
    public CPoint(double x, double y, double z)
    {
      _x = x;
      _y = y;
      _z = z;
    }
    //properties
    public double X { get { return _x; } set { _x = value; } }
    public double Y { get { return _y; } set { _y = value; } }
    public double Z { get { return _z; } set { _z = value; } }
    //static methods
    public static bool IsEqualLocation(CColorPoint p1, CColorPoint p2)
    {
      return (p1.X == p2.X && p1.Y == p2.Y && p1.Z == p2.Z);
    }
  }

  //Color point inherits from Point class
  //That means it can access all its methods and fields
  class CColorPoint: CPoint{
    //fields
    private System.Drawing.Color _c;

    //default constructor
    public CColorPoint()
    {
      X = 0;
      Y = 0;
      Z = 0;
      _c = System.Drawing.Color.White;
    }
    //constructor
    public CColorPoint(double x, double y, double z, System.Drawing.Color c)
    {
      X = x;
      Y = y;
      Z = z;
      _c = c;
    }

    //properties
    public System.Drawing.Color C { get { return _c; } set { _c = value; } }

    //methods
    public double Saturation(){return _c.GetSaturation();}

    //static methods
    public static bool isEqualColor(CColorPoint p1, CColorPoint p2)
    {
      return p1.C.Equals(p2.C);
    }
    public static CColorPoint Average (CColorPoint a, CColorPoint b)
    {
      CColorPoint avPt = new CColorPoint();
      avPt.X = (a.X + b.X) / 2;
      avPt.Y = (a.Y + b.Y) / 2;
      avPt.Z = (a.Z + b.Z) / 2;
      avPt.C = Color.FromArgb((a.C.A + b.C.A) / 2, (a.C.R + b.C.R) / 2, (a.C.G + b.C.G) / 2, (a.C.B + b.C.B) / 2);
      return avPt;
    }
  }

  void ChangeLocationByValue(CColorPoint cp)
  {
    cp.X += 10;
    cp.Y += 10;
    cp.Z += 10;
    Print(" Inside change location= (" + cp.X + "," + cp.Y + "," + cp.Z + ")");
  }

  void ChangeLocationByReference(ref CColorPoint cp)
  {
    cp.X += 10;
    cp.Y += 10;
    cp.Z += 10;
    Print(" Inside change location= (" + cp.X + "," + cp.Y + "," + cp.Z + ")");
  }
# ---------- end classcolorpoints ----------
structcolorpoints_1 = StructColorPoints1()  # -> out, MatchLoc, MatchColor, Saturation; inputs x: Double, y: Double, z: Double, c: Color, x1: Double, y1: Double, z1: Double, c1: Color; disabled
# ---------- structcolorpoints_1: C# ----------
    ColorPoint cp0 = new ColorPoint();
    //Using default constructor sets fiels to zero
    Print("Default ColorPoint 0: X=" + cp0.X + ", Y=" + cp0.Y + ", Z=" + cp0.Z + ", Color=" + cp0.C.Name);
    //set fields
    cp0.X = x;
    cp0.Y = y;
    cp0.Z = z;
    cp0.C = c;
    Print("ColorPoint 0: X=" + cp0.X + ", Y=" + cp0.Y + ", Z=" + cp0.Z + ", Color=" + cp0.C.Name);

    ColorPoint cp1 = new ColorPoint();
    //set fields
    cp1.X = x1;
    cp1.Y = y1;
    cp1.Z = z1;
    cp1.C = c1;
    Print("ColorPoint 1: X=" + cp1.X + ", Y=" + cp1.Y + ", Z=" + cp1.Z + ", Color=" + cp1.C.Name);

    //compare location
    MatchLoc = false;
    if(cp0.X == cp1.X && cp0.Y == cp1.Y && cp0.Z == cp1.Z)
      MatchLoc = true;

    //compare color
    MatchColor = cp0.C.Equals(cp1.C);

    //get saturation
    Saturation = cp0.Saturation;
# ---------- structcolorpoints_1: C# additional code ----------
  struct ColorPoint{
    //fields for the point XYZ location and color
    private double _x;
    private double _y;
    private double _z;
    private System.Drawing.Color _c;
    //properties to get and set the location and color
    public double X { get { return _x; } set { _x = value; } }
    public double Y { get { return _y; } set { _y = value; } }
    public double Z { get { return _z; } set { _z = value; } }
    public System.Drawing.Color C { get { return _c; } set { _c = value; } }
    public double Saturation { get { return _c.GetSaturation(); } }
  }
# ---------- end structcolorpoints_1 ----------
classcolorpointinterface = ClassColorPointInterface()  # -> out, Equal; inputs x: Double, y: Double, z: Double, c: Color, x1: Double, y1: Double, z1: Double, c1: Color; disabled
# ---------- classcolorpointinterface: C# ----------
    ColorPoint cp0 = new ColorPoint();
    //set fields
    cp0.X = x;
    cp0.Y = y;
    cp0.Z = z;
    cp0.C = c;
    Print("ColorPoint 0: X=" + cp0.X + ", Y=" + cp0.Y + ", Z=" + cp0.Z + ", Color=" + cp0.C.Name);

    ColorPoint cp1 = new ColorPoint();
    //set fields
    cp1.X = x1;
    cp1.Y = y1;
    cp1.Z = z1;
    cp1.C = c1;
    Print("ColorPoint 1: X=" + cp1.X + ", Y=" + cp1.Y + ", Z=" + cp1.Z + ", Color=" + cp1.C.Name);

    //Equality test
    Equal = cp0.Equals(cp1);
# ---------- classcolorpointinterface: C# additional code ----------
  struct ColorPoint: IEquatable<ColorPoint>
  {
    //fields
    private double _x;
    private double _y;
    private double _z;
    private System.Drawing.Color _c;
    //properties
    public double X { get { return _x; } set { _x = value; } }
    public double Y { get { return _y; } set { _y = value; } }
    public double Z { get { return _z; } set { _z = value; } }
    public System.Drawing.Color C { get { return _c; } set { _c = value; } }
    //implement Equals method inside IEquatable interface - if omitted, you’ll get error
    public bool Equals(ColorPoint pt)
    {
      return (this._x == pt._x && this._y == pt._y && this._z == pt._z && this._c == pt._c);
    }
  }
# ---------- end classcolorpointinterface ----------
readingtexttopoints = ReadingTextToPoints()  # -> out, Points; inputs path: String, read: Boolean; disabled
# ---------- readingtexttopoints: C# ----------
    if ((!File.Exists(path)) || !read) {
      //Show message box
      System.Windows.Forms.MessageBox.Show("File does not exist or could not be read");
      //Give feedbacj in the component out parameter
      Print("Exit without reading");
      return;
    }

    //Read the file
    string[] lines = File.ReadAllLines(path);

    //Check that file is not empty
    if ((lines == null)) {
      Print("File has no content");
      return;
    }

    //Declare list of points
    List<Point3d> pts = new List<Point3d>();

    //Charachters to remove
    var charsToRemove = new string[] { " ", ")", "(", "[", "]", "{", "}" };

    //Loop through lines
    foreach (string line in lines)
    {
      //Trim
      var t_line = line;
      foreach (var c in charsToRemove)
      {
        t_line = t_line.Replace(c, string.Empty);
      }

      //Check if line is empty
      if (String.IsNullOrEmpty(line)) continue;

      //Tokenize line into array of strings separated by ","
      string[] parts = t_line.Split(",".ToCharArray());

      //Make sure that each line has exactly 3 values
      if (parts.Length != 3)
        continue;

      //Convert each coordinate from string to double
      double x = Convert.ToDouble(parts[0]);
      double y = Convert.ToDouble(parts[1]);
      double z = Convert.ToDouble(parts[2]);

      //create the point and add to the list
      pts.Add(new Point3d(x, y, z));
    }

    Points = pts;
# ---------- end readingtexttopoints ----------
treecreatespheres = TreeAccessCreateSpheres()  # -> out, Spheres; inputs ptTree: tree of Point3d, radius: Double; disabled
# ---------- treecreatespheres: C# ----------
    //Declare a tree of spheres
    DataTree<Sphere> sphereTree = new DataTree<Sphere>();
    int pathIndex = 0;
    foreach (List<Point3d> branch in ptTree.Branches) {
      List<Sphere> sphereList = new List<Sphere>();
      GH_Path path = new GH_Path(pathIndex);
      pathIndex = pathIndex + 1;
      foreach (Point3d pt in branch)
      {
        Sphere sphere = new Sphere(pt, 0.5);
        sphereList.Add(sphere);
      }
      sphereTree.AddRange(sphereList, path);
    }
    Print("Run #" + Iteration);
    Spheres = sphereTree;
# ---------- end treecreatespheres ----------

classabstracterror = ClassAbstractError()  # -> out, A; disabled
# ---------- classabstracterror: C# ----------
    //ERROR: attempt to create an instance of the abstract "Curve" class
      Rhino.Geometry.Curve crv = new Rhino.Geometry.Curve();
# ---------- end classabstracterror ----------

# ----
# POPULAR C# NODES
# CREATE FROM SCRATCH
constructnumtree_2 = ConstructTreeOfNumbers()  # -> out, Numbers; inputs branchNum: Int32, countNum: Int32, number: Int32; same code as constructnumtree
classcreatenewnurbscurve_2 = ClassCreateNewNURBSCurve()  # -> out, InterpolateCrv, NurbsCrv; inputs points: list of Point3d, degree: Int32; same code as classcreatenewnurbscurve
methodcreatecurveoffset_2 = MethodCreateCurveOffset()  # -> out, OffsetCrv; inputs crv: Curve, offset: Double; same code as methodcreatecurveoffset
methodpointdistance_2 = MethodPointDistance()  # -> out, Point, Distance; inputs x: Double, y: Double, z: Double, other: Point3d; same code as methodpointdistance
methodcreatecurvesbetweentwocurves_2 = MethodCreateCurvesBetweenTwoCurves()  # -> out, Curves; inputs curve0: Curve, curve1: Curve, count: Int32; same code as methodcreatecurvesbetweentwocurves
checkprimeandfactors_2 = CheckPrimeAndFactors()  # -> out, IsPrime, Factors; inputs num: Int32; same code as checkprimeandfactors
methodpointtransformx_2 = MethodPointTransformX()  # -> out, Point; inputs pt: Point3d, xform: Transform; same code as methodpointtransformx
operatorsvectors_2 = OperatorsVectors()  # -> out, Pt0, Pt1, Vec0, Vec1, AddVec, SubtractVec, DotVec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; same code as operatorsvectors
operatoraddtwopoints_2 = OperatorAddTwoPoints()  # -> out, Point; inputs pt1: Point3d, pt2: Point3d; same code as operatoraddtwopoints
classcreatepolylinefrompoints_2 = ClassCreatePolylineFromPoints()  # -> out, Crv, Type; inputs pts: list of Point3d; same code as classcreatepolylinefrompoints
createpointintializexyz_4 = CreatePointIntializeXYZ()  # -> out, Point; inputs x: Double, y: Double, z: Double; same code as createpointintializexyz
sumtreenum_2 = FindSumOfNumbersInTree()  # -> out, Sum; inputs x: tree of Double; same code as sumtreenum
getpointcoordinates_3 = GetPointCoordinates()  # -> out, A, B, C; inputs pt: Point3d; same code as getpointcoordinates
getoriginpoint_3 = GetOriginPoint()  # -> out, Origin; same code as getoriginpoint
navigatingtopologyofbrep_2 = NavigatingTopologyOfBrep()  # -> out, Faces, FaceSurfaces, Loops2DCurves, Loops3DCurves, Edges, Trims2DCurves, Vertices; inputs brep: Brep; same code as navigatingtopologyofbrep
calculateareavolumecentroid_2 = CalculateAreaVolumeCentroid()  # -> out, Area, Vol, Centroid; inputs brep: Brep; same code as calculateareavolumecentroid
extractoutlineandignorholes_2 = ExtractOutlineAndIgnorHoles()  # -> out, Outline; inputs brep: Brep; same code as extractoutlineandignorholes
methodffsetsurfaces_2 = MethodffSetSurfaces()  # -> out, OutSrf; inputs srf: Surface, num: Int32, dis: Double, tol: Double; same code as methodffsetsurfaces
methodgetcontrolpointsofnurbscurve_2 = MethodGetControlPointsOfNURBSCurve()  # -> out, CPoints; inputs crv: Curve; same code as methodgetcontrolpointsofnurbscurve
methodeveluatesurface_2 = MethodEveluateSurface()  # -> out, EvalPt, TanU, TanV; inputs srf: Surface, u: Double, v: Double; same code as methodeveluatesurface
m_16_returnsymetryplane_2 = M_16_ReturnSymetryPlane()  # -> out, symmetryPlane; inputs point1: Point3d, point2: Point3d, point3: Point3d; same code as m_16_returnsymetryplane
f_11_foreachloop_2 = F_11_ForeachLoop()  # -> out, multiplied; inputs numList: list of Double, multiplier: Double; same code as l_02_foreachloop
l_02_foreachloop_3 = L_02_ForeachLoop()  # -> out, multiplied; inputs numList: list of Double, multiplier: Double; same code as l_02_foreachloop
f_04_breakcontinueloopwithcomponentmessa_2 = F_04_BreakContinueLoopWithComponentMessage()  # -> out; inputs iterations: Int32, smallerThan: Int32; same code as f_04_breakcontinueloopwithcomponentmessa
l_04_randomnumbergenerator_3 = L_04_RandomNumberGenerator()  # -> out, numbers; inputs min: Double, max: Double, count: Int32, seed: Int32; same code as l_04_randomnumbergenerator
k_06_gripof3dpoints_nestedloops_2 = K_06_GripOf3DPointsNestedLoops()  # -> out, ptGrid; inputs x: Int32, y: Int32, z: Int32, spacing: Double; same code as k_06_gripof3dpoints_nestedloops
p_02_numbersorting_2 = P_02_NumberSorting()  # -> out, sorted; inputs intList: list of Int32; same code as p_02_numbersorting
k_05_series_2 = K_05_Series()  # -> out, S; inputs start: Int32, step: Int32, count: Int32; same code as k_05_series
k_06_range_2 = K_06_Range()  # -> out, R; inputs start: Double, end: Double, steps: Int32; same code as k_06_range
m_17_arrayfromstartendvalues_2 = M_17_ArrayFromStartEndValues()  # -> out, A; inputs start: Int32, end: Int32; same code as m_17_arrayfromstartendvalues
l_05_list3dpointandrandomclass_2 = L_05_List3DPointAndRandomClass()  # -> out, points; inputs height: Int32, spacing: Double, amplitude: Double, seed: Int32; same code as l_05_list3dpointandrandomclass

gene_pool_3 = GenePool(Decimals=2, Maximum=10, Minimum=0, Value=[3.57, 10, 5.3])

point_6 = Point(Point(-5.172161205, -8.205000366, -3.448154012))
point_7 = Point(Point(7.330210056, 4.05923049, 3.266672222))
point_8 = Point(Point(11.27765677, -6.657087734, -5.353712808))
point_9 = Point(Point(-5.172161205, -8.205000366, -3.448154012))

point_10 = Point(Point(-5.172161205, -8.205000366, -3.448154012))
point_11 = Point(Point(7.330210056, 4.05923049, 3.266672222))
point_12 = Point(Point(-5.172161205, -8.205000366, -3.448154012))
point_13 = Point(Point(11.27765677, -6.657087734, -5.353712808))

point_14 = Point()
point_15 = Point()
point_16 = Point()
point_17 = Point()

merge = Merge(Data1=point_11, Data2=point_13, Data3=point_12, Data4=point_10)
vector_xyz = VectorXYZ(XComponent=gene_pool_3, YComponent=gene_pool_3, ZComponent=gene_pool_3)  # -> Vector, Length

point_18 = Point()
point_19 = Point()
point_20 = Point()
point_21 = Point()

# ----
# 009
constructnumtree_3 = ConstructTreeOfNumbers()  # -> out, Numbers; inputs branchNum: Int32, countNum: Int32, number: Int32; same code as constructnumtree
methodpointtransformx_3 = MethodPointTransformX()  # -> out, Point; inputs pt: Point3d, xform: Transform; same code as methodpointtransformx
operatoraddtwopoints_3 = OperatorAddTwoPoints()  # -> out, Point; inputs pt1: Point3d, pt2: Point3d; same code as operatoraddtwopoints
getpointcoordinates_4 = GetPointCoordinates()  # -> out, A, B, C; inputs pt: Point3d; same code as getpointcoordinates
getoriginpoint_4 = GetOriginPoint()  # -> out, Origin; same code as getoriginpoint

point_22 = Point()
point_23 = Point()
point_24 = Point()
point_25 = Point()

# ----
# 009
constructnumtree_4 = ConstructTreeOfNumbers()  # -> out, Numbers; inputs branchNum: Int32, countNum: Int32, number: Int32; same code as constructnumtree
methodpointtransformx_4 = MethodPointTransformX()  # -> out, Point; inputs pt: Point3d, xform: Transform; same code as methodpointtransformx
operatoraddtwopoints_4 = OperatorAddTwoPoints()  # -> out, Point; inputs pt1: Point3d, pt2: Point3d; same code as operatoraddtwopoints
getpointcoordinates_5 = GetPointCoordinates()  # -> out, A, B, C; inputs pt: Point3d; same code as getpointcoordinates
getoriginpoint_5 = GetOriginPoint()  # -> out, Origin; same code as getoriginpoint

constructnumtree_5 = ConstructTreeOfNumbers()  # -> out, Numbers; inputs branchNum: Int32, countNum: Int32, number: Int32; same code as constructnumtree
methodpointtransformx_5 = MethodPointTransformX()  # -> out, Point; inputs pt: Point3d, xform: Transform; same code as methodpointtransformx
operatoraddtwopoints_5 = OperatorAddTwoPoints()  # -> out, Point; inputs pt1: Point3d, pt2: Point3d; same code as operatoraddtwopoints
getpointcoordinates_6 = GetPointCoordinates()  # -> out, A, B, C; inputs pt: Point3d; same code as getpointcoordinates
getoriginpoint_6 = GetOriginPoint()  # -> out, Origin; same code as getoriginpoint

list_item = ListItem(List=vector_xyz.Vector, Index=Slider(2, range=0..2), Wrap=True)
# 009
gene_pool_4 = GenePool(Decimals=0, Maximum=10, Minimum=0, Value=[1.895979159, 4.103441306, 3.903749648, 1.732849223, 5.136153174])
gene_pool_5 = GenePool(Decimals=0, Maximum=10, Minimum=0, Value=[9.142099539, 9.028582922, 3.527939121, 2.061750452, 6.646468405])
gene_pool_6 = GenePool(Decimals=0, Maximum=10, Minimum=0, Value=[0.1446648455, 6.790194747, 8.164573288, 4.119161979, 5.891806528])

l_04_randomnumbergenerator_4 = L_04_RandomNumberGenerator()  # -> out, numbers; inputs min: Double, max: Double, count: Int32, seed: Int32; same code as l_04_randomnumbergenerator
m_16_returnsymetryplane_3 = M_16_ReturnSymetryPlane()  # -> out, symmetryPlane; inputs point1: Point3d, point2: Point3d, point3: Point3d; same code as m_16_returnsymetryplane
f_11_foreachloop_3 = F_11_ForeachLoop()  # -> out, multiplied; inputs numList: list of Double, multiplier: Double; same code as l_02_foreachloop
l_02_foreachloop_4 = L_02_ForeachLoop()  # -> out, multiplied; inputs numList: list of Double, multiplier: Double; same code as l_02_foreachloop
l_05_list3dpointandrandomclass_3 = L_05_List3DPointAndRandomClass()  # -> out, points; inputs height: Int32, spacing: Double, amplitude: Double, seed: Int32; same code as l_05_list3dpointandrandomclass
# FIRST GENERATION:
# PLAYFUL AND EXPERIMENTAL
f_04_breakcontinueloopwithcomponentmessa_3 = F_04_BreakContinueLoopWithComponentMessage()  # -> out; inputs iterations: Int32, smallerThan: Int32; same code as f_04_breakcontinueloopwithcomponentmessa
p_02_numbersorting_3 = P_02_NumberSorting()  # -> out, sorted; inputs intList: list of Int32; same code as p_02_numbersorting
k_05_series_3 = K_05_Series()  # -> out, S; inputs start: Int32, step: Int32, count: Int32; same code as k_05_series
k_06_range_3 = K_06_Range()  # -> out, R; inputs start: Double, end: Double, steps: Int32; same code as k_06_range
m_17_arrayfromstartendvalues_3 = M_17_ArrayFromStartEndValues()  # -> out, A; inputs start: Int32, end: Int32; same code as m_17_arrayfromstartendvalues

move = Move(Geometry=list_item, Motion=vector_xyz.Vector)  # -> Geometry, Transform

l_04_randomnumbergenerator_5 = L_04_RandomNumberGenerator()  # -> out, numbers; inputs min: Double, max: Double, count: Int32, seed: Int32; same code as l_04_randomnumbergenerator
# 009
# FIRST GENERATION:
# PLAYFUL AND EXPERIMENTAL
m_16_returnsymetryplane_4 = M_16_ReturnSymetryPlane()  # -> out, symmetryPlane; inputs point1: Point3d, point2: Point3d, point3: Point3d; same code as m_16_returnsymetryplane
f_11_foreachloop_4 = F_11_ForeachLoop()  # -> out, multiplied; inputs numList: list of Double, multiplier: Double; same code as l_02_foreachloop
l_02_foreachloop_5 = L_02_ForeachLoop()  # -> out, multiplied; inputs numList: list of Double, multiplier: Double; same code as l_02_foreachloop
l_05_list3dpointandrandomclass_4 = L_05_List3DPointAndRandomClass()  # -> out, points; inputs height: Int32, spacing: Double, amplitude: Double, seed: Int32; same code as l_05_list3dpointandrandomclass
# FIRST GENERATION:
# PLAYFUL AND EXPERIMENTAL
f_04_breakcontinueloopwithcomponentmessa_4 = F_04_BreakContinueLoopWithComponentMessage()  # -> out; inputs iterations: Int32, smallerThan: Int32; same code as f_04_breakcontinueloopwithcomponentmessa
p_02_numbersorting_4 = P_02_NumberSorting()  # -> out, sorted; inputs intList: list of Int32; same code as p_02_numbersorting
k_05_series_4 = K_05_Series()  # -> out, S; inputs start: Int32, step: Int32, count: Int32; same code as k_05_series
k_06_range_4 = K_06_Range()  # -> out, R; inputs start: Double, end: Double, steps: Int32; same code as k_06_range
m_17_arrayfromstartendvalues_4 = M_17_ArrayFromStartEndValues()  # -> out, A; inputs start: Int32, end: Int32; same code as m_17_arrayfromstartendvalues

l_04_randomnumbergenerator_6 = L_04_RandomNumberGenerator()  # -> out, numbers; inputs min: Double, max: Double, count: Int32, seed: Int32; same code as l_04_randomnumbergenerator
m_16_returnsymetryplane_5 = M_16_ReturnSymetryPlane()  # -> out, symmetryPlane; inputs point1: Point3d, point2: Point3d, point3: Point3d; same code as m_16_returnsymetryplane
f_11_foreachloop_5 = F_11_ForeachLoop()  # -> out, multiplied; inputs numList: list of Double, multiplier: Double; same code as l_02_foreachloop
l_02_foreachloop_6 = L_02_ForeachLoop()  # -> out, multiplied; inputs numList: list of Double, multiplier: Double; same code as l_02_foreachloop
l_05_list3dpointandrandomclass_5 = L_05_List3DPointAndRandomClass()  # -> out, points; inputs height: Int32, spacing: Double, amplitude: Double, seed: Int32; same code as l_05_list3dpointandrandomclass
f_04_breakcontinueloopwithcomponentmessa_5 = F_04_BreakContinueLoopWithComponentMessage()  # -> out; inputs iterations: Int32, smallerThan: Int32; same code as f_04_breakcontinueloopwithcomponentmessa
p_02_numbersorting_5 = P_02_NumberSorting()  # -> out, sorted; inputs intList: list of Int32; same code as p_02_numbersorting
k_05_series_5 = K_05_Series()  # -> out, S; inputs start: Int32, step: Int32, count: Int32; same code as k_05_series
k_06_range_5 = K_06_Range()  # -> out, R; inputs start: Double, end: Double, steps: Int32; same code as k_06_range
m_17_arrayfromstartendvalues_5 = M_17_ArrayFromStartEndValues()  # -> out, A; inputs start: Int32, end: Int32; same code as m_17_arrayfromstartendvalues

vector_xyz_2 = VectorXYZ(XComponent=0, YComponent=0, ZComponent=0)  # -> Vector, Length
methodpointdistance_3 = MethodPointDistance()  # -> out, Point, Distance; inputs x: Double, y: Double, z: Double, other: Point3d; same code as methodpointdistance
checkprimeandfactors_3 = CheckPrimeAndFactors()  # -> out, IsPrime, Factors; inputs num: Int32; same code as checkprimeandfactors
createpointintializexyz_5 = CreatePointIntializeXYZ()  # -> out, Point; inputs x: Double, y: Double, z: Double; same code as createpointintializexyz
sumtreenum_3 = FindSumOfNumbersInTree()  # -> out, Sum; inputs x: tree of Double; same code as sumtreenum

constructnumtree_6 = ConstructTreeOfNumbers(branchNum=gene_pool_4, countNum=gene_pool_5, number=gene_pool_6)  # -> out, Numbers; inputs branchNum: Int32, countNum: Int32, number: Int32; same code as constructnumtree
methodpointtransformx_6 = MethodPointTransformX(pt=merge, xform=move.Transform)  # -> out, Point; inputs pt: Point3d, xform: Transform; same code as methodpointtransformx
operatoraddtwopoints_6 = OperatorAddTwoPoints(pt1=point_11, pt2=point_13)  # -> out, Point; inputs pt1: Point3d, pt2: Point3d; same code as operatoraddtwopoints
getoriginpoint_7 = GetOriginPoint()  # -> out, Origin; same code as getoriginpoint
getpointcoordinates_7 = GetPointCoordinates(pt=merge)  # -> out, A, B, C; inputs pt: Point3d; same code as getpointcoordinates

vector_xyz_3 = VectorXYZ(XComponent=0, YComponent=0, ZComponent=0)  # -> Vector, Length
methodpointdistance_4 = MethodPointDistance()  # -> out, Point, Distance; inputs x: Double, y: Double, z: Double, other: Point3d; same code as methodpointdistance
checkprimeandfactors_4 = CheckPrimeAndFactors()  # -> out, IsPrime, Factors; inputs num: Int32; same code as checkprimeandfactors
createpointintializexyz_6 = CreatePointIntializeXYZ()  # -> out, Point; inputs x: Double, y: Double, z: Double; same code as createpointintializexyz
sumtreenum_4 = FindSumOfNumbersInTree()  # -> out, Sum; inputs x: tree of Double; same code as sumtreenum

vector_xyz_4 = VectorXYZ(XComponent=0, YComponent=0, ZComponent=0)  # -> Vector, Length
methodpointdistance_5 = MethodPointDistance()  # -> out, Point, Distance; inputs x: Double, y: Double, z: Double, other: Point3d; same code as methodpointdistance
checkprimeandfactors_5 = CheckPrimeAndFactors()  # -> out, IsPrime, Factors; inputs num: Int32; same code as checkprimeandfactors
createpointintializexyz_7 = CreatePointIntializeXYZ()  # -> out, Point; inputs x: Double, y: Double, z: Double; same code as createpointintializexyz
sumtreenum_5 = FindSumOfNumbersInTree()  # -> out, Sum; inputs x: tree of Double; same code as sumtreenum

l_04_randomnumbergenerator_7 = L_04_RandomNumberGenerator()  # -> out, numbers; inputs min: Double, max: Double, count: Int32, seed: Int32; same code as l_04_randomnumbergenerator
m_16_returnsymetryplane_6 = M_16_ReturnSymetryPlane()  # -> out, symmetryPlane; inputs point1: Point3d, point2: Point3d, point3: Point3d; same code as m_16_returnsymetryplane
f_11_foreachloop_6 = F_11_ForeachLoop()  # -> out, multiplied; inputs numList: list of Double, multiplier: Double; same code as l_02_foreachloop
l_02_foreachloop_7 = L_02_ForeachLoop()  # -> out, multiplied; inputs numList: list of Double, multiplier: Double; same code as l_02_foreachloop
l_05_list3dpointandrandomclass_6 = L_05_List3DPointAndRandomClass()  # -> out, points; inputs height: Int32, spacing: Double, amplitude: Double, seed: Int32; same code as l_05_list3dpointandrandomclass
f_04_breakcontinueloopwithcomponentmessa_6 = F_04_BreakContinueLoopWithComponentMessage()  # -> out; inputs iterations: Int32, smallerThan: Int32; same code as f_04_breakcontinueloopwithcomponentmessa
p_02_numbersorting_6 = P_02_NumberSorting()  # -> out, sorted; inputs intList: list of Int32; same code as p_02_numbersorting
k_05_series_6 = K_05_Series()  # -> out, S; inputs start: Int32, step: Int32, count: Int32; same code as k_05_series
k_06_range_6 = K_06_Range()  # -> out, R; inputs start: Double, end: Double, steps: Int32; same code as k_06_range
m_17_arrayfromstartendvalues_6 = M_17_ArrayFromStartEndValues()  # -> out, A; inputs start: Int32, end: Int32; same code as m_17_arrayfromstartendvalues

panel_6 = Panel(methodpointtransformx_6.Point)

l_04_randomnumbergenerator_8 = L_04_RandomNumberGenerator()  # -> out, numbers; inputs min: Double, max: Double, count: Int32, seed: Int32; same code as l_04_randomnumbergenerator
m_16_returnsymetryplane_7 = M_16_ReturnSymetryPlane()  # -> out, symmetryPlane; inputs point1: Point3d, point2: Point3d, point3: Point3d; same code as m_16_returnsymetryplane
f_11_foreachloop_7 = F_11_ForeachLoop()  # -> out, multiplied; inputs numList: list of Double, multiplier: Double; same code as l_02_foreachloop
l_02_foreachloop_8 = L_02_ForeachLoop()  # -> out, multiplied; inputs numList: list of Double, multiplier: Double; same code as l_02_foreachloop
l_05_list3dpointandrandomclass_7 = L_05_List3DPointAndRandomClass()  # -> out, points; inputs height: Int32, spacing: Double, amplitude: Double, seed: Int32; same code as l_05_list3dpointandrandomclass
f_04_breakcontinueloopwithcomponentmessa_7 = F_04_BreakContinueLoopWithComponentMessage()  # -> out; inputs iterations: Int32, smallerThan: Int32; same code as f_04_breakcontinueloopwithcomponentmessa
p_02_numbersorting_7 = P_02_NumberSorting()  # -> out, sorted; inputs intList: list of Int32; same code as p_02_numbersorting
k_05_series_7 = K_05_Series()  # -> out, S; inputs start: Int32, step: Int32, count: Int32; same code as k_05_series
k_06_range_7 = K_06_Range()  # -> out, R; inputs start: Double, end: Double, steps: Int32; same code as k_06_range
m_17_arrayfromstartendvalues_7 = M_17_ArrayFromStartEndValues()  # -> out, A; inputs start: Int32, end: Int32; same code as m_17_arrayfromstartendvalues

number_slider_18 = Slider(26, range=0..100)
absolute = Absolute(Value=getpointcoordinates_7.A)

l_04_randomnumbergenerator_9 = L_04_RandomNumberGenerator()  # -> out, numbers; inputs min: Double, max: Double, count: Int32, seed: Int32; same code as l_04_randomnumbergenerator
m_16_returnsymetryplane_8 = M_16_ReturnSymetryPlane()  # -> out, symmetryPlane; inputs point1: Point3d, point2: Point3d, point3: Point3d; same code as m_16_returnsymetryplane
f_11_foreachloop_8 = F_11_ForeachLoop()  # -> out, multiplied; inputs numList: list of Double, multiplier: Double; same code as l_02_foreachloop
l_02_foreachloop_9 = L_02_ForeachLoop()  # -> out, multiplied; inputs numList: list of Double, multiplier: Double; same code as l_02_foreachloop
l_05_list3dpointandrandomclass_8 = L_05_List3DPointAndRandomClass()  # -> out, points; inputs height: Int32, spacing: Double, amplitude: Double, seed: Int32; same code as l_05_list3dpointandrandomclass
f_04_breakcontinueloopwithcomponentmessa_8 = F_04_BreakContinueLoopWithComponentMessage()  # -> out; inputs iterations: Int32, smallerThan: Int32; same code as f_04_breakcontinueloopwithcomponentmessa
p_02_numbersorting_8 = P_02_NumberSorting()  # -> out, sorted; inputs intList: list of Int32; same code as p_02_numbersorting
k_05_series_8 = K_05_Series()  # -> out, S; inputs start: Int32, step: Int32, count: Int32; same code as k_05_series
k_06_range_8 = K_06_Range()  # -> out, R; inputs start: Double, end: Double, steps: Int32; same code as k_06_range
m_17_arrayfromstartendvalues_8 = M_17_ArrayFromStartEndValues()  # -> out, A; inputs start: Int32, end: Int32; same code as m_17_arrayfromstartendvalues

# ----
# SECOND GENERATION:
# PLAYFUL AND EXPERIMENTAL
panel_7 = Panel(constructnumtree_6.Numbers)
list_item_2 = ListItem(List=constructnumtree_6.Numbers, Index="3", Wrap=True)

k_06_gripof3dpoints_nestedloops_3 = K_06_GripOf3DPointsNestedLoops()  # -> out, ptGrid; inputs x: Int32, y: Int32, z: Int32, spacing: Double; same code as k_06_gripof3dpoints_nestedloops
operatorsvectors_3 = OperatorsVectors()  # -> out, Pt0, Pt1, Vec0, Vec1, AddVec, SubtractVec, DotVec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; same code as operatorsvectors

k_06_gripof3dpoints_nestedloops_4 = K_06_GripOf3DPointsNestedLoops()  # -> out, ptGrid; inputs x: Int32, y: Int32, z: Int32, spacing: Double; same code as k_06_gripof3dpoints_nestedloops
operatorsvectors_4 = OperatorsVectors()  # -> out, Pt0, Pt1, Vec0, Vec1, AddVec, SubtractVec, DotVec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; same code as operatorsvectors

k_06_gripof3dpoints_nestedloops_5 = K_06_GripOf3DPointsNestedLoops()  # -> out, ptGrid; inputs x: Int32, y: Int32, z: Int32, spacing: Double; same code as k_06_gripof3dpoints_nestedloops
operatorsvectors_5 = OperatorsVectors()  # -> out, Pt0, Pt1, Vec0, Vec1, AddVec, SubtractVec, DotVec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; same code as operatorsvectors

m_16_returnsymetryplane_9 = M_16_ReturnSymetryPlane()  # -> out, symmetryPlane; inputs point1: Point3d, point2: Point3d, point3: Point3d; same code as m_16_returnsymetryplane
f_11_foreachloop_9 = F_11_ForeachLoop()  # -> out, multiplied; inputs numList: list of Double, multiplier: Double; same code as l_02_foreachloop
l_02_foreachloop_10 = L_02_ForeachLoop()  # -> out, multiplied; inputs numList: list of Double, multiplier: Double; same code as l_02_foreachloop
l_05_list3dpointandrandomclass_9 = L_05_List3DPointAndRandomClass()  # -> out, points; inputs height: Int32, spacing: Double, amplitude: Double, seed: Int32; same code as l_05_list3dpointandrandomclass
f_04_breakcontinueloopwithcomponentmessa_9 = F_04_BreakContinueLoopWithComponentMessage()  # -> out; inputs iterations: Int32, smallerThan: Int32; same code as f_04_breakcontinueloopwithcomponentmessa
l_04_randomnumbergenerator_10 = L_04_RandomNumberGenerator()  # -> out, numbers; inputs min: Double, max: Double, count: Int32, seed: Int32; same code as l_04_randomnumbergenerator
p_02_numbersorting_9 = P_02_NumberSorting()  # -> out, sorted; inputs intList: list of Int32; same code as p_02_numbersorting
k_05_series_9 = K_05_Series()  # -> out, S; inputs start: Int32, step: Int32, count: Int32; same code as k_05_series
k_06_range_9 = K_06_Range()  # -> out, R; inputs start: Double, end: Double, steps: Int32; same code as k_06_range
m_17_arrayfromstartendvalues_9 = M_17_ArrayFromStartEndValues()  # -> out, A; inputs start: Int32, end: Int32; same code as m_17_arrayfromstartendvalues

l_04_randomnumbergenerator_11 = L_04_RandomNumberGenerator(min=constructnumtree_6.Numbers, max=list_item_2, count="3", seed=number_slider_18)  # -> out, numbers; inputs min: Double, max: Double, count: Int32, seed: Int32; same code as l_04_randomnumbergenerator
m_16_returnsymetryplane_10 = M_16_ReturnSymetryPlane(point1=methodpointtransformx_6.Point, point2=getoriginpoint_7.Origin, point3=operatoraddtwopoints_6.Point)  # -> out, symmetryPlane; inputs point1: Point3d, point2: Point3d, point3: Point3d; same code as m_16_returnsymetryplane
f_11_foreachloop_10 = F_11_ForeachLoop(numList=constructnumtree_6.Numbers, multiplier="3")  # -> out, multiplied; inputs numList: list of Double, multiplier: Double; same code as l_02_foreachloop
l_02_foreachloop_11 = L_02_ForeachLoop(numList=constructnumtree_6.Numbers, multiplier=list_item_2)  # -> out, multiplied; inputs numList: list of Double, multiplier: Double; same code as l_02_foreachloop
l_05_list3dpointandrandomclass_10 = L_05_List3DPointAndRandomClass(height=absolute, spacing=getpointcoordinates_7.B, amplitude=getpointcoordinates_7.C, seed=number_slider_18)  # -> out, points; inputs height: Int32, spacing: Double, amplitude: Double, seed: Int32; same code as l_05_list3dpointandrandomclass
f_04_breakcontinueloopwithcomponentmessa_10 = F_04_BreakContinueLoopWithComponentMessage(iterations=constructnumtree_6.Numbers, smallerThan=list_item_2)  # -> out; inputs iterations: Int32, smallerThan: Int32; same code as f_04_breakcontinueloopwithcomponentmessa
p_02_numbersorting_10 = P_02_NumberSorting(intList=constructnumtree_6.Numbers)  # -> out, sorted; inputs intList: list of Int32; same code as p_02_numbersorting
k_05_series_10 = K_05_Series(start=list_item_2, step=list_item_2, count=list_item_2)  # -> out, S; inputs start: Int32, step: Int32, count: Int32; same code as k_05_series
k_06_range_10 = K_06_Range(start=getpointcoordinates_7.A, end=getpointcoordinates_7.B, steps="3")  # -> out, R; inputs start: Double, end: Double, steps: Int32; same code as k_06_range
m_17_arrayfromstartendvalues_10 = M_17_ArrayFromStartEndValues(start=methodpointtransformx_6.Point, end=operatoraddtwopoints_6.Point)  # -> out, A; inputs start: Int32, end: Int32; same code as m_17_arrayfromstartendvalues

m_16_returnsymetryplane_11 = M_16_ReturnSymetryPlane()  # -> out, symmetryPlane; inputs point1: Point3d, point2: Point3d, point3: Point3d; same code as m_16_returnsymetryplane
f_11_foreachloop_11 = F_11_ForeachLoop()  # -> out, multiplied; inputs numList: list of Double, multiplier: Double; same code as l_02_foreachloop
l_02_foreachloop_12 = L_02_ForeachLoop()  # -> out, multiplied; inputs numList: list of Double, multiplier: Double; same code as l_02_foreachloop
l_05_list3dpointandrandomclass_11 = L_05_List3DPointAndRandomClass()  # -> out, points; inputs height: Int32, spacing: Double, amplitude: Double, seed: Int32; same code as l_05_list3dpointandrandomclass
f_04_breakcontinueloopwithcomponentmessa_11 = F_04_BreakContinueLoopWithComponentMessage()  # -> out; inputs iterations: Int32, smallerThan: Int32; same code as f_04_breakcontinueloopwithcomponentmessa
l_04_randomnumbergenerator_12 = L_04_RandomNumberGenerator()  # -> out, numbers; inputs min: Double, max: Double, count: Int32, seed: Int32; same code as l_04_randomnumbergenerator
p_02_numbersorting_11 = P_02_NumberSorting()  # -> out, sorted; inputs intList: list of Int32; same code as p_02_numbersorting
k_05_series_11 = K_05_Series()  # -> out, S; inputs start: Int32, step: Int32, count: Int32; same code as k_05_series
k_06_range_11 = K_06_Range()  # -> out, R; inputs start: Double, end: Double, steps: Int32; same code as k_06_range
m_17_arrayfromstartendvalues_11 = M_17_ArrayFromStartEndValues()  # -> out, A; inputs start: Int32, end: Int32; same code as m_17_arrayfromstartendvalues

m_16_returnsymetryplane_12 = M_16_ReturnSymetryPlane()  # -> out, symmetryPlane; inputs point1: Point3d, point2: Point3d, point3: Point3d; same code as m_16_returnsymetryplane
f_11_foreachloop_12 = F_11_ForeachLoop()  # -> out, multiplied; inputs numList: list of Double, multiplier: Double; same code as l_02_foreachloop
l_02_foreachloop_13 = L_02_ForeachLoop()  # -> out, multiplied; inputs numList: list of Double, multiplier: Double; same code as l_02_foreachloop
l_05_list3dpointandrandomclass_12 = L_05_List3DPointAndRandomClass()  # -> out, points; inputs height: Int32, spacing: Double, amplitude: Double, seed: Int32; same code as l_05_list3dpointandrandomclass
f_04_breakcontinueloopwithcomponentmessa_12 = F_04_BreakContinueLoopWithComponentMessage()  # -> out; inputs iterations: Int32, smallerThan: Int32; same code as f_04_breakcontinueloopwithcomponentmessa
l_04_randomnumbergenerator_13 = L_04_RandomNumberGenerator()  # -> out, numbers; inputs min: Double, max: Double, count: Int32, seed: Int32; same code as l_04_randomnumbergenerator
p_02_numbersorting_12 = P_02_NumberSorting()  # -> out, sorted; inputs intList: list of Int32; same code as p_02_numbersorting
k_05_series_12 = K_05_Series()  # -> out, S; inputs start: Int32, step: Int32, count: Int32; same code as k_05_series
k_06_range_12 = K_06_Range()  # -> out, R; inputs start: Double, end: Double, steps: Int32; same code as k_06_range
m_17_arrayfromstartendvalues_12 = M_17_ArrayFromStartEndValues()  # -> out, A; inputs start: Int32, end: Int32; same code as m_17_arrayfromstartendvalues

panel_8 = Panel(l_05_list3dpointandrandomclass_10.points)

classcreatenewnurbscurve_3 = ClassCreateNewNURBSCurve()  # -> out, InterpolateCrv, NurbsCrv; inputs points: list of Point3d, degree: Int32; same code as classcreatenewnurbscurve
classcreatepolylinefrompoints_3 = ClassCreatePolylineFromPoints()  # -> out, Crv, Type; inputs pts: list of Point3d; same code as classcreatepolylinefrompoints

interpolate = Interpolate(Vertices=l_05_list3dpointandrandomclass_10.points, Degree=3, Periodic=False, KnotStyle=1)  # -> Curve, Length, Domain
panel_9 = Panel(l_04_randomnumbergenerator_11.numbers)

classcreatenewnurbscurve_4 = ClassCreateNewNURBSCurve()  # -> out, InterpolateCrv, NurbsCrv; inputs points: list of Point3d, degree: Int32; same code as classcreatenewnurbscurve
classcreatepolylinefrompoints_4 = ClassCreatePolylineFromPoints()  # -> out, Crv, Type; inputs pts: list of Point3d; same code as classcreatepolylinefrompoints

classcreatenewnurbscurve_5 = ClassCreateNewNURBSCurve()  # -> out, InterpolateCrv, NurbsCrv; inputs points: list of Point3d, degree: Int32; same code as classcreatenewnurbscurve
classcreatepolylinefrompoints_5 = ClassCreatePolylineFromPoints()  # -> out, Crv, Type; inputs pts: list of Point3d; same code as classcreatepolylinefrompoints

cull_index = CullIndex(List=flatten(interpolate.Curve), Indices="-1", Wrap=True)
point_26 = Point(l_05_list3dpointandrandomclass_10.points)

m_16_returnsymetryplane_13 = M_16_ReturnSymetryPlane()  # -> out, symmetryPlane; inputs point1: Point3d, point2: Point3d, point3: Point3d; same code as m_16_returnsymetryplane
f_11_foreachloop_13 = F_11_ForeachLoop()  # -> out, multiplied; inputs numList: list of Double, multiplier: Double; same code as l_02_foreachloop
l_02_foreachloop_14 = L_02_ForeachLoop()  # -> out, multiplied; inputs numList: list of Double, multiplier: Double; same code as l_02_foreachloop
l_05_list3dpointandrandomclass_13 = L_05_List3DPointAndRandomClass()  # -> out, points; inputs height: Int32, spacing: Double, amplitude: Double, seed: Int32; same code as l_05_list3dpointandrandomclass
f_04_breakcontinueloopwithcomponentmessa_13 = F_04_BreakContinueLoopWithComponentMessage()  # -> out; inputs iterations: Int32, smallerThan: Int32; same code as f_04_breakcontinueloopwithcomponentmessa
l_04_randomnumbergenerator_14 = L_04_RandomNumberGenerator()  # -> out, numbers; inputs min: Double, max: Double, count: Int32, seed: Int32; same code as l_04_randomnumbergenerator
p_02_numbersorting_13 = P_02_NumberSorting()  # -> out, sorted; inputs intList: list of Int32; same code as p_02_numbersorting
k_05_series_13 = K_05_Series()  # -> out, S; inputs start: Int32, step: Int32, count: Int32; same code as k_05_series
k_06_range_13 = K_06_Range()  # -> out, R; inputs start: Double, end: Double, steps: Int32; same code as k_06_range
m_17_arrayfromstartendvalues_13 = M_17_ArrayFromStartEndValues()  # -> out, A; inputs start: Int32, end: Int32; same code as m_17_arrayfromstartendvalues

cull_index_2 = CullIndex(List=flatten(point_26), Indices="-1", Wrap=True)
pipe = Pipe(Curve=cull_index, Radius=1, Caps=0)

m_16_returnsymetryplane_14 = M_16_ReturnSymetryPlane()  # -> out, symmetryPlane; inputs point1: Point3d, point2: Point3d, point3: Point3d; same code as m_16_returnsymetryplane
f_11_foreachloop_14 = F_11_ForeachLoop()  # -> out, multiplied; inputs numList: list of Double, multiplier: Double; same code as l_02_foreachloop
l_02_foreachloop_15 = L_02_ForeachLoop()  # -> out, multiplied; inputs numList: list of Double, multiplier: Double; same code as l_02_foreachloop
l_05_list3dpointandrandomclass_14 = L_05_List3DPointAndRandomClass()  # -> out, points; inputs height: Int32, spacing: Double, amplitude: Double, seed: Int32; same code as l_05_list3dpointandrandomclass
f_04_breakcontinueloopwithcomponentmessa_14 = F_04_BreakContinueLoopWithComponentMessage()  # -> out; inputs iterations: Int32, smallerThan: Int32; same code as f_04_breakcontinueloopwithcomponentmessa
l_04_randomnumbergenerator_15 = L_04_RandomNumberGenerator()  # -> out, numbers; inputs min: Double, max: Double, count: Int32, seed: Int32; same code as l_04_randomnumbergenerator
p_02_numbersorting_14 = P_02_NumberSorting()  # -> out, sorted; inputs intList: list of Int32; same code as p_02_numbersorting
k_05_series_14 = K_05_Series()  # -> out, S; inputs start: Int32, step: Int32, count: Int32; same code as k_05_series
k_06_range_14 = K_06_Range()  # -> out, R; inputs start: Double, end: Double, steps: Int32; same code as k_06_range
m_17_arrayfromstartendvalues_14 = M_17_ArrayFromStartEndValues()  # -> out, A; inputs start: Int32, end: Int32; same code as m_17_arrayfromstartendvalues

m_16_returnsymetryplane_15 = M_16_ReturnSymetryPlane()  # -> out, symmetryPlane; inputs point1: Point3d, point2: Point3d, point3: Point3d; same code as m_16_returnsymetryplane
f_11_foreachloop_15 = F_11_ForeachLoop()  # -> out, multiplied; inputs numList: list of Double, multiplier: Double; same code as l_02_foreachloop
l_02_foreachloop_16 = L_02_ForeachLoop()  # -> out, multiplied; inputs numList: list of Double, multiplier: Double; same code as l_02_foreachloop
l_05_list3dpointandrandomclass_15 = L_05_List3DPointAndRandomClass()  # -> out, points; inputs height: Int32, spacing: Double, amplitude: Double, seed: Int32; same code as l_05_list3dpointandrandomclass
f_04_breakcontinueloopwithcomponentmessa_15 = F_04_BreakContinueLoopWithComponentMessage()  # -> out; inputs iterations: Int32, smallerThan: Int32; same code as f_04_breakcontinueloopwithcomponentmessa
l_04_randomnumbergenerator_16 = L_04_RandomNumberGenerator()  # -> out, numbers; inputs min: Double, max: Double, count: Int32, seed: Int32; same code as l_04_randomnumbergenerator
p_02_numbersorting_15 = P_02_NumberSorting()  # -> out, sorted; inputs intList: list of Int32; same code as p_02_numbersorting
k_05_series_15 = K_05_Series()  # -> out, S; inputs start: Int32, step: Int32, count: Int32; same code as k_05_series
k_06_range_15 = K_06_Range()  # -> out, R; inputs start: Double, end: Double, steps: Int32; same code as k_06_range
m_17_arrayfromstartendvalues_15 = M_17_ArrayFromStartEndValues()  # -> out, A; inputs start: Int32, end: Int32; same code as m_17_arrayfromstartendvalues

getpointcoordinates_8 = GetPointCoordinates(pt=cull_index_2)  # -> out, A, B, C; inputs pt: Point3d; same code as getpointcoordinates

vector_xyz_5 = VectorXYZ(XComponent=0, YComponent=0, ZComponent=0)  # -> Vector, Length
methodpointdistance_6 = MethodPointDistance()  # -> out, Point, Distance; inputs x: Double, y: Double, z: Double, other: Point3d; same code as methodpointdistance
checkprimeandfactors_6 = CheckPrimeAndFactors()  # -> out, IsPrime, Factors; inputs num: Int32; same code as checkprimeandfactors
createpointintializexyz_8 = CreatePointIntializeXYZ()  # -> out, Point; inputs x: Double, y: Double, z: Double; same code as createpointintializexyz
sumtreenum_6 = FindSumOfNumbersInTree()  # -> out, Sum; inputs x: tree of Double; same code as sumtreenum

methodcreatecurveoffset_3 = MethodCreateCurveOffset()  # -> out, OffsetCrv; inputs crv: Curve, offset: Double; same code as methodcreatecurveoffset
methodcreatecurvesbetweentwocurves_3 = MethodCreateCurvesBetweenTwoCurves()  # -> out, Curves; inputs curve0: Curve, curve1: Curve, count: Int32; same code as methodcreatecurvesbetweentwocurves
methodgetcontrolpointsofnurbscurve_3 = MethodGetControlPointsOfNURBSCurve()  # -> out, CPoints; inputs crv: Curve; same code as methodgetcontrolpointsofnurbscurve

methodcreatecurveoffset_4 = MethodCreateCurveOffset()  # -> out, OffsetCrv; inputs crv: Curve, offset: Double; same code as methodcreatecurveoffset
methodcreatecurvesbetweentwocurves_4 = MethodCreateCurvesBetweenTwoCurves()  # -> out, Curves; inputs curve0: Curve, curve1: Curve, count: Int32; same code as methodcreatecurvesbetweentwocurves
methodgetcontrolpointsofnurbscurve_4 = MethodGetControlPointsOfNURBSCurve()  # -> out, CPoints; inputs crv: Curve; same code as methodgetcontrolpointsofnurbscurve

methodcreatecurveoffset_5 = MethodCreateCurveOffset()  # -> out, OffsetCrv; inputs crv: Curve, offset: Double; same code as methodcreatecurveoffset
methodcreatecurvesbetweentwocurves_5 = MethodCreateCurvesBetweenTwoCurves()  # -> out, Curves; inputs curve0: Curve, curve1: Curve, count: Int32; same code as methodcreatecurvesbetweentwocurves
methodgetcontrolpointsofnurbscurve_5 = MethodGetControlPointsOfNURBSCurve()  # -> out, CPoints; inputs crv: Curve; same code as methodgetcontrolpointsofnurbscurve

l_04_randomnumbergenerator_17 = L_04_RandomNumberGenerator()  # -> out, numbers; inputs min: Double, max: Double, count: Int32, seed: Int32; same code as l_04_randomnumbergenerator
m_16_returnsymetryplane_16 = M_16_ReturnSymetryPlane()  # -> out, symmetryPlane; inputs point1: Point3d, point2: Point3d, point3: Point3d; same code as m_16_returnsymetryplane
f_11_foreachloop_16 = F_11_ForeachLoop()  # -> out, multiplied; inputs numList: list of Double, multiplier: Double; same code as l_02_foreachloop
l_02_foreachloop_17 = L_02_ForeachLoop()  # -> out, multiplied; inputs numList: list of Double, multiplier: Double; same code as l_02_foreachloop
l_05_list3dpointandrandomclass_16 = L_05_List3DPointAndRandomClass()  # -> out, points; inputs height: Int32, spacing: Double, amplitude: Double, seed: Int32; same code as l_05_list3dpointandrandomclass
f_04_breakcontinueloopwithcomponentmessa_16 = F_04_BreakContinueLoopWithComponentMessage()  # -> out; inputs iterations: Int32, smallerThan: Int32; same code as f_04_breakcontinueloopwithcomponentmessa
p_02_numbersorting_16 = P_02_NumberSorting()  # -> out, sorted; inputs intList: list of Int32; same code as p_02_numbersorting
k_05_series_16 = K_05_Series()  # -> out, S; inputs start: Int32, step: Int32, count: Int32; same code as k_05_series
k_06_range_16 = K_06_Range()  # -> out, R; inputs start: Double, end: Double, steps: Int32; same code as k_06_range
m_17_arrayfromstartendvalues_16 = M_17_ArrayFromStartEndValues()  # -> out, A; inputs start: Int32, end: Int32; same code as m_17_arrayfromstartendvalues

m_16_returnsymetryplane_17 = M_16_ReturnSymetryPlane()  # -> out, symmetryPlane; inputs point1: Point3d, point2: Point3d, point3: Point3d; same code as m_16_returnsymetryplane
f_11_foreachloop_17 = F_11_ForeachLoop()  # -> out, multiplied; inputs numList: list of Double, multiplier: Double; same code as l_02_foreachloop
l_02_foreachloop_18 = L_02_ForeachLoop()  # -> out, multiplied; inputs numList: list of Double, multiplier: Double; same code as l_02_foreachloop
l_05_list3dpointandrandomclass_17 = L_05_List3DPointAndRandomClass()  # -> out, points; inputs height: Int32, spacing: Double, amplitude: Double, seed: Int32; same code as l_05_list3dpointandrandomclass
f_04_breakcontinueloopwithcomponentmessa_17 = F_04_BreakContinueLoopWithComponentMessage()  # -> out; inputs iterations: Int32, smallerThan: Int32; same code as f_04_breakcontinueloopwithcomponentmessa
l_04_randomnumbergenerator_18 = L_04_RandomNumberGenerator()  # -> out, numbers; inputs min: Double, max: Double, count: Int32, seed: Int32; same code as l_04_randomnumbergenerator
p_02_numbersorting_17 = P_02_NumberSorting()  # -> out, sorted; inputs intList: list of Int32; same code as p_02_numbersorting
k_05_series_17 = K_05_Series()  # -> out, S; inputs start: Int32, step: Int32, count: Int32; same code as k_05_series
k_06_range_17 = K_06_Range()  # -> out, R; inputs start: Double, end: Double, steps: Int32; same code as k_06_range
m_17_arrayfromstartendvalues_17 = M_17_ArrayFromStartEndValues()  # -> out, A; inputs start: Int32, end: Int32; same code as m_17_arrayfromstartendvalues

vector_xyz_6 = VectorXYZ(XComponent=getpointcoordinates_8.A, YComponent=getpointcoordinates_8.B, ZComponent=getpointcoordinates_8.C)  # -> Vector, Length
methodpointdistance_7 = MethodPointDistance(x=getpointcoordinates_8.A, y=getpointcoordinates_8.B, z=getpointcoordinates_8.C)  # -> out, Point, Distance; inputs x: Double, y: Double, z: Double, other: Point3d; same code as methodpointdistance
checkprimeandfactors_7 = CheckPrimeAndFactors(num=[getpointcoordinates_8.A, getpointcoordinates_8.B, getpointcoordinates_8.C])  # -> out, IsPrime, Factors; inputs num: Int32; same code as checkprimeandfactors
createpointintializexyz_9 = CreatePointIntializeXYZ(x=getpointcoordinates_8.A, y=getpointcoordinates_8.B, z=getpointcoordinates_8.C)  # -> out, Point; inputs x: Double, y: Double, z: Double; same code as createpointintializexyz
sumtreenum_7 = FindSumOfNumbersInTree(x=cull_index_2)  # -> out, Sum; inputs x: tree of Double; same code as sumtreenum

m_16_returnsymetryplane_18 = M_16_ReturnSymetryPlane()  # -> out, symmetryPlane; inputs point1: Point3d, point2: Point3d, point3: Point3d; same code as m_16_returnsymetryplane
f_11_foreachloop_18 = F_11_ForeachLoop()  # -> out, multiplied; inputs numList: list of Double, multiplier: Double; same code as l_02_foreachloop
l_02_foreachloop_19 = L_02_ForeachLoop()  # -> out, multiplied; inputs numList: list of Double, multiplier: Double; same code as l_02_foreachloop
l_05_list3dpointandrandomclass_18 = L_05_List3DPointAndRandomClass()  # -> out, points; inputs height: Int32, spacing: Double, amplitude: Double, seed: Int32; same code as l_05_list3dpointandrandomclass
f_04_breakcontinueloopwithcomponentmessa_18 = F_04_BreakContinueLoopWithComponentMessage()  # -> out; inputs iterations: Int32, smallerThan: Int32; same code as f_04_breakcontinueloopwithcomponentmessa
l_04_randomnumbergenerator_19 = L_04_RandomNumberGenerator()  # -> out, numbers; inputs min: Double, max: Double, count: Int32, seed: Int32; same code as l_04_randomnumbergenerator
p_02_numbersorting_18 = P_02_NumberSorting()  # -> out, sorted; inputs intList: list of Int32; same code as p_02_numbersorting
k_05_series_18 = K_05_Series()  # -> out, S; inputs start: Int32, step: Int32, count: Int32; same code as k_05_series
k_06_range_18 = K_06_Range()  # -> out, R; inputs start: Double, end: Double, steps: Int32; same code as k_06_range
m_17_arrayfromstartendvalues_18 = M_17_ArrayFromStartEndValues()  # -> out, A; inputs start: Int32, end: Int32; same code as m_17_arrayfromstartendvalues

m_16_returnsymetryplane_19 = M_16_ReturnSymetryPlane()  # -> out, symmetryPlane; inputs point1: Point3d, point2: Point3d, point3: Point3d; same code as m_16_returnsymetryplane
f_11_foreachloop_19 = F_11_ForeachLoop()  # -> out, multiplied; inputs numList: list of Double, multiplier: Double; same code as l_02_foreachloop
l_02_foreachloop_20 = L_02_ForeachLoop()  # -> out, multiplied; inputs numList: list of Double, multiplier: Double; same code as l_02_foreachloop
l_05_list3dpointandrandomclass_19 = L_05_List3DPointAndRandomClass()  # -> out, points; inputs height: Int32, spacing: Double, amplitude: Double, seed: Int32; same code as l_05_list3dpointandrandomclass
f_04_breakcontinueloopwithcomponentmessa_19 = F_04_BreakContinueLoopWithComponentMessage()  # -> out; inputs iterations: Int32, smallerThan: Int32; same code as f_04_breakcontinueloopwithcomponentmessa
l_04_randomnumbergenerator_20 = L_04_RandomNumberGenerator()  # -> out, numbers; inputs min: Double, max: Double, count: Int32, seed: Int32; same code as l_04_randomnumbergenerator
p_02_numbersorting_19 = P_02_NumberSorting()  # -> out, sorted; inputs intList: list of Int32; same code as p_02_numbersorting
k_05_series_19 = K_05_Series()  # -> out, S; inputs start: Int32, step: Int32, count: Int32; same code as k_05_series
k_06_range_19 = K_06_Range()  # -> out, R; inputs start: Double, end: Double, steps: Int32; same code as k_06_range
m_17_arrayfromstartendvalues_19 = M_17_ArrayFromStartEndValues()  # -> out, A; inputs start: Int32, end: Int32; same code as m_17_arrayfromstartendvalues

k_06_gripof3dpoints_nestedloops_6 = K_06_GripOf3DPointsNestedLoops()  # -> out, ptGrid; inputs x: Int32, y: Int32, z: Int32, spacing: Double; same code as k_06_gripof3dpoints_nestedloops
operatorsvectors_6 = OperatorsVectors()  # -> out, Pt0, Pt1, Vec0, Vec1, AddVec, SubtractVec, DotVec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; same code as operatorsvectors

panel_10 = Panel(checkprimeandfactors_7.Factors)
panel_11 = Panel(vector_xyz_6.Length)

navigatingtopologyofbrep_3 = NavigatingTopologyOfBrep()  # -> out, Faces, FaceSurfaces, Loops2DCurves, Loops3DCurves, Edges, Trims2DCurves, Vertices; inputs brep: Brep; same code as navigatingtopologyofbrep
calculateareavolumecentroid_3 = CalculateAreaVolumeCentroid()  # -> out, Area, Vol, Centroid; inputs brep: Brep; same code as calculateareavolumecentroid
extractoutlineandignorholes_3 = ExtractOutlineAndIgnorHoles()  # -> out, Outline; inputs brep: Brep; same code as extractoutlineandignorholes
methodffsetsurfaces_3 = MethodffSetSurfaces()  # -> out, OutSrf; inputs srf: Surface, num: Int32, dis: Double, tol: Double; same code as methodffsetsurfaces
methodeveluatesurface_3 = MethodEveluateSurface()  # -> out, EvalPt, TanU, TanV; inputs srf: Surface, u: Double, v: Double; same code as methodeveluatesurface

list_item_3 = ListItem(List=vector_xyz_6.Vector, Index=0, Wrap=True)
list_item_4 = ListItem(List=vector_xyz_6.Vector, Index="1", Wrap=True)

m_16_returnsymetryplane_20 = M_16_ReturnSymetryPlane()  # -> out, symmetryPlane; inputs point1: Point3d, point2: Point3d, point3: Point3d; same code as m_16_returnsymetryplane
f_11_foreachloop_20 = F_11_ForeachLoop()  # -> out, multiplied; inputs numList: list of Double, multiplier: Double; same code as l_02_foreachloop
l_02_foreachloop_21 = L_02_ForeachLoop()  # -> out, multiplied; inputs numList: list of Double, multiplier: Double; same code as l_02_foreachloop
l_05_list3dpointandrandomclass_20 = L_05_List3DPointAndRandomClass()  # -> out, points; inputs height: Int32, spacing: Double, amplitude: Double, seed: Int32; same code as l_05_list3dpointandrandomclass
f_04_breakcontinueloopwithcomponentmessa_20 = F_04_BreakContinueLoopWithComponentMessage()  # -> out; inputs iterations: Int32, smallerThan: Int32; same code as f_04_breakcontinueloopwithcomponentmessa
l_04_randomnumbergenerator_21 = L_04_RandomNumberGenerator()  # -> out, numbers; inputs min: Double, max: Double, count: Int32, seed: Int32; same code as l_04_randomnumbergenerator
p_02_numbersorting_20 = P_02_NumberSorting()  # -> out, sorted; inputs intList: list of Int32; same code as p_02_numbersorting
k_05_series_20 = K_05_Series()  # -> out, S; inputs start: Int32, step: Int32, count: Int32; same code as k_05_series
k_06_range_20 = K_06_Range()  # -> out, R; inputs start: Double, end: Double, steps: Int32; same code as k_06_range
m_17_arrayfromstartendvalues_20 = M_17_ArrayFromStartEndValues()  # -> out, A; inputs start: Int32, end: Int32; same code as m_17_arrayfromstartendvalues

navigatingtopologyofbrep_4 = NavigatingTopologyOfBrep()  # -> out, Faces, FaceSurfaces, Loops2DCurves, Loops3DCurves, Edges, Trims2DCurves, Vertices; inputs brep: Brep; same code as navigatingtopologyofbrep
calculateareavolumecentroid_4 = CalculateAreaVolumeCentroid()  # -> out, Area, Vol, Centroid; inputs brep: Brep; same code as calculateareavolumecentroid
extractoutlineandignorholes_4 = ExtractOutlineAndIgnorHoles()  # -> out, Outline; inputs brep: Brep; same code as extractoutlineandignorholes
methodffsetsurfaces_4 = MethodffSetSurfaces()  # -> out, OutSrf; inputs srf: Surface, num: Int32, dis: Double, tol: Double; same code as methodffsetsurfaces
methodeveluatesurface_4 = MethodEveluateSurface()  # -> out, EvalPt, TanU, TanV; inputs srf: Surface, u: Double, v: Double; same code as methodeveluatesurface

navigatingtopologyofbrep_5 = NavigatingTopologyOfBrep()  # -> out, Faces, FaceSurfaces, Loops2DCurves, Loops3DCurves, Edges, Trims2DCurves, Vertices; inputs brep: Brep; same code as navigatingtopologyofbrep
calculateareavolumecentroid_5 = CalculateAreaVolumeCentroid()  # -> out, Area, Vol, Centroid; inputs brep: Brep; same code as calculateareavolumecentroid
extractoutlineandignorholes_5 = ExtractOutlineAndIgnorHoles()  # -> out, Outline; inputs brep: Brep; same code as extractoutlineandignorholes
methodffsetsurfaces_5 = MethodffSetSurfaces()  # -> out, OutSrf; inputs srf: Surface, num: Int32, dis: Double, tol: Double; same code as methodffsetsurfaces
methodeveluatesurface_5 = MethodEveluateSurface()  # -> out, EvalPt, TanU, TanV; inputs srf: Surface, u: Double, v: Double; same code as methodeveluatesurface

m_16_returnsymetryplane_21 = M_16_ReturnSymetryPlane()  # -> out, symmetryPlane; inputs point1: Point3d, point2: Point3d, point3: Point3d; same code as m_16_returnsymetryplane
f_11_foreachloop_21 = F_11_ForeachLoop()  # -> out, multiplied; inputs numList: list of Double, multiplier: Double; same code as l_02_foreachloop
l_02_foreachloop_22 = L_02_ForeachLoop()  # -> out, multiplied; inputs numList: list of Double, multiplier: Double; same code as l_02_foreachloop
l_05_list3dpointandrandomclass_21 = L_05_List3DPointAndRandomClass()  # -> out, points; inputs height: Int32, spacing: Double, amplitude: Double, seed: Int32; same code as l_05_list3dpointandrandomclass
f_04_breakcontinueloopwithcomponentmessa_21 = F_04_BreakContinueLoopWithComponentMessage()  # -> out; inputs iterations: Int32, smallerThan: Int32; same code as f_04_breakcontinueloopwithcomponentmessa
l_04_randomnumbergenerator_22 = L_04_RandomNumberGenerator()  # -> out, numbers; inputs min: Double, max: Double, count: Int32, seed: Int32; same code as l_04_randomnumbergenerator
p_02_numbersorting_21 = P_02_NumberSorting()  # -> out, sorted; inputs intList: list of Int32; same code as p_02_numbersorting
k_05_series_21 = K_05_Series()  # -> out, S; inputs start: Int32, step: Int32, count: Int32; same code as k_05_series
k_06_range_21 = K_06_Range()  # -> out, R; inputs start: Double, end: Double, steps: Int32; same code as k_06_range
m_17_arrayfromstartendvalues_21 = M_17_ArrayFromStartEndValues()  # -> out, A; inputs start: Int32, end: Int32; same code as m_17_arrayfromstartendvalues

classcreatenewnurbscurve_6 = ClassCreateNewNURBSCurve()  # -> out, InterpolateCrv, NurbsCrv; inputs points: list of Point3d, degree: Int32; same code as classcreatenewnurbscurve
classcreatepolylinefrompoints_6 = ClassCreatePolylineFromPoints()  # -> out, Crv, Type; inputs pts: list of Point3d; same code as classcreatepolylinefrompoints

operatorsvectors_7 = OperatorsVectors(v0=list_item_3)  # -> out, Pt0, Pt1, Vec0, Vec1, AddVec, SubtractVec, DotVec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; inputs v0: Vector3d
# ---------- operatorsvectors_7: C# ----------
    //Create a New instance Of a point And a vector:
    Point3d p0 = new Point3d(3, 6, 0);
    //Vector3d v0 = new Vector3d(4, 1.5, 0);
    double factor = 0.5;

    //Move a point by a vector:
    Point3d p1 = new Point3d(Point3d.Unset);
    p1 = p0 + v0;

    //Distance between 2 points:
    double distance = 0;
    distance = p0.DistanceTo(p1);

    //Point subtraction(create vector between two points):
    Vector3d v1 = new Vector3d(Vector3d.Unset);
    v1 = Point3d.Origin - p0;

    //Vector addition (create average vector):
    Vector3d addVectors = new Vector3d(Vector3d.Unset);
    addVectors = v0 + v1;

    //Vector subtraction:
    Vector3d subVectors = new Vector3d(Vector3d.Unset);
    subVectors = v0 - v1;

    //Vector dot product (if result Is positive number then vectors are In the same direction):
    double dot = 0;
    dot = v0 * v1;

    //Vector cross product (result is a vector normal to the 2 input vectors)
    Vector3d corss = new Vector3d(Vector3d.Unset);
    corss = Vector3d.CrossProduct(v0, v1);

    //Scale a vector:
    Vector3d scaleV0 = new Vector3d(Vector3d.Unset);
    scaleV0 = factor * v0;

    //Get vector length:
    double v0Length = v0.Length;

    //Assign output
    Pt0 = p0;
    Pt1 = p1;
    Vec0 = v0;
    Vec1 = v1;
    AddVec = addVectors;
    SubtractVec = subVectors;
    DotVec = dot;
    CrossVec = corss;
    ScaleVec0 = scaleV0;
    LengthVec0 = v0Length;
# ---------- end operatorsvectors_7 ----------

m_16_returnsymetryplane_22 = M_16_ReturnSymetryPlane()  # -> out, symmetryPlane; inputs point1: Point3d, point2: Point3d, point3: Point3d; same code as m_16_returnsymetryplane
f_11_foreachloop_22 = F_11_ForeachLoop()  # -> out, multiplied; inputs numList: list of Double, multiplier: Double; same code as l_02_foreachloop
l_02_foreachloop_23 = L_02_ForeachLoop()  # -> out, multiplied; inputs numList: list of Double, multiplier: Double; same code as l_02_foreachloop
l_05_list3dpointandrandomclass_22 = L_05_List3DPointAndRandomClass()  # -> out, points; inputs height: Int32, spacing: Double, amplitude: Double, seed: Int32; same code as l_05_list3dpointandrandomclass
f_04_breakcontinueloopwithcomponentmessa_22 = F_04_BreakContinueLoopWithComponentMessage()  # -> out; inputs iterations: Int32, smallerThan: Int32; same code as f_04_breakcontinueloopwithcomponentmessa
l_04_randomnumbergenerator_23 = L_04_RandomNumberGenerator()  # -> out, numbers; inputs min: Double, max: Double, count: Int32, seed: Int32; same code as l_04_randomnumbergenerator
p_02_numbersorting_22 = P_02_NumberSorting()  # -> out, sorted; inputs intList: list of Int32; same code as p_02_numbersorting
k_05_series_22 = K_05_Series()  # -> out, S; inputs start: Int32, step: Int32, count: Int32; same code as k_05_series
k_06_range_22 = K_06_Range()  # -> out, R; inputs start: Double, end: Double, steps: Int32; same code as k_06_range
m_17_arrayfromstartendvalues_22 = M_17_ArrayFromStartEndValues()  # -> out, A; inputs start: Int32, end: Int32; same code as m_17_arrayfromstartendvalues

merge_2 = Merge(
    Data1=operatorsvectors_7.Pt0,
    Data2=operatorsvectors_7.Pt1,
    Data3=operatorsvectors_7.Vec0,
    Data4=operatorsvectors_7.Vec1,
    Data5=operatorsvectors_7.AddVec,
    Data6=operatorsvectors_7.SubtractVec,
    Data7=operatorsvectors_7.DotVec,
    Data8=operatorsvectors_7.CrossVec,
    Data9=operatorsvectors_7.ScaleVec0,
    Data10=operatorsvectors_7.LengthVec0)
getpointcoordinates_9 = GetPointCoordinates(pt=operatorsvectors_7.ScaleVec0)  # -> out, A, B, C; inputs pt: Point3d; same code as getpointcoordinates
panel_12 = Panel(merge_2)

methodcreatecurveoffset_6 = MethodCreateCurveOffset()  # -> out, OffsetCrv; inputs crv: Curve, offset: Double; same code as methodcreatecurveoffset
methodcreatecurvesbetweentwocurves_6 = MethodCreateCurvesBetweenTwoCurves()  # -> out, Curves; inputs curve0: Curve, curve1: Curve, count: Int32; same code as methodcreatecurvesbetweentwocurves
methodgetcontrolpointsofnurbscurve_6 = MethodGetControlPointsOfNURBSCurve()  # -> out, CPoints; inputs crv: Curve; same code as methodgetcontrolpointsofnurbscurve

k_06_gripof3dpoints_nestedloops_7 = K_06_GripOf3DPointsNestedLoops(x=operatorsvectors_7.Pt0, y=operatorsvectors_7.Pt1, z=operatorsvectors_7.AddVec, spacing=Slider(58, range=0..100))  # -> out, ptGrid; inputs x: Int32, y: Int32, z: Int32, spacing: Double; same code as k_06_gripof3dpoints_nestedloops

m_16_returnsymetryplane_23 = M_16_ReturnSymetryPlane()  # -> out, symmetryPlane; inputs point1: Point3d, point2: Point3d, point3: Point3d; same code as m_16_returnsymetryplane
f_11_foreachloop_23 = F_11_ForeachLoop()  # -> out, multiplied; inputs numList: list of Double, multiplier: Double; same code as l_02_foreachloop
l_02_foreachloop_24 = L_02_ForeachLoop()  # -> out, multiplied; inputs numList: list of Double, multiplier: Double; same code as l_02_foreachloop
l_05_list3dpointandrandomclass_23 = L_05_List3DPointAndRandomClass()  # -> out, points; inputs height: Int32, spacing: Double, amplitude: Double, seed: Int32; same code as l_05_list3dpointandrandomclass
f_04_breakcontinueloopwithcomponentmessa_23 = F_04_BreakContinueLoopWithComponentMessage()  # -> out; inputs iterations: Int32, smallerThan: Int32; same code as f_04_breakcontinueloopwithcomponentmessa
l_04_randomnumbergenerator_24 = L_04_RandomNumberGenerator()  # -> out, numbers; inputs min: Double, max: Double, count: Int32, seed: Int32; same code as l_04_randomnumbergenerator
p_02_numbersorting_23 = P_02_NumberSorting()  # -> out, sorted; inputs intList: list of Int32; same code as p_02_numbersorting
k_05_series_23 = K_05_Series()  # -> out, S; inputs start: Int32, step: Int32, count: Int32; same code as k_05_series
k_06_range_23 = K_06_Range()  # -> out, R; inputs start: Double, end: Double, steps: Int32; same code as k_06_range
m_17_arrayfromstartendvalues_23 = M_17_ArrayFromStartEndValues()  # -> out, A; inputs start: Int32, end: Int32; same code as m_17_arrayfromstartendvalues

navigatingtopologyofbrep_6 = NavigatingTopologyOfBrep()  # -> out, Faces, FaceSurfaces, Loops2DCurves, Loops3DCurves, Edges, Trims2DCurves, Vertices; inputs brep: Brep; same code as navigatingtopologyofbrep
calculateareavolumecentroid_6 = CalculateAreaVolumeCentroid()  # -> out, Area, Vol, Centroid; inputs brep: Brep; same code as calculateareavolumecentroid
extractoutlineandignorholes_6 = ExtractOutlineAndIgnorHoles()  # -> out, Outline; inputs brep: Brep; same code as extractoutlineandignorholes
methodffsetsurfaces_6 = MethodffSetSurfaces()  # -> out, OutSrf; inputs srf: Surface, num: Int32, dis: Double, tol: Double; same code as methodffsetsurfaces
methodeveluatesurface_6 = MethodEveluateSurface()  # -> out, EvalPt, TanU, TanV; inputs srf: Surface, u: Double, v: Double; same code as methodeveluatesurface

classcreatenewnurbscurve_7 = ClassCreateNewNURBSCurve(points=vector_xyz_6.Vector, degree="3")  # -> out, InterpolateCrv, NurbsCrv; inputs points: list of Point3d, degree: Int32; same code as classcreatenewnurbscurve
classcreatepolylinefrompoints_7 = ClassCreatePolylineFromPoints(pts=vector_xyz_6.Vector)  # -> out, Crv, Type; inputs pts: list of Point3d; same code as classcreatepolylinefrompoints

methodcreatecurveoffset_7 = MethodCreateCurveOffset(crv=classcreatenewnurbscurve_7.NurbsCrv, offset=operatorsvectors_7.LengthVec0)  # -> out, OffsetCrv; inputs crv: Curve, offset: Double; same code as methodcreatecurveoffset
methodcreatecurvesbetweentwocurves_7 = MethodCreateCurvesBetweenTwoCurves(curve0=classcreatenewnurbscurve_7.InterpolateCrv, curve1=classcreatenewnurbscurve_7.NurbsCrv, count="3")  # -> out, Curves; inputs curve0: Curve, curve1: Curve, count: Int32; same code as methodcreatecurvesbetweentwocurves
methodgetcontrolpointsofnurbscurve_7 = MethodGetControlPointsOfNURBSCurve(crv=classcreatenewnurbscurve_7.NurbsCrv)  # -> out, CPoints; inputs crv: Curve; same code as methodgetcontrolpointsofnurbscurve

number_slider_19 = Slider(94, range=0..100)
loft_2 = Loft(
    Curves=methodcreatecurvesbetweentwocurves_7.Curves,
    Options={Adjust=False, Closed=False, LoftEnds=0, LoftSimp=0, LoftType=0, Rebuild=10, Refit=0.01})
point_27 = Point(k_06_gripof3dpoints_nestedloops_7.ptGrid)

# ----
# 009
# FIRST GENERATION:
# PLAYFUL AND EXPERIMENTAL
gene_pool_7 = GenePool(Decimals=2, Maximum=10, Minimum=0, Value=[3.65, 9.33, 2.53])
merge_3 = Merge(Data1=point_7, Data2=point_8, Data3=point_9, Data4=point_6)
vector_xyz_7 = VectorXYZ(XComponent=gene_pool_7, YComponent=gene_pool_7, ZComponent=gene_pool_7)  # -> Vector, Length
list_item_5 = ListItem(List=vector_xyz_7.Vector, Index=Slider(2, range=0..2), Wrap=True)
gene_pool_8 = GenePool(Decimals=0, Maximum=10, Minimum=0, Value=[1.895979159, 4.103441306, 3.903749648, 1.732849223, 5.136153174])
gene_pool_9 = GenePool(Decimals=0, Maximum=10, Minimum=0, Value=[1.895979159, 4.103441306, 3.903749648, 1.732849223, 5.136153174])
gene_pool_10 = GenePool(Decimals=0, Maximum=10, Minimum=0, Value=[1.895979159, 4.103441306, 3.903749648, 1.732849223, 5.136153174])
move_2 = Move(Geometry=list_item_5, Motion=vector_xyz_7.Vector)  # -> Geometry, Transform
number_slider_20 = Slider(26, range=0..100)

constructnumtree_7 = ConstructTreeOfNumbers(branchNum=gene_pool_8, countNum=gene_pool_9, number=gene_pool_10)  # -> out, Numbers; inputs branchNum: Int32, countNum: Int32, number: Int32; same code as constructnumtree
methodpointtransformx_7 = MethodPointTransformX(pt=merge_3, xform=move_2.Transform)  # -> out, Point; inputs pt: Point3d, xform: Transform; same code as methodpointtransformx
operatoraddtwopoints_7 = OperatorAddTwoPoints(pt1=point_7, pt2=point_8)  # -> out, Point; inputs pt1: Point3d, pt2: Point3d; same code as operatoraddtwopoints
getpointcoordinates_10 = GetPointCoordinates(pt=merge_3)  # -> out, A, B, C; inputs pt: Point3d; same code as getpointcoordinates
getoriginpoint_8 = GetOriginPoint()  # -> out, Origin; same code as getoriginpoint

panel_13 = Panel(methodpointtransformx_7.Point)
absolute_2 = Absolute(Value=getpointcoordinates_10.A)
panel_14 = Panel(constructnumtree_7.Numbers)
list_item_6 = ListItem(List=constructnumtree_7.Numbers, Index="3", Wrap=True)

l_04_randomnumbergenerator_25 = L_04_RandomNumberGenerator(min=constructnumtree_7.Numbers, max=list_item_6, count="3", seed=number_slider_20)  # -> out, numbers; inputs min: Double, max: Double, count: Int32, seed: Int32; same code as l_04_randomnumbergenerator
m_16_returnsymetryplane_24 = M_16_ReturnSymetryPlane(point1=methodpointtransformx_7.Point, point2=getoriginpoint_8.Origin, point3=operatoraddtwopoints_7.Point)  # -> out, symmetryPlane; inputs point1: Point3d, point2: Point3d, point3: Point3d; same code as m_16_returnsymetryplane
f_11_foreachloop_24 = F_11_ForeachLoop(numList=constructnumtree_7.Numbers, multiplier="3")  # -> out, multiplied; inputs numList: list of Double, multiplier: Double; same code as l_02_foreachloop
l_02_foreachloop_25 = L_02_ForeachLoop(numList=constructnumtree_7.Numbers, multiplier=list_item_6)  # -> out, multiplied; inputs numList: list of Double, multiplier: Double; same code as l_02_foreachloop
l_05_list3dpointandrandomclass_24 = L_05_List3DPointAndRandomClass(height=absolute_2, spacing=getpointcoordinates_10.B, amplitude=getpointcoordinates_10.C, seed=number_slider_20)  # -> out, points; inputs height: Int32, spacing: Double, amplitude: Double, seed: Int32; same code as l_05_list3dpointandrandomclass
f_04_breakcontinueloopwithcomponentmessa_24 = F_04_BreakContinueLoopWithComponentMessage(iterations=constructnumtree_7.Numbers, smallerThan=list_item_6)  # -> out; inputs iterations: Int32, smallerThan: Int32; same code as f_04_breakcontinueloopwithcomponentmessa
p_02_numbersorting_24 = P_02_NumberSorting(intList=constructnumtree_7.Numbers)  # -> out, sorted; inputs intList: list of Int32; same code as p_02_numbersorting
k_05_series_24 = K_05_Series(start=list_item_6, step=list_item_6, count=list_item_6)  # -> out, S; inputs start: Int32, step: Int32, count: Int32; same code as k_05_series
k_06_range_24 = K_06_Range(start=getpointcoordinates_10.A, end=getpointcoordinates_10.B, steps="3")  # -> out, R; inputs start: Double, end: Double, steps: Int32; same code as k_06_range
m_17_arrayfromstartendvalues_24 = M_17_ArrayFromStartEndValues(start=methodpointtransformx_7.Point, end=operatoraddtwopoints_7.Point)  # -> out, A; inputs start: Int32, end: Int32; same code as m_17_arrayfromstartendvalues

panel_15 = Panel(l_05_list3dpointandrandomclass_24.points)
interpolate_2 = Interpolate(Vertices=l_05_list3dpointandrandomclass_24.points, Degree=3, Periodic=False, KnotStyle=1)  # -> Curve, Length, Domain
panel_16 = Panel(l_04_randomnumbergenerator_25.numbers)
cull_index_3 = CullIndex(List=flatten(interpolate_2.Curve), Indices="-1", Wrap=True)
pipe_2 = Pipe(Curve=cull_index_3, Radius=1, Caps=0)

methodffsetsurfaces_7 = MethodffSetSurfaces(srf=loft_2, num="3", dis=Slider(10, range=0..10))  # -> out, flatten(OutSrf); inputs srf: Surface, num: Int32, dis: Double, tol: Double; same code as methodffsetsurfaces
methodeveluatesurface_7 = MethodEveluateSurface(srf=loft_2, u=number_slider_19, v=number_slider_19)  # -> out, EvalPt, TanU, TanV; inputs srf: Surface, u: Double, v: Double; same code as methodeveluatesurface
navigatingtopologyofbrep_7 = NavigatingTopologyOfBrep(brep=methodffsetsurfaces_7.OutSrf)  # -> out, Faces, FaceSurfaces, Loops2DCurves, Loops3DCurves, Edges, Trims2DCurves, Vertices; inputs brep: Brep; same code as navigatingtopologyofbrep
extractoutlineandignorholes_7 = ExtractOutlineAndIgnorHoles(brep=methodffsetsurfaces_7.OutSrf)  # -> out, Outline; inputs brep: Brep; same code as extractoutlineandignorholes

list_item_7 = ListItem(List=extractoutlineandignorholes_7.Outline, Index=0, Wrap=True)  # -> Item, Item1, Item2, Item3, Item4, Item5, Item6, Item7
cull_index_4 = CullIndex(List=flatten(list_item_7.Item7), Indices="0", Wrap=True)
loft_3 = Loft(
    Curves=flatten(cull_index_4),
    Options={Adjust=False, Closed=False, LoftEnds=0, LoftSimp=0, LoftType=0, Rebuild=10, Refit=0.01})

calculateareavolumecentroid_7 = CalculateAreaVolumeCentroid(brep=loft_3)  # -> out, Area, Vol, Centroid; inputs brep: Brep; same code as calculateareavolumecentroid

orient = Orient(Geometry=loft_3, Source=calculateareavolumecentroid_7.Centroid, Target=methodeveluatesurface_7.EvalPt)  # -> Geometry, Transform
